# Grasshopper definition Math_Domain.ghx (Grasshopper 1.0.7)

# ---- group: Grasshopper Bnd
bnd = Bounds()

# ----
c_bnd = CSharpScript()  # -> Out, I

# ---- group: Grasshopper Consec
consec = ConsecutiveDomains(Numbers=[0, 0.5, 1, 1.5, 2], Additive=True)

# ----
c_consec = CSharpScript()  # -> Out, D

# ---- group: Grasshopper Div
div = DivideDomain(Domain=Domain(0, 1), Count=10)

# ----
c_div = CSharpScript()  # -> Out, S

# ---- group: Grasshopper FDom
fdom = FindDomain(Strict=False)  # -> Index, Neighbour

# ----
c_fdom = CSharpScript()  # -> Out, I, N

# ---- group: Grasshopper Inc
inc = Includes(Domain=Domain(0, 1))  # -> Includes, Deviation

# ---- group: C# Inc
c_script = CSharpScript()  # -> Out, I, D

# ---- group: Grasshopper ReMap
remap = RemapNumbers(Source=Domain(0, 1), Target=Domain(0, 1))  # -> Mapped, Clipped

# ----
c_remap = CSharpScript()  # -> Out, R, C

# ---- group: Grasshopper Dom²Num
dom²num = ConstructDomain²(UMin=0, UMax=1, VMin=0, VMax=1)

# ----
c_dom²num = CSharpScript()  # -> Out, _2dDomain

# ---- group: Grasshopper Dom²Num
dom² = ConstructDomain²(DomainU=Domain(0, 1), DomainV=Domain(0, 1))

# ----
c_dom²num_2 = CSharpScript()  # -> Out, _2dDomain

# ---- group: Grasshopper DeDom2Num
dedom2num = DeconstructDomain²()  # -> UMin, UMax, VMin, VMax

# ---- group: C# DeDom2Num
c_dom²num_3 = CSharpScript()  # -> Out, U0, U1, V0, V1

# ---- group: Grasshopper DeDom2
dedom2 = DeconstructDomain²()  # -> UComponent, VComponent

# ----
c_dedom2 = CSharpScript()  # -> Out, U, V

# ---- group: Grasshopper Bnd
bnd_2 = Bounds2D()

# ----
c_bnd_2 = CSharpScript()  # -> Out, I

# ---- group: Grasshopper C# Divide
divide = DivideDomain²(UCount=10, VCount=10)

# ----
c_divide = CSharpScript()  # -> Out, I

# ----
# GH#: A C# dictionary of Grasshopper3D components.
# 
# This file contains a category of Grasshopper components, and a mirroring C#/RhinoCommon implementation.
# 
# This is an educational project initiated by students/faculty of GSD-6338: Introduction to Computational Design, at the Harvard Graduate School of Design.
# 
# More information: {{project link}}
# Math Domain
# Math Domain Incomplete: Bounds(Bnd)
# Consecutive Domains (Consec)
# Divide Domain (Div)
# Find Domain (FDom)
# Includes (Inc)
# Remap Numbers (ReMap)
# ConstructDomain² (Dom²Num)
# ConstructDomain² (Dom²)
# DeconstructDomain² (DeDom2Num)
# DeconstructDomain² (DeDom2)
# Bounds2D (Bnd)
# Divide Domain² (Divide)
number_slider = Slider(5, range=0..10)
number_slider_2 = Slider(6, range=0..10)
c_dom = CSharpScript(A=number_slider, B=number_slider_2)  # -> out, I; inputs A: Double, B: Double
# ---------- c_dom: C# ----------
    // Component written by @erinlinseyhunt

    // Creating a new Domain with an Interval
    Interval dx = new Interval(A, B);

    // Output
    I = dx;
# ---------- end c_dom ----------
panel = Panel(c_dom.I)

# ---- group: Grasshopper Dom
dom = ConstructDomain(DomainStart=number_slider, DomainEnd=number_slider_2)

# ----
panel_2 = Panel(dom)

dom_2 = ConstructDomain(DomainStart=Slider(5, range=0..10), DomainEnd=Slider(6, range=0..10))

# ---- group: Grasshopper DeDomain
dedomain = DeconstructDomain(Domain=dom_2)  # -> Start, End

# ---- group: C# DeDomain
c_script_2 = CSharpScript(I=dom_2)  # -> out, S, E
# ---------- c_script_2: C# ----------
    // Component written by @erinlinseyhunt

    // Output
    S = I.T0;    // getting the lower bound of the domain
    E = I.T1; // getting the upper bound of the domain
# ---------- end c_script_2 ----------

# ----
panel_3 = Panel(dedomain.Start)
panel_4 = Panel(dedomain.End)

panel_5 = Panel(c_script_2.S)
panel_6 = Panel(c_script_2.E)
