# Grasshopper definition Maths_Time.ghx (Grasshopper 1.0.7)

# ----
# GH#: A C# dictionary of Grasshopper3D components.
# 
# This file contains a category of Grasshopper components, and a mirroring C#/RhinoCommon implementation.
# 
# This is an educational project initiated by students/faculty of GSD-6338: Introduction to Computational Design, at the Harvard Graduate School of Design.
# 
# More information: {{project link}}
# Maths Time
number_slider = Slider(2020, range=0..2100)
number_slider_2 = Slider(11, range=0..12)
number_slider_3 = Slider(11, range=0..31)
number_slider_4 = Slider(13, range=0..24)
number_slider_5 = Slider(26, range=0..60)
number_slider_6 = Slider(21, range=0..60)
gh_date = CSharpScript(Y=number_slider, M=number_slider_2, D=number_slider_3, h=number_slider_4, m=number_slider_5, s=number_slider_6)  # -> out, Dout; inputs Y: Int32, M: Int32, D: Int32, h: Int32, m: Int32, s: Int32
# ---------- gh_date: C# ----------
    // Component written by @garciadelcastillo

    // This component creates a system DateTime object.
    
    // TODO: Implement all the DateTime checks the original component features
    Component.AddRuntimeMessage(GH_RuntimeMessageLevel.Warning, "This component doesn't mimic the error checks of the original");
  
    // Create DateTime object from inputs
    DateTime dt = new DateTime(Y, M, D, h, m, s);
    
    // Output
    Dout = dt;
# ---------- end gh_date ----------
date = ConstructDate(
    Year=number_slider,
    Month=number_slider_2,
    Day=number_slider_3,
    Hour=number_slider_4,
    Minute=number_slider_5,
    Second=number_slider_6)
panel = Panel(date)
panel_2 = Panel(gh_date.Dout)

number_slider_7 = Slider(11.38, range=0..31)
number_slider_8 = Slider(13, range=0..24)
number_slider_9 = Slider(26, range=0..60)
number_slider_10 = Slider(21, range=0..60)
c_script = CSharpScript(D=number_slider_7, H=number_slider_8, M=number_slider_9, S=number_slider_10)  # -> out, T; inputs D: Double, H: Double, M: Double, S: Double
# ---------- c_script: C# usings ----------
// We need to bring in the calendars
using System.Globalization;
# ---------- c_script: C# ----------
    // Component written by @garciadelcastillo

    // This component creates a time object accepting non-integer
    // parameters as inputs and aggregating them "smoothly".

    // For this, let's compute the total time in milliseconds to get some precision
    long mS = (long) (S * 1000);
    long mM = (long) (M * 60 * 1000);
    long mH = (long) (H * 60 * 60 * 1000);
    long mD = (long) (D * 24 * 60 * 60 * 1000);
    long totalMillis = mS + mM + mH + mD;

    // Create a time object using these millis,
    // converted to "ticks" (1 ms == 10000 ticks).
    // https://docs.microsoft.com/en-us/dotnet/api/system.datetime.ticks?view=net-5.0
    DateTime dt = new DateTime(totalMillis * 10000);

    // Output
    T = dt;
# ---------- end c_script ----------
smtime = ConstructSmoothTime(Days=number_slider_7, Hours=number_slider_8, Minutes=number_slider_9, Seconds=number_slider_10)
panel_3 = Panel(smtime)
panel_4 = Panel(c_script.T)

number_slider_11 = Slider(13, range=0..24)
number_slider_12 = Slider(26, range=0..60)
number_slider_13 = Slider(21, range=0..60)
time = ConstructTime(Hour=number_slider_11, Minute=number_slider_12, Second=number_slider_13)
c_script_2 = CSharpScript(H=number_slider_11, M=number_slider_12, S=number_slider_13)  # -> out, T; inputs H: Int32, M: Int32, S: Int32
# ---------- c_script_2: C# ----------
    // Component written by @garciadelcastillo

    // Creates a time-only object using GH's DateTime converter
    DateTime dt = GH_Convert.CreatePureTime(H, M, S);

    // Output
    T = dt;
# ---------- end c_script_2 ----------
panel_5 = Panel(time)
panel_6 = Panel(c_script_2.T)

date_2 = ConstructDate(
    Year=Slider(2020, range=0..2100),
    Month=Slider(11, range=0..12),
    Day=Slider(11, range=0..31),
    Hour=12,
    Minute=0,
    Second=0)
date_3 = ConstructDate(Year=1970, Month=1, Day=1, Hour=Slider(13, range=0..24), Minute=Slider(26, range=0..60), Second=Slider(21, range=0..60))
panel_7 = Panel([date_2, date_3])
c_script_3 = CSharpScript(D=date_2, T=date_3)  # -> out, R
# ---------- c_script_3: C# ----------
    // Component written by @garciadelcastillo

    // This component creates a DateTime object combining
    // the date portion of the first input with
    // the time portion of the second.

    R = new DateTime(D.Year, D.Month, D.Day, T.Hour, T.Minute, T.Second);
# ---------- end c_script_3 ----------
cdate = CombineDateTime(Date=date_2, Time=date_3)
panel_8 = Panel(c_script_3.R)
panel_9 = Panel(cdate)

number_slider_14 = Slider(2020, range=0..2100)
number_slider_15 = Slider(11, range=0..12)
number_slider_16 = Slider(11, range=0..31)
list = ValueList({"Gregorian", "Julian", "Hebrew", "Persian", "Um Al Qura", "Hijri", "Buddist (Thai)", "Chinese (LS)", "Japanese", "Japanese (LS)", "Korean", "Korean (LS)", "Taiwan", "Taiwan (LS)"}, selected="Persian")
c_script_4 = CSharpScript(Y=number_slider_14, M=number_slider_15, D=number_slider_16, c=list)  # -> out, T; inputs Y: Int32, M: Int32, D: Int32, c: String
# ---------- c_script_4: C# ----------
    // Component written by @garciadelcastillo

    // This component creates a system DateTime object with an "exotic" calendar.

    // Create an instance of the target calendar
    Calendar calendar = CultureInfo.InvariantCulture.Calendar;
    if (c == "Gregorian")
    {
      calendar = new GregorianCalendar();
    }
    else if (c == "Julian")
    {
      calendar = new JulianCalendar();
    }
    else if (c == "Hebrew")
    {
      calendar = new HebrewCalendar();
    }
    else if (c == "Persian")
    {
      calendar = new PersianCalendar();
    }
    else if (c == "Um Al Qura")
    {
      calendar = new UmAlQuraCalendar();
    }
    else if (c == "Hijri")
    {
      calendar = new HijriCalendar();
    }
    else if (c == "Buddist (Thai)")
    {
      calendar = new ThaiBuddhistCalendar();
    }
    else if (c == "Chinese (LS)")
    {
      calendar = new ChineseLunisolarCalendar();
    }
    else if (c == "Japanese")
    {
      calendar = new JapaneseCalendar();
    }
    else if (c == "Japanese (LS)")
    {
      calendar = new JapaneseLunisolarCalendar();
    }
    else if (c == "Korean")
    {
      calendar = new KoreanCalendar();
    }
    else if (c == "Korean (LS)")
    {
      calendar = new KoreanLunisolarCalendar();
    }
    else if (c == "Taiwan")
    {
      calendar = new TaiwanCalendar();
    }
    else if (c == "Taiwan (LS)")
    {
      calendar = new TaiwanLunisolarCalendar();
    }
    else
    {
      Component.AddRuntimeMessage(GH_RuntimeMessageLevel.Error, "Calendar not implemented");
      return;
    }

    // Create DateTime object from inputs, using this calendar
    DateTime dt = new DateTime(Y, M, D, calendar);

    // Output
    T = dt;
# ---------- end c_script_4 ----------
dateex = ConstructExoticDate(Year=number_slider_14, Month=number_slider_15, Day=number_slider_16, Calendar=3)
panel_10 = Panel(dateex)
panel_11 = Panel(c_script_4.T)

number_slider_17 = Slider(0.652, range=0..1)
time_2 = Time(date_3)
time_3 = Time(date_2)
intdate = InterpolateDate(DateA=time_3, DateB=time_2, Interpolation=number_slider_17)
c_script_5 = CSharpScript(A=time_3, B=time_2, t=number_slider_17)  # -> out, R; inputs t: Double
# ---------- c_script_5: C# ----------
    // Component written by @garciadelcastillo

    // This component takes to DateTimes, and calculates
    // an intermediate one at a proportional distance between them.

    // To do these calculations, let's convert the times to ticks.
    // https://docs.microsoft.com/en-us/dotnet/api/system.datetime.ticks?view=net-5.0
    long start = A.Ticks;
    long end = B.Ticks;
    
    // Calculate the difference, and the proportional ticks for the new date.
    long diff = end - start;
    long interpolatedTicks = start + (long) (t * diff);
    DateTime dt = new DateTime(interpolatedTicks);
    
    // Output
    R = dt;
# ---------- end c_script_5 ----------
panel_12 = Panel(c_script_5.R)
panel_13 = Panel(intdate)

time_4 = Time(date)
c_script_6 = CSharpScript(D=time_4)  # -> out, Y, M, Dout, h, m, s
# ---------- c_script_6: C# ----------
    // Component written by @garciadelcastillo
    
    // This component takes a DateTime object and extracts its parameters
    Y = D.Year;
    M = D.Month;
    Dout = D.Day;
    h = D.Hour;
    m = D.Minute;
    s = D.Second;
# ---------- end c_script_6 ----------
ddate = DeconstructDate(Date=time_4)  # -> Year, Month, Day, Hour, Minute, Second
panel_14 = Panel([ddate.Year, ddate.Month, ddate.Day, ddate.Hour, ddate.Minute, ddate.Second])
panel_15 = Panel([c_script_6.Y, c_script_6.M, c_script_6.Dout, c_script_6.h, c_script_6.m, c_script_6.s])

number_slider_18 = Slider(5, range=0..10)
time_5 = Time(date_3)
time_6 = Time(date_2)
c_script_7 = CSharpScript(A=time_6, B=time_5, N=number_slider_18)  # -> out, R; inputs N: Int32
# ---------- c_script_7: C# ----------
    // Component written by @garciadelcastillo

    // This component divides the time between the two DateTime extremes
    // and outputs a list of the intermediate dates.
    
    // To do these calculations, let's convert the times to ticks
    // and calculate the amount of ticks on each interval.
    // https://docs.microsoft.com/en-us/dotnet/api/system.datetime.ticks?view=net-5.0
    long start = A.Ticks;
    long end = B.Ticks;
    double interval = (end - start) / (N - 1);
    
    // Create a list of DateTimes and compute them incrementally.
    List<DateTime> dates = new List<DateTime>();
    for (int i = 0; i < N; i++)
    {
      long ticks = start + (long) (i * interval);
      DateTime date = new DateTime(ticks);
      dates.Add(date);
    }
    
    // Output
    R = dates;
# ---------- end c_script_7 ----------
rdate = DateRange(TimeA=time_6, TimeB=time_5, Count=number_slider_18)
panel_16 = Panel(rdate)
panel_17 = Panel(c_script_7.R)
