# Grasshopper definition Maths_Trig.ghx (Grasshopper 1.0.7)

alpha = Slider(47.18, range=0..360)
beta = Slider(73.85, range=0..360)
P = Slider(62.53, range=0..100)
Q = Slider(65.67, range=0..100)
R = Slider(70.36, range=0..100)
rad = Radians(Degrees=alpha)
rad_2 = Radians(Degrees=beta)
rtrig = RightTrigonometry(PLength=P, QLength=Q)  # -> Alpha, Beta, PLength, QLength, RLength
c_script = CSharpScript(P=P, Q=Q)  # -> out, alphaOut, betaOut, POut, QOut, ROut; inputs alpha: Double, beta: Double, P: Double, Q: Double, R: Double
# ---------- c_script: C# ----------
    // Component written by @garciadelcastillo
    
    // This component calculates the trigonometry of the square triangle,
    // given any valid combination of inputs. 
    // WARNING: behavior is not identical to vanilla component,
    // as the original would yield invalid combinations of values
    // when input data is overconstrained. 
    
    // Define terms to compute
    double computedA = 0,
      computedB = 0,
      computedC = 0,
      computedAlpha = 0,
      computedBeta = 0;
    string computedMessage = "";

    // We will rely on a custom function to take care of figuring out
    // amount of inputs, their valid combinations and sanity checks:
    bool success = ComputeSquareTriangleFromAnglesAndSides(alpha, beta, Q, P, R,
      out computedA, out computedB, out computedC,
      out computedAlpha, out computedBeta, out computedMessage);
    if (!success)
    {
      this.Component.AddRuntimeMessage(GH_RuntimeMessageLevel.Warning, computedMessage);
    }

    // Outputs
    alphaOut = computedAlpha;
    betaOut = computedBeta;
    POut = computedB;
    QOut = computedA;
    ROut = computedC;
# ---------- c_script: C# additional code ----------
  /// <summary>
  /// Computes the sides of a square triangle and their angles,
  /// given a variable amount of input angle and sides data. 
  /// Includes sanity checks and an output message parameter 
  /// informing of what was going on.
  /// Returns false if calculations went wrong.
  /// </summary>
  /// <param name="alpha"></param>
  /// <param name="beta"></param>
  /// <param name="a"></param>
  /// <param name="b"></param>
  /// <param name="c"></param>
  /// <param name="sideA"></param>
  /// <param name="sideB"></param>
  /// <param name="sideC"></param>
  /// <param name="alphaOut"></param>
  /// <param name="betaOut"></param>
  /// <param name="message"></param>
  /// <returns></returns>
  bool ComputeSquareTriangleFromAnglesAndSides(double alpha, double beta,
    double a, double b, double c,
    out double sideA, out double sideB, out double sideC,
    out double alphaOut, out double betaOut, out string message)
  {
    double HALF_PI = 0.5 * Math.PI;
    string msg = "";

    // Compute how many angles and sides are available as inputs
    int availableAngles = 0;
    int availableSides = 0;
    if (!Equals(alpha, 0)) availableAngles++;
    if (!Equals(beta, 0)) availableAngles++;
    if (!Equals(a, 0)) availableSides++;
    if (!Equals(b, 0)) availableSides++;
    if (!Equals(c, 0)) availableSides++;

    // If only one input angle is available, compute the other and count up
    if (availableAngles == 1)
    {
      // Override input arguments
      if (Equals(alpha, 0))
      {
        alpha = HALF_PI - beta;
      }
      else
      {
        beta = HALF_PI - alpha;
      }
      availableAngles = 2;
    }
    
    // Are angles right?
    if (alpha < 0 || beta < 0 || alpha > HALF_PI || beta > HALF_PI) 
    {
      msg = "Angles sum up to more than Pi, which precludes a valid triangle";
    }

      // If both input angles are zero
    else if (availableAngles == 0)
    {
      // If all sides are available, return ComputeSquareTriangleFromSides
      if (availableSides > 1)
      {
        return ComputeSquareTriangleFromSides(a, b, c, out sideA, out sideB, out sideC, out alphaOut, out betaOut, out message);
      }
      else
      {
        msg = "Not enough data to compute triangle";
      }
    }

      // If both input angles are available
    else if (availableAngles == 2)
    {
      // If they add up to Pi
      if (Equals(alpha + beta - 0.5 * Math.PI, 0))
      {
        // If more or less than one input side
        if (availableSides < 1)
        {
          msg = "Triangulation is underconstrained, please reduce number of inputs.";
        }
        else if (availableSides > 1)
        {
          msg = "Triangulation is overconstrained, please reduce number of inputs.";
        }
        else {
          alphaOut = alpha;
          betaOut = beta;

          // Is hypotenuse available?
          if (!Equals(c, 0))
          {
            sideC = c;
            sideA = sideC * Math.Sin(alpha);
            sideB = sideC * Math.Sin(beta);
            message = "Computed sides A & B";
          }
            // Are the cathethi (legs) available?
          else if (!Equals(a, 0))
          {
            sideA = a;
            sideC = sideA / Math.Sin(alpha);
            sideB = sideC * Math.Sin(beta);
            message = "Computed sides B & C";
          }
          else
          {
            sideB = b;
            sideC = sideB / Math.Sin(beta);
            sideA = sideC * Math.Sin(alpha);
            message = "Computed sides A & C";
          }

          return true;
        }
      }
      else
      {
        msg = "Alpha, Beta and Gamma angles do not sum up to Pi, which precludes a valid triangle";
      }
    }

    // If here, something went wrong,
    // so zero everything and return false.
    sideA = 0;
    sideB = 0;
    sideC = 0;
    alphaOut = 0;
    betaOut = 0;
    message = msg;
    return false;
  }
  
  /// <summary>
  /// Computes the sides of a square triangle and their angles,
  /// given a variable amount of input sides data. 
  /// Includes sanity checks and an output message parameter 
  /// informing of what was going on.
  /// Returns false if calculations went wrong.
  /// </summary>
  /// <param name="a"></param>
  /// <param name="b"></param>
  /// <param name="c"></param>
  /// <param name="sideA"></param>
  /// <param name="sideB"></param>
  /// <param name="sideC"></param>
  /// <param name="alpha"></param>
  /// <param name="beta"></param>
  /// <param name="message"></param>
  /// <returns></returns>
  bool ComputeSquareTriangleFromSides(double a, double b, double c,
    out double sideA, out double sideB, out double sideC,
    out double alpha, out double beta, out string message)
  {
    string msg = "";

    // Sanity: check if there are at least two sides available as arguments
    if ((Equals(a, 0) && (Equals(b, 0) || Equals(c, 0)))
      || (Equals(b, 0) && Equals(c, 0)))
    {
      // Do nothing, silently fail at the end of function
      msg = "Not enough input data to compute triangle sides";
    }

      // Sanity: check if all sides are given
    else if (!Equals(a, 0) && !Equals(b, 0) && !Equals(c, 0))
    {
      msg = "Too much data to compute triangle sides, problem is overconstrained";
    }

      // Are the catheti (legs) available?
    else if (!Equals(a, 0) && !Equals(b, 0))
    {
      // Apply straight Pythagorean theorem
      sideA = a;
      sideB = b;
      sideC = Math.Sqrt(a * a + b * b);
      alpha = Math.Asin(sideA / sideC);
      beta = Math.Asin(sideB / sideC);
      message = "Computed side C";
      return true;
    }

      // Is a cathetus (leg) and hypotenuse available?
    else if (!Equals(a, 0) && !Equals(c, 0))
    {
      if (a > c)
      {
        msg = "Invalid right triangle: cathetus is larger than hypotenuse";
      }
      else
      {
        sideA = a;
        sideC = c;
        sideB = Math.Sqrt(c * c - a * a);
        alpha = Math.Asin(sideA / sideC);
        beta = Math.Asin(sideB / sideC);
        message = "Computed side B";
        return true;
      }
    }
    else if (!Equals(b, 0) && !Equals(c, 0))
    {
      if (b > c)
      {
        msg = "Invalid right triangle: cathetus is larger than hypotenuse";
      }
      else
      {
        sideB = b;
        sideC = c;
        sideA = Math.Sqrt(c * c - b * b);
        alpha = Math.Asin(sideA / sideC);
        beta = Math.Asin(sideB / sideC);
        message = "Computed side A";
        return true;
      }
    }

    // If here, something went wrong,
    // so zero everything and return false.
    sideA = 0;
    sideB = 0;
    sideC = 0;
    alpha = 0;
    beta = 0;
    message = msg;
    return false;
  }

  

  /// <summary>
  /// Calculate if two values approximately equal each other.
  /// Doubles cannot be compared with == due to precision problems.
  /// It is better to use some small tolerance value to compare them.
  /// </summary>
  /// <param name="a"></param>
  /// <param name="b"></param>
  /// <returns></returns>
  bool Equals(double a, double b)
  {
    return Math.Abs(a - b) < RhinoMath.ZeroTolerance;
  }
# ---------- end c_script ----------
panel = Panel([rtrig.Alpha, rtrig.Beta, rtrig.PLength, rtrig.QLength, rtrig.RLength])
panel_2 = Panel([c_script.alphaOut, c_script.betaOut, c_script.POut, c_script.QOut, c_script.ROut])

x = Slider(5, range=0..10)
gh_sin = CSharpScript(x=x)  # -> out, y; inputs x: Double
# ---------- gh_sin: C# ----------
    // Component written by @erinlinseyhunt

    // Sin
    y = Math.Sin(x);
# ---------- end gh_sin ----------
sin = Sine(Value=x)
panel_3 = Panel(gh_sin.y)
panel_4 = Panel(sin)

# ----
# GH#: A C# dictionary of Grasshopper3D components.
# 
# This file contains a category of Grasshopper components, and a mirroring C#/RhinoCommon implementation.
# 
# This is an educational project initiated by students/faculty of GSD-6338: Introduction to Computational Design, at the Harvard Graduate School of Design.
# 
# More information: {{project link}}
# Maths Trig
x_2 = Slider(4, range=0..10)
gh_cos = CSharpScript(x=x_2)  # -> out, y; inputs x: Double
# ---------- gh_cos: C# ----------
    // Component written by @erinlinseyhunt

    // Cos
    y = Math.Cos(x);
# ---------- end gh_cos ----------
cos = Cosine(Value=x_2)
panel_5 = Panel(cos)
panel_6 = Panel(gh_cos.y)

x_3 = Slider(1, range=-1..1)
gh_acos = CSharpScript(x=x_3)  # -> out, y; inputs x: Double
# ---------- gh_acos: C# ----------
    // Component written by @erinlinseyhunt

    // Arccosine
    y = Math.Acos(x);
# ---------- end gh_acos ----------
acos = ArcCosine(Value=x_3)
panel_7 = Panel(acos)
panel_8 = Panel(gh_acos.y)

x_4 = Slider(5, range=0..10)
gh_atan = CSharpScript(x=x_4)  # -> out, y; inputs x: Double
# ---------- gh_atan: C# ----------
    // Component written by @erinlinseyhunt

    // Atan
    y = Math.Atan(x);
# ---------- end gh_atan ----------
atan = ArcTangent(Value=x_4)
panel_9 = Panel(atan)
panel_10 = Panel(gh_atan.y)

x_5 = Slider(5, range=0..10)
gh_cot = CSharpScript(x=x_5)  # -> out, y; inputs x: Double
# ---------- gh_cot: C# ----------
    // Component written by @erinlinseyhunt

    // Cotangent
    y = 1 / Math.Tan(x);
# ---------- end gh_cot ----------
cot = CoTangent(Value=x_5)
panel_11 = Panel(cot)
panel_12 = Panel(gh_cot.y)

number_slider = Slider(8, range=0..10)
gh_deg = CSharpScript(R=number_slider)  # -> out, D; inputs R: Double
# ---------- gh_deg: C# ----------
    // Component written by @erinlinseyhunt

    // Angle input in Degrees
    double radians = R;

    // Converts the angle from Degrees to Radians
    double degree = (180 / Math.PI) * radians;

    // Output
    D = degree;
# ---------- end gh_deg ----------
deg = Degrees(Radians=number_slider)
panel_13 = Panel(deg)
panel_14 = Panel(gh_deg.D)

gh_centroid = CSharpScript()  # -> Out, C, AB, BC, CA
centroid = Centroid()  # -> Centroid, MedianAB, MedianBC, MedianCA

gh_icentre = CSharpScript()  # -> Out, I, A, B, C
icentre = Incentre()  # -> Incentre, BisectorA, BisectorB, BisectorC

x_6 = Slider(2, range=0..10)
sinc = Sinc(Value=x_6)
gh_sinc = CSharpScript(x=x_6)  # -> out, y; inputs x: Double
# ---------- gh_sinc: C# ----------
    // Component written by @erinlinseyhunt

    // Sinc
    y = Math.Sin(x) / x;
# ---------- end gh_sinc ----------
panel_15 = Panel(sinc)
panel_16 = Panel(gh_sinc.y)

x_7 = Slider(5, range=0..10)
tan = Tangent(Value=x_7)
gh_tan = CSharpScript(x=x_7)  # -> out, y; inputs x: Double
# ---------- gh_tan: C# ----------
    // Component written by @erinlinseyhunt

    // Tan
    y = Math.Tan(x);
# ---------- end gh_tan ----------
panel_17 = Panel(tan)
panel_18 = Panel(gh_tan.y)

x_8 = Slider(4, range=0..10)
sec = Secant(Value=x_8)
gh_sec = CSharpScript(x=x_8)  # -> out, y; inputs x: Double
# ---------- gh_sec: C# ----------
    // Component written by @erinlinseyhunt

    // Secant
    y = 1 / Math.Cos(x);
# ---------- end gh_sec ----------
panel_19 = Panel(sec)
panel_20 = Panel(gh_sec.y)

number_slider_2 = Slider(1, range=0..10)
rad_3 = Radians(Degrees=number_slider_2)
gh_rad = CSharpScript(D=number_slider_2)  # -> out, R; inputs D: Double
# ---------- gh_rad: C# ----------
    // Component written by @erinlinseyhunt

    // Angle input in Degrees
    double degree = D;

    // Converting the angle from Degrees to Radians
    double radians = Math.PI * (degree / 180.00);

    // Output
    R = radians;
# ---------- end gh_rad ----------
panel_21 = Panel(rad_3)
panel_22 = Panel(gh_rad.R)

x_9 = Slider(1, range=0..10)
asin = ArcSine(Value=x_9)
gh_asin = CSharpScript(x=x_9)  # -> out, y; inputs x: Double
# ---------- gh_asin: C# ----------
    // Component written by @erinlinseyhunt

    // Arcsine
    y = Math.Asin(x);
# ---------- end gh_asin ----------
panel_23 = Panel(gh_asin.y)
panel_24 = Panel(asin)

x_10 = Slider(6, range=0..10)
csc = CoSecant(Value=x_10)
gh_csc = CSharpScript(x=x_10)  # -> out, y; inputs x: Double
# ---------- gh_csc: C# ----------
    // Component written by @erinlinseyhunt

    // Cosecant
    y = 1 / Math.Sin(x);
# ---------- end gh_csc ----------
panel_25 = Panel(gh_csc.y)
panel_26 = Panel(csc)

trig = TriangleTrigonometry()  # -> Alpha, Beta, Gamma, ALength, BLength, CLength

ccentre = Circumcentre()  # -> Circumcentre, BisectorAB, BisectorBC, BisectorCA
gh_ccentre = CSharpScript()  # -> Out, C, AB, BC, CA

ocentre = Orthocentre()  # -> Orthocentre, AltitudeAB, AltitudeBC, AltitudeCA
gh_ocentre = CSharpScript()  # -> Out, C, AB, BC, CA
