# Grasshopper definition Maths_Util.ghx (Grasshopper 1.0.7)

# ----
# GH#: A C# dictionary of Grasshopper3D components.
# 
# This file contains a category of Grasshopper components, and a mirroring C#/RhinoCommon implementation.
# 
# This is an educational project initiated by students/faculty of GSD-6338: Introduction to Computational Design, at the Harvard Graduate School of Design.
# 
# More information: {{project link}}
# Maths Util
number_slider = Slider(1, range=0..10)
c_script = CSharpScript(N=number_slider)  # -> out, y; inputs N: Double
# ---------- c_script: C# ----------
    // Component written by @garciadelcastillo

    // This component returns "epsilon", a system property that defines
    // a very small value typically used for precision comparisons.
    y = N * double.Epsilon;
# ---------- end c_script ----------
eps = Epsilon(Factor=number_slider)
panel = Panel(c_script.y)
panel_2 = Panel(eps)

number_slider_2 = Slider(1, range=0..10)
c_script_2 = CSharpScript(N=number_slider_2)  # -> out, y; inputs N: Double
# ---------- c_script_2: C# ----------
    // Component written by @garciadelcastillo

    // This component returns a factor of the natural number e.
    
    y = N * Math.E;
# ---------- end c_script_2 ----------
E = NaturalLogarithm(Factor=number_slider_2)
panel_3 = Panel(c_script_2.y)
panel_4 = Panel(E)

number_slider_3 = Slider(0.05, range=0..1)
genes = GenePool(Decimals=2, Maximum=100, Minimum=0, Value=[34.37, 77.76, 15.82, 22.27, 9.67, 4.25, 34.08, 73.88, 18.16, 77.86, 50])
list = ValueList({"Block", "Linear", "Cubic", "Catmull"}, selected="Catmull")
c_script_3 = CSharpScript(D=genes, t=number_slider_3, type=list)  # -> out, V; inputs D: list of Double, t: Double, type: String
# ---------- c_script_3: C# ----------
    // Component written by @garciadelcastillo

    // This component computes an interpolated value among a list of values
    // at a normalized parameter, using different interpolation techniques.

    // If out of normalized range, return extremes
    if (t <= 0)
    {
      V = D[0];
      return;
    }
    else if (t >= 1.0)
    {
      V = D[D.Count - 1];
      return;
    }

    // Otherwise, let's calculate the interpolated value using the appropriate method
    double interp = 0;
    if (type == "Block")
    {
      interp = BlockInterpolation(D, t);
    }
    else if (type == "Linear")
    {
      interp = LinearInterpolation(D, t);
    }
    else if (type == "Cubic" || type == "Catmull")
    {
      interp = CubicInterpolation(D, t, type);
    }
    else
    {
      Component.AddRuntimeMessage(GH_RuntimeMessageLevel.Error, "Method not implemented");
      return;
    }


    // Outputs
    V = interp;
# ---------- c_script_3: C# additional code ----------
  // Block interpolation
  double BlockInterpolation(List<double> values, double t)
  {
    // Block interpolation finds the closest value on the list
    // at the normalized position 0-1, without smoothing.
    // This is equivalent to finding the rounded position!
    int index = (int) Math.Round(t * (values.Count - 1));

    return values[index];
  }

  // Linear interpolation
  double LinearInterpolation(List<double> values, double t)
  {
    // Linear interpolation finds the simple linearly distributed
    // value between two extremes.

    // Calculate the position of the lower value to interpolate from.
    int lowerIndex = (int) Math.Floor(t * (values.Count - 1));

    // Get the lower and upper interpolation extremes.
    double a = values[lowerIndex];
    double b = values[lowerIndex + 1];

    // Calculate the new 0-1 interpolation factor between them.
    double tStep = 1.0 / (values.Count - 1.0);
    double newT = (t - lowerIndex * tStep) / tStep;

    // Interpolate linearly
    double interpolated = a + (b - a) * newT;

    return interpolated;
  }

  // Cubic interpolations
  double CubicInterpolation(List<double> values, double t, string type)
  {
    // Calculate the position of the lower value to interpolate from.
    int lowerIndex = (int) Math.Floor(t * (values.Count - 1));

    // Get the lower and upper interpolation extremes.
    double p1 = values[lowerIndex];
    double p2 = values[lowerIndex + 1];

    // If one of them is at the boundary, create a "ghost point" over it
    // forming a straight line to ease the tangency of the interpolation.
    double p0 = lowerIndex > 0 ? values[lowerIndex - 1] : p1 - (p2 - p1);
    double p3 = lowerIndex + 2 < values.Count - 1 ? values[lowerIndex + 2] : p2 - (p1 - p2);

    // Calculate the new 0-1 interpolation factor between them.
    double tStep = 1.0 / (values.Count - 1.0);
    double newT = (t - lowerIndex * tStep) / tStep;

    // Choose cubic interpolation based on type
    double interpolated = type == "Cubic"
      ? InterpolationCubic(p0, p1, p2, p3, newT)
      : InterpolationCatmullRom(p0, p1, p2, p3, newT);

    return interpolated;
  }

  // Cubic interpolation
  double InterpolationCubic(double p0, double p1, double p2, double p3, double t)
  {
    // Cubic interpolation uses twice the slope of lines p0-p2 and p1-p3
    // resulting in more abrupt curvature changes.
    // http://paulbourke.net/miscellaneous/interpolation/
    double t2 = t * t;
    double a = -p0 + p1 - p2 + p3;
    double b = p0 - p1 - a;
    double c = p2 - p0;
    double d = p1;

    double interpolated = a * t2 * t + b * t2 + c * t + d;

    return interpolated;
  }

  // Catmull-Rom interpolation
  double InterpolationCatmullRom(double p0, double p1, double p2, double p3, double t)
  {
    // Cubic interpolation uses the slope of lines p0-p2 and p1-p3
    // resulting in smoother curvature transitions.
    // http://danceswithcode.net/engineeringnotes/interpolation/interpolation.html
    double a = -0.5 * p0 + 1.5 * p1 - 1.5 * p2 + 0.5 * p3;
    double b = p0 - 2.5 * p1 + 2 * p2 - 0.5 * p3;
    double c = -0.5 * p0 + 0.5 * p2;
    double d = p1;

    double interpolated = a * t * t * t + b * t * t + c * t + d;

    return interpolated;
  }
# ---------- end c_script_3 ----------
interp = InterpolateData(Data=genes, Parameter=number_slider_3, Interpolation=4)
panel_5 = Panel(interp)
panel_6 = Panel(c_script_3.V)

number_slider_4 = Slider(0.351, range=0..1)
genes_2 = GenePool(Decimals=2, Maximum=100, Minimum=0, Value=[34.37, 77.76, 15.82, 22.27, 9.67, 4.25, 34.08, 73.88, 18.16, 77.86, 50])
c_script_4 = CSharpScript(I=genes_2, t=number_slider_4)  # -> out, T; inputs I: list of Double, t: Double
# ---------- c_script_4: C# ----------
    // Component written by @garciadelcastillo

    // This component removes small/large elements from the list
    // proportional to the normalized value t.

    // Some sanity checks
    if (t < 0)
    {
      t = 0;
    }
    else if (t >= 1)
    {
      return;
    }

    // Sort list numerically
    I.Sort();

    // Calculate how many elements to truncate on each end
    int trunc = (int) Math.Round(t * 0.5 * I.Count);
    if (trunc == 0)
    {
      T = I;
      return;
    }

    // Remove trunc elements from both ends
    List<double> truncList = I.GetRange(trunc, I.Count - 2 * trunc);

    // Outputs
    T = truncList;
# ---------- end c_script_4 ----------
trunc = Truncate(Input=genes_2, TruncationFactor=number_slider_4)
panel_7 = Panel(trunc)
panel_8 = Panel(c_script_4.T)

number_slider_5 = Slider(29.31, range=0..100)
number_slider_6 = Slider(67.18, range=0..100)
number_slider_7 = Slider(23.42, range=0..100)
number_slider_8 = Slider(63.81, range=0..100)
number_slider_9 = Slider(12.48, range=0..100)
number_slider_10 = Slider(78.96, range=0..100)
number_slider_11 = Slider(41.09, range=0..100)
extrz = Extremes(
    A=number_slider_5,
    B=number_slider_6,
    C=number_slider_7,
    D=number_slider_8,
    E=number_slider_9,
    F=number_slider_10,
    G=number_slider_11)  # -> Mininum, Maximum
c_script_5 = CSharpScript(
    A=number_slider_5,
    B=number_slider_6,
    C=number_slider_7,
    D=number_slider_8,
    E=number_slider_9,
    F=number_slider_10,
    G=number_slider_11)  # -> out, Vminus, Vplus; inputs A: Double, B: Double, C: Double, D: Double, E: Double, F: Double, G: Double
# ---------- c_script_5: C# ----------
    // Component written by @garciadelcastillo

    // This component takes a bunch of numerical inputs,
    // and calculates the minimum and maximum values.

    // TODO: Accept non-numerical inputs like points, vectors, etc.
    Component.AddRuntimeMessage(GH_RuntimeMessageLevel.Warning, "Only accepting numerical inputs at this time");

    // Create a list with all the input values.
    List<double> values = new List<double>() {A, B, C, D, E, F, G};

    // Initialize two comparison values at the extremes
    // of the capacity of a double number.
    double min = double.MaxValue;
    double max = double.MinValue;

    // Iterate over all values, and if greater/smaller than max/min,
    // keep track of these.
    foreach(double v in values)
    {
      if (v > max)
      {
        max = v;
      }
      if (v < min)
      {
        min = v;
      }
    }

    // Outputs
    Vminus = min;
    Vplus = max;
# ---------- end c_script_5 ----------
panel_9 = Panel([extrz.Mininum, extrz.Maximum])
panel_10 = Panel([c_script_5.Vminus, c_script_5.Vplus])

number_slider_12 = Slider(29.31, range=0..100)
number_slider_13 = Slider(67.18, range=0..100)
min = Minimum(A=number_slider_12, B=number_slider_13)
c_script_6 = CSharpScript(A=number_slider_12, B=number_slider_13)  # -> out, R; inputs A: Double, B: Double
# ---------- c_script_6: C# ----------
    // Component written by @garciadelcastillo

    // This component returns the smaller of the two input values.
    
    // TODO: Accept non-numerical inputs like points, vectors, etc.
    Component.AddRuntimeMessage(GH_RuntimeMessageLevel.Warning, "Only accepting numerical inputs at this time");

    // Outputs
    R = Math.Min(A, B);
# ---------- end c_script_6 ----------
panel_11 = Panel(min)
panel_12 = Panel(c_script_6.R)

complex = CreateComplex(Real=Slider(10, range=-10..10), Imaginary=Slider(4, range=-10..10))
c_script_7 = CSharpScript(C=complex)  # -> out, A
# ---------- c_script_7: C# ----------
    // Component written by @garciadelcastillo

    // This component returns the argument of a complex number.
    
    A = C.Argument;
# ---------- end c_script_7 ----------
arg = ComplexArgument(Complex=complex)
panel_13 = Panel(arg)
panel_14 = Panel(c_script_7.A)

genes_3 = GenePool(Decimals=2, Maximum=100, Minimum=0, Value=[34.37, 73.45, 25.44, 68.98, 24.32, 67.63, 34.08, 73.88, 18.16, 77.86])
avr = Average(Input=genes_3)
c_script_8 = CSharpScript(I=genes_3)  # -> out, AM; inputs I: list of Double
# ---------- c_script_8: C# ----------
    // Component written by @garciadelcastillo

    // This component computes the average of a list of numbers.

    // Compute the mass addition of this list
    double total = 0;
    foreach (double val in I)
    {
      total += val;
    }

    // Compute the average
    double avg = total / I.Count;

    // Outputs
    AM = avg;
# ---------- end c_script_8 ----------
panel_15 = Panel(avr)
panel_16 = Panel(c_script_8.AM)

number_slider_14 = Slider(10, range=-10..10)
number_slider_15 = Slider(4, range=-10..10)
c_script_9 = CSharpScript(R=number_slider_14, i=number_slider_15)  # -> out, C; inputs R: Double, i: Double
# ---------- c_script_9: C# ----------
    // Component written by @garciadelcastillo

    // This component creates a complex number from real and imaginary parts.
    Complex comp = new Complex(R, i);

    // Outputs
    C = comp;
# ---------- end c_script_9 ----------
complex_2 = CreateComplex(Real=number_slider_14, Imaginary=number_slider_15)
panel_17 = Panel(complex_2)
panel_18 = Panel(c_script_9.C)

C = Complex(complex)
c_script_10 = CSharpScript(C=C)  # -> out, Cout
# ---------- c_script_10: C# ----------
    // Component written by @garciadelcastillo

    // This component returns the conjugate of the given complex number.
    Complex conj = new Complex(C.Real, -C.Imaginary);

    // Outputs
    Cout = conj;
# ---------- end c_script_10 ----------
complex_conjugate = ComplexConjugate(Complex=C)
panel_19 = Panel(complex_conjugate)
panel_20 = Panel(c_script_10.Cout)

C_2 = Complex(complex)
c_script_11 = CSharpScript(C=C_2)  # -> out, R, i
# ---------- c_script_11: C# ----------
    // Component written by @garciadelcastillo

    // This component returns the real and imaginary parts of a complex number.

    R = C.Real;
    i = C.Imaginary;
# ---------- end c_script_11 ----------
complex_3 = ComplexComponents(Complex=C_2)  # -> Real, Imaginary
panel_21 = Panel([c_script_11.R, c_script_11.i])
panel_22 = Panel([complex_3.Real, complex_3.Imaginary])

C_3 = Complex(complex)
c_script_12 = CSharpScript(C=C_3)  # -> out, M
# ---------- c_script_12: C# ----------
    // Component written by @garciadelcastillo

    // This component returns the modulus of the given complex number.
    
    M = C.Modulus();
# ---------- end c_script_12 ----------
cmod = ComplexModulus(Complex=C_3)
panel_23 = Panel(cmod)
panel_24 = Panel(c_script_12.M)

number_slider_16 = Slider(1, range=0..10)
c_script_13 = CSharpScript(N=number_slider_16)  # -> out, y; inputs N: Double
# ---------- c_script_13: C# ----------
    // Component written by @garciadelcastillo

    // This component returns the value of the golden ratio.
    double phi = (1 + Math.Sqrt(5)) / 2;
    
    // Output
    y = N * phi;
# ---------- end c_script_13 ----------
phi = GoldenRatio(Factor=number_slider_16)
panel_25 = Panel(c_script_13.y)
panel_26 = Panel(phi)

number_slider_17 = Slider(1, range=0..10)
c_script_14 = CSharpScript(N=number_slider_17)  # -> out, y; inputs N: Double
# ---------- c_script_14: C# ----------
    // Component written by @garciadelcastillo

    // This component returns a factor of Pi.

    y = N * Math.PI;
# ---------- end c_script_14 ----------
pi = Pi(Factor=number_slider_17)
panel_27 = Panel(c_script_14.y)
panel_28 = Panel(pi)

number_slider_18 = Slider(32.8, range=0..100)
round = Round(Number=number_slider_18)  # -> Nearest, Floor, Ceiling
c_script_15 = CSharpScript(x=number_slider_18)  # -> out, N, F, C; inputs x: Double
# ---------- c_script_15: C# ----------
    // Component written by @garciadelcastillo

    // This component applies different rounding methods to the input value.
    
    // Rounding to the closest integer.
    N = Math.Round(x);
    
    // Rounding to the closest smaller integer.
    F = Math.Floor(x);
    
    // Rounding to the closest larger integer.
    C = Math.Ceiling(x);
# ---------- end c_script_15 ----------
panel_29 = Panel([c_script_15.N, c_script_15.F, c_script_15.C])
panel_30 = Panel([round.Nearest, round.Floor, round.Ceiling])

number_slider_19 = Slider(29.31, range=0..100)
number_slider_20 = Slider(67.18, range=0..100)
c_script_16 = CSharpScript(A=number_slider_19, B=number_slider_20)  # -> out, R; inputs A: Double, B: Double
# ---------- c_script_16: C# ----------
    // Component written by @garciadelcastillo

    // This component returns the larger of the two input values.

    // TODO: Accept non-numerical inputs like points, vectors, etc.
    Component.AddRuntimeMessage(GH_RuntimeMessageLevel.Warning, "Only accepting numerical inputs at this time");

    // Outputs
    R = Math.Max(A, B);
# ---------- end c_script_16 ----------
max = Maximum(A=number_slider_19, B=number_slider_20)
panel_31 = Panel(max)
panel_32 = Panel(c_script_16.R)

genes_4 = GenePool(Decimals=2, Maximum=10, Minimum=0, Value=[10, 10, 0, 0, 0, 0, 0, 10, 10, 10])
series = Series(Start=0, Step=1, Count=10)
wav = WeightedAverage(Input=series, Weights=genes_4)
c_script_17 = CSharpScript(I=series, W=genes_4)  # -> out, AM; inputs I: list of Double, W: list of Double
# ---------- c_script_17: C# ----------
    // Component written by @garciadelcastillo

    // This component computes the average of the input values,
    // weighting them by factors.

    // Sanity checks
    if (I.Count != W.Count) {
      Component.AddRuntimeMessage(GH_RuntimeMessageLevel.Error, "You must supply equal amounts of weights and values");
      return;
    }

    // Calculate totals for weights and weighted values
    double totalWeights = 0;
    double totalValues = 0;
    for (int i = 0; i < I.Count; i++)
    {
      totalWeights += W[i];
      totalValues += I[i] * W[i];
    }

    // Compute average
    double avg = totalValues / totalWeights;

    // Outputs
    AM = avg;
# ---------- end c_script_17 ----------
panel_33 = Panel(c_script_17.AM)
panel_34 = Panel(wav)

nblur = BlurNumbers(Strength=0.5, Iterations=1, Lock=True, Wrap=False)
smooth = SmoothNumbers(SmoothDelay=2000)
