# Grasshopper definition Sets_Text.ghx (Grasshopper 1.0.7)

# ----
# GH#: A C# dictionary of Grasshopper3D components.
# 
# This file contains a category of Grasshopper components, and a mirroring C#/RhinoCommon implementation.
# 
# This is an educational project initiated by students/faculty of GSD-6338: Introduction to Computational Design, at the Harvard Graduate School of Design.
# 
# More information: {{project link}}
# Sets_Text
panel = Panel("$&H1)569Gr@")
chars = Characters(Text=panel)  # -> Result, Unicode
gh_characters = CSharpScript(T=panel)  # -> C, U; inputs T: String
# ---------- gh_characters: C# ----------
    // Component written by @sonomirco

    // The component breaks the string in singular character and also passed a Unicode
    // https://en.wikipedia.org/wiki/Unicode

    // Global variables
    // Once we know the dimension of the container and we don't have to perform heavy operations through the list,
    // better to use arrays that are lighter containers in terms of memory.
    // We define the dimension of the array as the length of string, and because a string is a list of characters has
    // a length property.
    string[] letters = new string[T.Length];
    int[] unicodeLetterValues = new int[T.Length];

    // Initialize a variable int that we will use as a counter for the while loop.
    int index = 0;

    // All the collection start with the first value at index zero, we iterate the loop for the length of string minus 1.
    while(index <= T.Length - 1)
    {
      // Retrieving the character.
      // Because the string is a list of characters, we have just to pass the index to the string and we have the character back.
      char character = T[index];

      // We convert the character that is a type char, to string and collect it inside the array.
      letters[index] = character.ToString();

      // We cast the character in int to retrieve the Unicode of the char and collect it inside the array.
      unicodeLetterValues[index] = (int) character;
      ++index;
    }

    // Outputs
    C = letters;
    U = unicodeLetterValues;
# ---------- end gh_characters ----------
panel_2 = Panel(chars.Result)
panel_3 = Panel(gh_characters.C)
panel_4 = Panel(chars.Unicode)
panel_5 = Panel(gh_characters.U)

gh_concatenate = CSharpScript(Separator="||", A="GH#", B="Concatenate")  # -> R; inputs Separator: String, A: String, B: String
# ---------- gh_concatenate: C# ----------
    // Component written by @sonomirco

    // The component concatenate texts.
    // Here we provide some different solutions to concatenate text.
    // The vanilla component has some custom features, like inputting the separator or adding extra input dynamically.
    // These functionalities are not integrated into this component, because the aim is to explain how to concatenate texts.

    // Solution 1
    // https://docs.microsoft.com/en-us/dotnet/api/system.string.concat?view=net-5.0
    string solution1 = string.Concat(A, Separator, B);

    // Solution 2
    // https://docs.microsoft.com/en-us/dotnet/api/system.string.format?view=net-5.0
    string solution2 = string.Format("{0}{1}{2}", A, Separator, B);

    // Solution 3
    // It is possible to concatenate strings using the operator +.
    string solution3 = A + Separator + B;

    // Output
    R = solution1;
# ---------- end gh_concatenate ----------
concat = Concatenate(FragmentA="GH#", FragmentB="Concatenate", JoinSeparator="||")
panel_6 = Panel(gh_concatenate)
panel_7 = Panel(concat)

panel_8 = Panel("""{0:#0,0}
GH#{1}""")
int = Integer("50800")
culture = Culture(3081)
format = Format(Format=panel_8, Culture=culture, Data0=int, Data1="Format")
gh_format = CSharpScript(F=panel_8, C=culture, a=int, b="Format")  # -> T; inputs F: String, C: String
# ---------- gh_format: C# ----------
    // Component written by @sonomirco

    // Format some data using formatting tags.
    // The format component derives from the string method Format.
    // https://docs.microsoft.com/en-us/dotnet/api/system.string.format?view=netframework-4.7.2
    // Here a link explaining some good information regardin the component.
    // https://discourse.mcneel.com/t/digit-grouping-using-formatting-culture/79046/9

    // Define culture info from the input C.
    // https://docs.microsoft.com/en-us/dotnet/api/system.globalization.cultureinfo?view=net-5.0
    System.Globalization.CultureInfo culture = new System.Globalization.CultureInfo(C);
    
    // Using the method Format to formatting the information as defined by the input F.
    string dataFormatted = string.Format(culture, F, a, b);
    
    //Output.
    T = dataFormatted;
# ---------- end gh_format ----------
panel_9 = Panel(format)
panel_10 = Panel(gh_format)

panel_11 = Panel("""GH#
Joint
String""")
gh_join = CSharpScript(T=panel_11, J="//")  # -> R; inputs T: list of String, J: String
# ---------- gh_join: C# ----------
    // Component written by @sonomirco

    // Join a collection of texts into one.

    // We define the input 'T' as a list of strings and we check if the length of the list is zero, we exit.
    if(T.Count == 0)
      return;

    // Join a string is a method of string and takes a string 'J' as separator and a collection as an array.
    // https://docs.microsoft.com/en-us/dotnet/api/system.string.join?view=net-5.0
    // List has a method to convert the list into an Array (ToArray method).
    // https://docs.microsoft.com/en-us/dotnet/api/system.collections.generic.list-1.toarray?view=net-5.0
    string joinedStrings = string.Join(J, T.ToArray());

    // Output.
    R = joinedStrings;
# ---------- end gh_join ----------
join = TextJoin(Text=panel_11, Join="//")
panel_12 = Panel(join)
panel_13 = Panel(gh_join)

culture_2 = Culture(3081)
case = TextCase(Text="CaSiNg", Culture=culture_2)  # -> UpperCase, LowerCase
gh_case = CSharpScript(T="CaSiNg", C=culture_2)  # -> U, L; inputs T: String, C: String
# ---------- gh_case: C# ----------
    // Component written by @sonomirco

    // Change the case of some text.

    // Define culture info from the input C.
    // https://docs.microsoft.com/en-us/dotnet/api/system.globalization.cultureinfo?view=net-5.0
    System.Globalization.CultureInfo culture = new System.Globalization.CultureInfo(C);

    // Using the string method ToUpper to change the text in upper case.
    string upperCase = T.ToUpper(culture);
    
    // Using the string method ToUpper to change the text in upper case.
    string lowerCase = T.ToLower(culture);

    //Outputs.
    U = upperCase;
    L = lowerCase;
# ---------- end gh_case ----------
panel_14 = Panel(case.UpperCase)
panel_15 = Panel(case.LowerCase)
panel_16 = Panel(gh_case.U)
panel_17 = Panel(gh_case.L)

int_2 = Integer("15")
int_3 = Integer("6")
fragment = TextFragment(Text="VanillaGrasshopper", Start=int_2, Count=int_3)
gh_textfragment = CSharpScript(T="VanillaGrasshopper", i=int_2, N=int_3)  # -> F; inputs T: String, i: Int32, N: Int32
# ---------- gh_textfragment: C# ----------
    // Component written by @sonomirco

    // Extract a subset of a text.
    // This component is focused on the use of the string method Substring.
    // https://docs.microsoft.com/en-us/dotnet/api/system.string.substring?view=net-5.0

    // Check if the start index is not less than zero, if it is retreive an error message.
    if (i < 0)
      this.Component.AddRuntimeMessage(GH_RuntimeMessageLevel.Error, "Start index must be equal to or larger than zero");

      // Check if the start index is bigger than the string length, if it is retreive an warning message.
      // We also ouput a empty string.
    else if (i >= T.Length)
    {
      this.Component.AddRuntimeMessage(GH_RuntimeMessageLevel.Warning, "Start index beyond end of text");
      F = string.Empty;
    }

      // Check if the length of the subset we want to obtain is not less than zero.
      // We output the substring starting from the index i until the end of the string.
    else if (N < 0)
    {
      F = T.Substring(i);
    }

      // If all the checks are passed define the subset based on the inputs provide.
      // we output the substring starting from index i and for the length provided from the input N.
    else
    {
      // This avoid to have a null result if we input a start index very close to the end of the string and a N input that is bigger than the number
      // of characters remaing.
      int subSetLength = Math.Min(N, (T.Length - i));
      F = T.Substring(i, subSetLength);
      };
# ---------- end gh_textfragment ----------
panel_18 = Panel(fragment)
panel_19 = Panel(gh_textfragment)

toggle = BooleanToggle(True)
toggle_2 = BooleanToggle(False)
gh_texttrim = CSharpScript(T=" VanillaGrasshopper ", S=toggle, E=toggle_2)  # -> R; inputs T: String, S: Boolean, E: Boolean
# ---------- gh_texttrim: C# ----------
    // Component written by @sonomirco

    // Remove whitespace at the begin or at the end of a text.
    // This component is focused on the use of the string method TrimEnd and TrimStart.
    // https://docs.microsoft.com/en-us/dotnet/api/system.string.trimend?view=net-5.0

    // Global variable
    // Copied the input text.
    string trimmedText = T;

    // If the input S is true trim the start.
    // If the input E is true trim the end
    if (S)
      trimmedText = trimmedText.TrimStart();
    if (E)
      trimmedText = trimmedText.TrimEnd();

    // Output.
    R = trimmedText;
# ---------- end gh_texttrim ----------
trim = TextTrim(Text=" VanillaGrasshopper ", Start=toggle, End=toggle_2)
panel_20 = Panel(trim)
panel_21 = Panel(gh_texttrim)

panel_22 = Panel(""" 
GH#Split""")
split = TextSplit(Text=panel_22, Separators="#")
gh_text_split = CSharpScript(T=panel_22, C="#")  # -> R; inputs T: String, C: String
# ---------- gh_text_split: C# ----------
    // Component written by @sonomirco

    // Split some text using separator.
    // String has a method called Split that takes a CharArray as separator
    // https://docs.microsoft.com/en-us/dotnet/api/system.string.split?view=net-5.0
    R = T.Split(C.ToCharArray(), StringSplitOptions.None);
# ---------- end gh_text_split ----------
panel_23 = Panel(split)
panel_24 = Panel(gh_text_split)

panel_25 = Panel(""" 
GH#
Joint
String""")
gh_text_length = CSharpScript(T=panel_25)  # -> out, L; inputs T: String
# ---------- gh_text_length: C# ----------
    // Component written by @sonomirco

    // Get the length (character count) of some text.
    // Becuase a string is a list of characters has a length property.

    // Output
    L = T.Length;
# ---------- end gh_text_length ----------
len = TextLength(Text=panel_25)
panel_26 = Panel(gh_text_length.L)
panel_27 = Panel(len)

tmatch = MatchText(Case=True)
rep = ReplaceText(RecursiveReplace=False)
tsort = SortText(Culture=127)  # -> Keys, Values
tdist = TextDistance(TextA=" VanillaGrasshopper ", TextB="Grass", Case=True)
panel_28 = Panel(tdist)
