# Grasshopper definition Vector_Plane.ghx (Grasshopper 1.0.7)

# ---- group: Deconstruct Plane
# GH#: A C# dictionary of Grasshopper3D components.
# 
# This file contains a category of Grasshopper components, and a mirroring C#/RhinoCommon implementation.
# 
# This is an educational project initiated by students/faculty of GSD-6338: Introduction to Computational Design, at the Harvard Graduate School of Design.
# 
# More information: {{project link}}
# Vector Plane
xy = XYPlane(Origin=Point(0, 0, 0))
gh_deplane = CSharpScript(P=xy)  # -> out, O, X, Y, Z; inputs P: Plane
# ---------- gh_deplane: C# ----------
    // Component written by @krichterlunn

    // This component outputs the Origin (O) of a plane, and its X, Y, Z Axis
    O = P.Origin;
    X = P.XAxis;
    Y = P.YAxis;
    Z = P.ZAxis;
# ---------- end gh_deplane ----------
deplane = DeconstructPlane(Plane=xy)  # -> Origin, XAxis, YAxis, ZAxis
panel = Panel(deplane.Origin)
panel_2 = Panel(deplane.XAxis)
panel_3 = Panel(deplane.YAxis)
panel_4 = Panel(deplane.ZAxis)
panel_5 = Panel(gh_deplane.O)
panel_6 = Panel(gh_deplane.X)
panel_7 = Panel(gh_deplane.Y)
panel_8 = Panel(gh_deplane.Z)

# ---- group: XZ Plane
pt = Point(Point(-8.200616191, 1.956036226, 0))
gh_xz = CSharpScript(O=pt)  # -> out, P; inputs O: Point3d
# ---------- gh_xz: C# ----------
    // Component written by @krichterlunn

    // This component sets two new vectors: one in the X direction and one in the Z direction
    // We then construct our new plane with Origine "O" and vectors X and Z
    Vector3d xVector = new Vector3d(1, 0, 0);
    Vector3d zVector = new Vector3d(0, 0, 1);
    Plane newXZ = new Plane(O, xVector, zVector);
    P = newXZ;
# ---------- end gh_xz ----------
xz = XZPlane(Origin=pt)
panel_9 = Panel(xz)
panel_10 = Panel(gh_xz.P)

# ---- group: Construct Plane
pt_2 = Point(Point(5.928926226, 17.76513586, 0))
X = Slider(1, range=1..5)
Y = Slider(1, range=1..5)
X_2 = UnitX(Factor=X)
Y_2 = UnitY(Factor=Y)
gh_pl = CSharpScript(O=pt_2, X=X_2, Y=Y_2)  # -> out, Pl; inputs O: Point3d, X: Vector3d, Y: Vector3d
# ---------- gh_pl: C# ----------
    // Component written by @krichterlunn

    // This component constructs a plane from an Origin point "O" and the input X and Y axis
    Plane newpl = new Plane(O, X, Y);

    // Output plane
    Pl = newpl;
# ---------- end gh_pl ----------
pl = ConstructPlane(Origin=pt_2, XAxis=X_2, YAxis=Y_2)
panel_11 = Panel(pl)
panel_12 = Panel(gh_pl.Pl)

# ---- group: Line + Pt
crv = Curve(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)
pt_3 = Point(Point(6.70516853, 0, 4.333694603))
gh_lnpt = CSharpScript(L=crv, P=pt_3)  # -> out, Pl; inputs L: Line, P: Point3d
# ---------- gh_lnpt: C# ----------
    // Component written by @krichterlunn

    // Vector x using start and end points of Line L
    Vector3d x = L.To - L.From;
    x.Unitize();

    // Vector y from Point3d P and end point of Line L
    Vector3d direction = L.To - P;
    Vector3d z = Vector3d.CrossProduct(x, direction);
    z.Unitize();
    Vector3d y = Vector3d.CrossProduct(z, x);

    // Construct new plane with origin = L.from, and x, y vectors
    Plane newpl = new Plane(L.From, x, y);

    // Output
    Pl = newpl;
# ---------- end gh_lnpt ----------
lnpt = LinePt(Line=crv, Point=pt_3)
panel_13 = Panel(lnpt)
panel_14 = Panel(gh_lnpt.Pl)

# ---- group: Plane Fit
pt_4 = Point([Point(-4.410231517, 4.10049347, -0.4515786429), Point(-3.325425288, -3.660053115, -1.111724532), Point(0.4898677026, -8.21495467, -0.860767574), Point(3.197213163, -7.166596062, 0), Point(2.179369692, -3.464424299, 1.015360714), Point(0.8730516958, 3.257894835, 0), Point(4.998037723, -0.01889610073, 1.820520159), Point(4.442070263, 2.40760673, 0), Point(6.555356326, -2.586465397, 0)])
gh_plfit = CSharpScript(P=pt_4)  # -> out, Pl, dx; inputs P: list of Point3d
# ---------- gh_plfit: C# ----------
    //Component written by @krichterlunn

    // fit a plane through an input list of Point3d
    Plane pl2;
    double Maxd;
    Plane.FitPlaneToPoints(P, out pl2, out Maxd);

    // output Plane and max deviation
    Pl = pl2;
    dx = Maxd;
# ---------- end gh_plfit ----------
plfit = PlaneFit(Points=pt_4)  # -> Plane, Deviation
panel_15 = Panel(plfit.Plane)
panel_16 = Panel(plfit.Deviation)
panel_17 = Panel(gh_plfit.dx)

# ----
number_slider = Slider(3, range=0..10)

# ---- group: Plane Offset
xy_2 = XYPlane(Origin=Point(0, 0, 0))
gh_pl_offset = CSharpScript(P=xy_2, O=number_slider)  # -> out, Pl; inputs P: Plane, O: Double
# ---------- gh_pl_offset: C# ----------
    //Component written by @krichterlunn

    // offset plane based on normal vector and distance O
    Vector3d offset = P.Normal * O;
    P.Translate(offset);

    //outputs
    Pl = P;
# ---------- end gh_pl_offset ----------
pl_offset = PlaneOffset(BasePlane=xy_2, Offset=number_slider)
panel_18 = Panel(pl_offset)
panel_19 = Panel(gh_pl_offset.Pl)

# ----
yz = YZPlane(Origin=Point(0, 0, 0))

# ---- group: Adjust Plane
pln = Plane(Plane(origin=(19, 6, 0), x=(0.6178215519, 0.7863183388, 0), y=(0.7099357833, -0.5578066869, 0.4299335804)))
X_3 = UnitX(Factor=1)
Z = UnitZ(Factor=1)
gh_padjust = CSharpScript(P=pln, N=Z)  # -> out, Pl; inputs P: Plane, N: Vector3d
# ---------- gh_padjust: C# ----------
    //Component written by @krichterlunn & @garciadelcastillo

    // This component rotates the plane around its center
    // to match its normal to the input one. 
    Transform rot = Transform.Rotation(P.Normal, N, P.Origin);
    P.Transform(rot);
    
    // Outputs
    Pl = P;
# ---------- end gh_padjust ----------
padjust = AdjustPlane(Plane=pln, Normal=Z)
panel_20 = Panel(padjust)
panel_21 = Panel(gh_padjust.Pl)

# ---- group: Align Planes
pln_2 = Plane([Plane(origin=(-18.00867755, 8.094398381, 0), x=(0.6693414041, 0.7429549682, 0), y=(0, 0, 1)), Plane(origin=(-15.60908894, 6.017764458, 0), x=(0.6402538266, 0.7681634185, 0), y=(0, 0, 1)), Plane(origin=(-13.13702255, 4.02789191, 0), x=(0.6137683, 0.7894862088, 0), y=(0, 0, 1)), Plane(origin=(-10.59743953, 2.124981747, 0), x=(0.5844139317, 0.8114557021, 0), y=(0, 0, 1)), Plane(origin=(-7.979564921, 0.3315971985, 0), x=(0.5419800382, 0.8403913602, 0), y=(0, 0, 1)), Plane(origin=(-5.24266772, -1.272687082, 0), x=(0.4613547686, 0.8872157446, 0), y=(0, 0, 1))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])
xy_3 = XYPlane(Origin=Point(0, 0, 0))
gh_align = CSharpScript(P=pln_2, M=xy_3)  # -> Out, Pl
align = AlignPlanes(Planes=pln_2, Master=xy_3)
panel_22 = Panel(align)
panel_23 = Panel(gh_align.Pl)

# ----
yz_2 = YZPlane(Origin=Point(0, 0, 0))

# ---- group: Plane Closest Point
pt_5 = Point(Point(5.409136367, -2.140998851, 0))
xy_4 = XYPlane(Origin=Point(0, 0, 0))
gh_cp = CSharpScript(S=pt_5, P=yz_2)  # -> out, Pt, uv, D; inputs S: Point3d, P: Plane
# ---------- gh_cp: C# ----------
    //Component written by @krichterlunn

    //find closest parameters to plane P
    double U;
    double V;
    P.ClosestParameter(S, out U, out V);

    //output closest point, new point uv coordinates, and Plane distance to S
    Pt = P.ClosestPoint(S);
    uv = new Point3d(U, V, 0.0);
    D = P.DistanceTo(S);
# ---------- end gh_cp ----------
cp = PlaneClosestPoint(Point=pt_5, Plane=yz_2)  # -> Point, UVPoint, Distance
panel_24 = Panel(cp.UVPoint)
panel_25 = Panel(cp.Distance)
panel_26 = Panel(gh_cp.Pt)
panel_27 = Panel(gh_cp.uv)
panel_28 = Panel(gh_cp.D)

# ---- group: Rotate Plane
xy_5 = XYPlane(Origin=Point(0, 0, 0))
angle = Slider(45, range=0..360)
gh_prot = CSharpScript(P=xy_5, A=angle)  # -> out, Pl; inputs P: Plane, A: Double
# ---------- gh_prot: C# ----------
    //Component written by @krichterlunn

    //rotate a plane around angle A and axis from plane P
    P.Rotate(A, P.Normal);
    
    //output new plane
    Pl = P;
# ---------- end gh_prot ----------
prot = RotatePlane(Plane=xy_5, Angle=angle)
panel_29 = Panel(prot)
panel_30 = Panel(gh_prot.Pl)

# ----
panel_31 = Panel(gh_plfit.Pl)
panel_32 = Panel(cp.Point)

# ---- group: XY Plane
pt_6 = Point(Point(-8.200616191, 1.956036226, 0))
gh_xy = CSharpScript(O=pt_6)  # -> out, P; inputs O: Point3d
# ---------- gh_xy: C# ----------
    // Component written by @krichterlunn

    // This component sets two new vectors: one in the X direction and one in the Y direction
    // We then construct our new plane with Origine "O" and vectors X and Y
    Vector3d xVector = new Vector3d(1, 0, 0);
    Vector3d yVector = new Vector3d(0, 1, 0);
    Plane newXY = new Plane(O, xVector, yVector);
    P = newXY;
# ---------- end gh_xy ----------
xy_6 = XYPlane(Origin=pt_6)
panel_33 = Panel(xy_6)
panel_34 = Panel(gh_xy.P)

# ---- group: YZ Plane
pt_7 = Point(Point(-8.200616191, 1.956036226, 0))
gh_yz = CSharpScript(O=pt_7)  # -> out, P; inputs O: Point3d
# ---------- gh_yz: C# ----------
    // Component written by @krichterlunn

    // This component sets two new vectors: one in the Y direction and one in the Z direction
    // We then construct our new plane with Origine "O" and vectors Y and Z
    Vector3d yVector = new Vector3d(0, 1, 0);
    Vector3d zVector = new Vector3d(0, 0, 1);
    Plane newYZ = new Plane(O, yVector, zVector);
    P = newYZ;
# ---------- end gh_yz ----------
yz_3 = YZPlane(Origin=pt_7)
panel_35 = Panel(yz_3)
panel_36 = Panel(gh_yz.P)

# ---- group: Line + Line
crv_2 = Curve(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)
crv_3 = Curve(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)
gh_lnln = CSharpScript(A=crv_2, B=crv_3)  # -> out, Pl; inputs A: Line, B: Line
# ---------- gh_lnln: C# ----------
    // Component written by @krichterlunn

    // Vector x from start and end points of Line A
    Vector3d x = A.To - A.From;
    x.Unitize();

    // Vector y from start and end points of Line B
    Vector3d direction = B.To - B.From;
    Vector3d z = Vector3d.CrossProduct(x, direction);
    z.Unitize();
    Vector3d y = Vector3d.CrossProduct(z, x);

    // Construct new plane (origin = A.From, Vector x, Vector Y)
    Plane newpl = new Plane(A.From, x, y);

    // Output
    Pl = newpl;
# ---------- end gh_lnln ----------
lnln = LineLine(LineA=crv_2, LineB=crv_3)
panel_37 = Panel(lnln)
panel_38 = Panel(gh_lnln.Pl)

# ---- group: Plane 3Pt
pt_8 = Point(Point(2.022902763, -2.775234427, 0))
pt_9 = Point(Point(2.149540586, 2.849301367, 0))
pt_10 = Point(Point(5.771559159, -6.59850313, 0))
gh_pl_3pt = CSharpScript(A=pt_8, B=pt_9, C=pt_10)  # -> out, Pl; inputs A: Point3d, B: Point3d, C: Point3d
# ---------- gh_pl_3pt: C# ----------
    //Component written by @krichterlunn

    //This component constructs a plane from three points
    Plane newpl = new Plane(A, B, C);

    //output new plane
    Pl = newpl;
# ---------- end gh_pl_3pt ----------
pl_3pt = Plane3Pt(PointA=pt_8, PointB=pt_9, PointC=pt_10)
panel_39 = Panel(pl_3pt)
panel_40 = Panel(gh_pl_3pt.Pl)

# ---- group: Plane Normal
pt_11 = Point(Point(0.01220753703, -1.47574791, 0))
Z_2 = UnitZ(Factor=1)
gh_pl_2 = CSharpScript(O=pt_11, Z=Z_2)  # -> out, P; inputs O: Point3d, Z: Vector3d
# ---------- gh_pl_2: C# ----------
    // Component written by @krichterlunn

    // Construct plane from a point3d = origin and a Vector3d = z
    Plane newpl = new Plane(O, Z);

    // Output
    P = newpl;
# ---------- end gh_pl_2 ----------
pl_2 = PlaneNormal(Origin=pt_11, ZAxis=Z_2)
panel_41 = Panel(gh_pl_2.P)
panel_42 = Panel(pl_2)

# ----
xy_7 = XYPlane(Origin=Point(0, 0, 0))

# ---- group: Plane Origin
pt_12 = Point(Point(0.01220753703, -1.47574791, 0))
gh_pl_origin = CSharpScript(B=xy_7, O=pt_12)  # -> out, Pl; inputs B: Plane, O: Point3d
# ---------- gh_pl_origin: C# ----------
    //Component written by @krichterlunn

    //set the new origin of plane B to be = O
    ​B.Origin = O;

    //output new plane
    Pl = B;
# ---------- end gh_pl_origin ----------
pl_origin = PlaneOrigin(Base=xy_7, Origin=pt_12)
panel_43 = Panel(pl_origin)
panel_44 = Panel(gh_pl_origin.Pl)

# ----
yz_4 = YZPlane(Origin=Point(0, 0, 0))

# ---- group: Align Plane
pln_3 = Plane(Plane(origin=(6, 5, 0), x=(0.5368754922, -0.8436614877, 0), y=(0.6305604577, 0.4012657458, -0.6643638388)))
xy_8 = XYPlane(Origin=Point(0, 0, 0))
Y_3 = UnitY(Factor=1)
gh_align_2 = CSharpScript(P=pln_3, D=Y_3)  # -> out, Pl, A; inputs P: Plane, D: Vector3d
# ---------- gh_align_2: C# ----------
    // Component written by @krichterlunn & @garciadelcastillo

    // This component rotates the plane around its normal, 
    // to match a guiding vector.

    // Check valid inputs first
    if (D.Length == 0)
    {
      this.Component.AddRuntimeMessage(GH_RuntimeMessageLevel.Error, "Cannot straighten a plane with a zero-length guide vector.");
      return;
    }

    // Find the projection of the direction vector on the plane
    double u, v;
    P.ClosestParameter(P.Origin + D, out u, out v);  

    // Calculate the angle with the plane axis and rotate it
    double angle = 0.5 * Math.PI - Math.Atan2(u, v);  // this is very strange: u & v should be flipped here, but only works if they aren't, no idea why...
    P.Rotate(angle, P.Normal, P.Origin);

    // Outputs
    Pl = P;
    A = angle;
# ---------- end gh_align_2 ----------
align_2 = AlignPlane(Plane=pln_3, Direction=Y_3)  # -> Plane, Angle
panel_45 = Panel(gh_align_2.A)
panel_46 = Panel(align_2.Plane)
panel_47 = Panel(align_2.Angle)
panel_48 = Panel(gh_align_2.Pl)

# ---- group: Flip Plane
pln_4 = Plane(Plane(origin=(19, 6, 0), x=(0.6178215519, 0.7863183388, 0), y=(0.7099357833, -0.5578066869, 0.4299335804)))
toggle = BooleanToggle(False)
toggle_2 = BooleanToggle(True)
toggle_3 = BooleanToggle(True)
gh_pflip = CSharpScript(P=pln_4, X=toggle, Y=toggle_2, S=toggle_3)  # -> out, Pl; inputs P: Plane, X: Boolean, Y: Boolean, S: Boolean
# ---------- gh_pflip: C# ----------
    // Component written by @krichterlunn & @garciadelcastillo

    // This component flips the directions of the plane's main axes.
    
    // The axis vectors in the plane cannot be changed, so let's get copies
    // and create a new vector with the flipped ones. 
    Vector3d vecX = P.XAxis;
    Vector3d vecY = P.YAxis;
    
    // Flip X or Y?
    if (X == true)
    {
      vecX.Reverse();
    }
    if (Y == true)
    {
      vecY.Reverse();
    }

    // Swap them?
    if (S == true)
    {
      Vector3d prevX = vecX;
      vecX = vecY;
      vecY = prevX;
    }
    
    // Create a new plane with flipped axes.
    Plane newP = new Plane(P.Origin, vecX, vecY);

    // Outputs
    Pl = newP;
# ---------- end gh_pflip ----------
pflip = FlipPlane(Plane=pln_4, ReverseX=toggle, ReverseY=toggle_2, SwapAxes=toggle_3)
panel_49 = Panel(pflip)
panel_50 = Panel(gh_pflip.Pl)

# ---- group: Plane Coordinates
pt_13 = Point(Point(12.08494025, 17.98450827, 0))
xy_9 = XYPlane(Origin=Point(0, 0, 0))
yz_5 = YZPlane(Origin=Point(0, 0, 0))
gh_plcoord = CSharpScript(P=pt_13, S=xy_9)  # -> out, X, Y, Z; inputs P: Point3d, S: Plane
# ---------- gh_plcoord: C# ----------
    //Component written by @krichterlunn

    // get the coordinates of a point3d in plane S
    X = P.X;
    Y = P.Y;
    Z = P.Z;
# ---------- end gh_plcoord ----------
plcoord = PlaneCoordinates(Point=pt_13, System=xy_9)  # -> XCoordinate, YCoordinate, ZCoordinate
panel_51 = Panel(plcoord.XCoordinate)
panel_52 = Panel(plcoord.YCoordinate)
panel_53 = Panel(plcoord.ZCoordinate)
panel_54 = Panel(gh_plcoord.X)
panel_55 = Panel(gh_plcoord.Y)
panel_56 = Panel(gh_plcoord.Z)
