# Grasshopper definition Vector_Vector.ghx (Grasshopper 1.0.7)

# ----
# Vector Vector
number_slider = Slider(10, range=0..10)
number_slider_2 = Slider(6, range=0..10)
number_slider_3 = Slider(3, range=0..10)
vec = VectorXYZ(XComponent=number_slider, YComponent=number_slider_2, ZComponent=number_slider_3)  # -> Vector, Length
gh_vec = CSharpScript(X=number_slider, Y=number_slider_2, Z=number_slider_3)  # -> V, L; inputs X: Double, Y: Double, Z: Double
# ---------- gh_vec: C# usings ----------
using System.IO;
using System.Linq;
using System.Data;
using System.Drawing;
using System.Reflection;
using System.Windows.Forms;
using System.Xml;
using System.Xml.Linq;
using System.Runtime.InteropServices;

using Rhino.DocObjects;
using Rhino.Collections;
using GH_IO;
using GH_IO.Serialization;
# ---------- gh_vec: C# ----------
    //Component written by @erinlinseyhunt

    //Create a new vector
    Vector3d v = new Vector3d(X, Y, Z);

    //Output the vector and its length
    V = v;
    L = v.Length;
# ---------- end gh_vec ----------
panel = Panel(gh_vec.V)
panel_2 = Panel(vec.Vector)
panel_3 = Panel(vec.Length)
panel_4 = Panel(gh_vec.L)

number_slider_4 = Slider(3, range=0..10)
vec_2 = Vector(Vector(22, -6, 0))
gh_amp = CSharpScript(V=vec_2, A=number_slider_4)  # -> out, Vout; inputs V: Vector3d, A: Double
# ---------- gh_amp: C# ----------
    //Component written by @krichterlunn

    //Unitize Vector
    V.Unitize();

    //Multiply vector by Amplitude A
    Vout = V * A;
# ---------- end gh_amp ----------
amp = Amplitude(Vector=vec_2, Amplitude=number_slider_4)
panel_5 = Panel(amp)
panel_6 = Panel(gh_amp.Vout)

number_slider_5 = Slider(5, range=0..10)
gh_x = CSharpScript(F=number_slider_5)  # -> out, V; inputs F: Double
# ---------- gh_x: C# ----------
    //Component written by @krichterlunn

    //Multiplies your XVector with your input value of F
    Vector3d XVector = new Vector3d(1 * F, 0, 0);
    V = XVector;
# ---------- end gh_x ----------
X = UnitX(Factor=number_slider_5)
panel_7 = Panel(X)
panel_8 = Panel(gh_x.V)

number_slider_6 = Slider(3, range=0..10)
gh_y = CSharpScript(F=number_slider_6)  # -> out, V; inputs F: Double
# ---------- gh_y: C# ----------
    //Component written by @krichterlunn

    //Multiplies your YVector with your input value of F
    Vector3d YVector = new Vector3d(0, 1 * F, 0);
    V = YVector;
# ---------- end gh_y ----------
Y = UnitY(Factor=number_slider_6)
panel_9 = Panel(gh_y.V)
panel_10 = Panel(Y)

number_slider_7 = Slider(7, range=0..10)
gh_z = CSharpScript(F=number_slider_7)  # -> out, V; inputs F: Double
# ---------- gh_z: C# ----------
    //Component written by @krichterlunn

    //Multiplies your ZVector with your input value of F
    Vector3d ZVector = new Vector3d(0, 0, 1 * F);
    V = ZVector;
# ---------- end gh_z ----------
Z = UnitZ(Factor=number_slider_7)
panel_11 = Panel(Z)
panel_12 = Panel(gh_z.V)

number_slider_8 = Slider(5, range=0..10)
X_2 = UnitX(Factor=1)
vec_3 = Vector(Vector(4, 13, 0))
gh_vrot = CSharpScript(V=vec_3, X=X_2, A=number_slider_8)  # -> out, Vout; inputs V: Vector3d, X: Vector3d, A: Double
# ---------- gh_vrot: C# ----------
    //Component written by @krichterlunn

    //Rotate Vector
    V.Rotate(A, X);

    //output rotated vector
    Vout = V;
# ---------- end gh_vrot ----------
vrot = Rotate(Vector=vec_3, Axis=X_2, Angle=number_slider_8)
panel_13 = Panel(vrot)
panel_14 = Panel(gh_vrot.Vout)

toggle = BooleanToggle(False)
vec_4 = Vector(Vector(-10, 19, 0))
vec_5 = Vector(Vector(6, -6, 0))
gh_xprod = CSharpScript(A=vec_4, B=vec_5, U=toggle)  # -> out, V, L; inputs A: Vector3d, B: Vector3d, U: Boolean
# ---------- gh_xprod: C# ----------
    //Component written by @krichterlunn

    // get the crossproduct of two vectors (A, B)
    Vector3d crossproduct = Vector3d.CrossProduct(A, B);

    //outputs for when boolean = false
    V = crossproduct;
    L = crossproduct.Length;

    // define boolean value is = true
    if (U == true)
    {
      // get the crossproduct of two vectors (A, B) unitized
      Vector3d crossproduct2 = Vector3d.CrossProduct(A, B);
      crossproduct2.Unitize();
      
      // outputs for when boolean = true 
      V = crossproduct2;
      L = crossproduct2.Length;
    }
# ---------- end gh_xprod ----------
xprod = CrossProduct(VectorA=vec_4, VectorB=vec_5, Unitize=toggle)  # -> Vector, Length
panel_15 = Panel(xprod.Vector)
panel_16 = Panel(xprod.Length)
panel_17 = Panel(gh_xprod.V)
panel_18 = Panel(gh_xprod.L)

toggle_2 = BooleanToggle(False)
vec_6 = Vector(Vector(-10, 19, 0))
vec_7 = Vector(Vector(6, -6, 0))
gh_dprod = CSharpScript(A=vec_6, B=vec_7, U=toggle_2)  # -> out, D; inputs A: Vector3d, B: Vector3d, U: Boolean
# ---------- gh_dprod: C# ----------
    //Component written by @krichterlunn

    // get the dot product of two vectors (A, B)
    double dot = Vector3d.Multiply(A, B);

    //output if boolean = false
    D = dot;

    if (U == true)
    {
      // Unitize A and B Vectors
      A.Unitize();
      B.Unitize();

      //get the dot product of two vectors (A, B) unitized
      double dot2 = Vector3d.Multiply(A, B);

      //output if boolean = true
      D = dot2;
    }
# ---------- end gh_dprod ----------
dprod = DotProduct(VectorA=vec_6, VectorB=vec_7, Unitize=toggle_2)
panel_19 = Panel(dprod)
panel_20 = Panel(gh_dprod.D)

toggle_3 = BooleanToggle(False)
pt = Point(Point(-0.111258938, -0.06423349353, 0))
pt_2 = Point(Point(12.60102352, -3.116514494, 0))
vec2pt = Vector2Pt(PointA=pt, PointB=pt_2, Unitize=toggle_3)  # -> Vector, Length
gh_vec2pt = CSharpScript(A=pt, B=pt_2, U=toggle_3)  # -> V, L; inputs A: Point3d, B: Point3d, U: Boolean
# ---------- gh_vec2pt: C# ----------
    // Component written by @garciadelcastillo
    
    // This component creates a vector between two points, 
    // and optionally unitizes it. 
    
    // Rhinocommon allows simple algebra directly on Point and Vector objects 
    Vector3d v = B - A;
  
    // Optionally, unitize the vector
    if (U == true)
    {
      v.Unitize();
    }
    
    // Outputs
    V = v;
    L = v.Length;
# ---------- end gh_vec2pt ----------
panel_21 = Panel(vec2pt.Vector)
panel_22 = Panel(gh_vec2pt.L)
panel_23 = Panel(vec2pt.Length)

vec_8 = Vector(Vector(12.71228246, -3.052281001, 0))
gh_unit = CSharpScript(V=vec_8)  # -> Vout; inputs V: Vector3d
# ---------- gh_unit: C# ----------
    //Component written by @krichterlunn

    // Unitize vector
    V.Unitize();
    Vout = V;
# ---------- end gh_unit ----------
unit = UnitVector(Vector=vec_8)
panel_24 = Panel(unit)
panel_25 = Panel(gh_unit)

vec_9 = Vector(Vector(-5, 22, 0))
vec_10 = Vector(Vector(7, 4, 0))
pln = Plane(Plane(origin=(6, 1, 0), x=(1, 0, 0), y=(0, 0.847998304, 0.52999894)))
gh_angle = CSharpScript(A=vec_9, B=vec_10, P=pln)  # -> out, Ang, R; inputs A: Vector3d, B: Vector3d, P: Plane
# ---------- gh_angle: C# ----------
    //Component written by @krichterlunn

    // Vector angle based on two vectors (A, B) and a base plane
    double angle = Vector3d.VectorAngle(A, B, P);
    // Vector reflex angle
    double reflex = (2 * Math.PI) - angle;

    // outputs
    Ang = angle;
    R = reflex;
# ---------- end gh_angle ----------
angle = Angle(VectorA=vec_9, VectorB=vec_10, Plane=pln)  # -> Angle, Reflex
panel_26 = Panel(gh_angle.Ang)
panel_27 = Panel(gh_angle.R)
panel_28 = Panel(angle.Angle)
panel_29 = Panel(angle.Reflex)

vec_11 = Vector(Vector(10, 4, 0))
gh_rev = CSharpScript(V=vec_11)  # -> out, Vout; inputs V: Vector3d
# ---------- gh_rev: C# ----------
    //Component written by @krichterlunn

    // reverse vector
    V.Reverse();

    // output vector
    Vout = V;
# ---------- end gh_rev ----------
rev = Reverse(Vector=vec_11)
panel_30 = Panel(rev)
panel_31 = Panel(gh_rev.Vout)

vec_12 = Vector(Vector(16, 5, 0))
gh_vlen = CSharpScript(V=vec_12)  # -> out, L; inputs V: Vector3d
# ---------- gh_vlen: C# ----------
    //Component written by @krichterlunn

    // outputs Vector Length
    L = V.Length;
# ---------- end gh_vlen ----------
vlen = VectorLength(Vector=vec_12)
panel_32 = Panel(vlen)
panel_33 = Panel(gh_vlen.L)

# ----
# GH#: A C# dictionary of Grasshopper3D components.
# 
# This file contains a category of Grasshopper components, and a mirroring C#/RhinoCommon implementation.
# 
# This is an educational project initiated by students/faculty of GSD-6338: Introduction to Computational Design, at the Harvard Graduate School of Design.
# 
# More information: {{project link}}
vec_13 = Vector(Vector(10, 6, 3))
devec = DeconstructVector(Vector=vec_13)  # -> XComponent, YComponent, ZComponent
gh_devec = CSharpScript(V=vec_13)  # -> X, Y, Z; inputs V: Vector3d
# ---------- gh_devec: C# ----------
    //Component written by @erinlinseyhunt

    //Get the X, Y and Z values from the vector
    double xcoord = V.X;
    double ycoord = V.Y;
    double zcoord = V.Z;

    //Output their values
    X = xcoord;
    Y = ycoord;
    Z = zcoord;
# ---------- end gh_devec ----------
panel_34 = Panel(devec.XComponent)
panel_35 = Panel(devec.YComponent)
panel_36 = Panel(devec.ZComponent)
panel_37 = Panel(gh_devec.X)
panel_38 = Panel(gh_devec.Y)
panel_39 = Panel(gh_devec.Z)

panel_40 = Panel(gh_vec2pt.V)
