# Grasshopper definition Curve_Primitive.ghx (Grasshopper 1.0.7)

number_slider = Slider(10, range=0..10)
pt = Point(Point(30.8022043, -44.10034382, 0))
vec = Vector(Vector(175.5572344, 356.437075, 0))
gh_line = CSharpScript(S=pt, D=vec, L=number_slider)  # -> out, Line; inputs S: Point3d, D: Vector3d, L: Double
# ---------- gh_line: C# ----------
//Component written by @Suekim37
//Create a line with starting point, direction vector, and line length
Line line = new Line(S, D, L);


//output
Line = line;
# ---------- end gh_line ----------
line = LineSDL(Start=pt, Direction=vec, Length=number_slider)
panel = Panel(gh_line.Line)
panel_2 = Panel(line)

number_slider_2 = Slider(8.6, range=0..10)
pt_2 = Point(Point(-8.844056887, 75.87621468, 0))
vec_2 = Vector(Vector(93.19585365, 32.9231477, 0))
gh_circle = CSharpScript(C=pt_2, N=vec_2, R=number_slider_2)  # -> out, Cir; inputs C: Point3d, N: Vector3d, R: Double
# ---------- gh_circle: C# usings ----------
using System.IO;
using System.Linq;
using System.Data;
using System.Drawing;
using System.Reflection;
using System.Windows.Forms;
using System.Xml;
using System.Xml.Linq;
using System.Runtime.InteropServices;

using Rhino.DocObjects;
using Rhino.Collections;
using GH_IO;
using GH_IO.Serialization;
# ---------- gh_circle: C# ----------
    //Component written by @Suekim37
    //Create a plane with the center point and a normal vector
    Plane plane = new Plane(C, N);

    //Create a circle with the plane and radius
    Circle circle = new Circle(plane, R);

    //output
    Cir = circle;
# ---------- end gh_circle ----------
circle = CircleCNR(Center=pt_2, Normal=vec_2, Radius=number_slider_2)
panel_3 = Panel(circle)
panel_4 = Panel(gh_circle.Cir)

number_slider_3 = Slider(8.6, range=0..10)
pln = Plane(Plane(origin=(40.29354661, 70.88856589, 0), x=(-0.38110474, 0.9245318692, 0), y=(-0.9245318692, -0.38110474, 0)))
gh_cir = CSharpScript(P=pln, R=number_slider_3)  # -> out, C; inputs P: Plane, R: Double
# ---------- gh_cir: C# ----------
//Component written by @Suekim37
//Create a circle with plane and radius
Circle circle = new Circle(P, R);

//output
C = circle;
# ---------- end gh_cir ----------
cir = Circle(Plane=pln, Radius=number_slider_3)
panel_5 = Panel(gh_cir.C)
panel_6 = Panel(cir)

number_slider_4 = Slider(3.5, range=0..10)
number_slider_5 = Slider(5, range=0..10)
pln_2 = Plane(Plane(origin=(2.442382, -22.92411509, 0), x=(-0.0943512179, 0.9955389735, 0), y=(0.9955389735, 0.0943512179, 0)))
gh_ellipse = CSharpScript(P=pln_2, R1=number_slider_4, R2=number_slider_5)  # -> out, E, F1, F2; inputs P: Plane, R1: Double, R2: Double
# ---------- gh_ellipse: C# ----------
//Component written by @Suekim37
//R1 is an ellipse radius along base plane X direction.
//R2 is an ellipse radius along base plane Y direction. @Rhinocommon

//Focus of Ellipse
//An ellipse is defined by two points, each called a focus. (F1, F2 here).
//If you take any point on the ellipse, the sum of the distances to the focus points is constant.
//source: https://www.mathopenref.com/ellipse.html

//Create an epllipse
Ellipse e = new Ellipse(P, R1, R2);

//Get the distance between the foci and the center
double F = Math.Sqrt(Math.Abs((R1 * R1) - (R2 * R2)));

//Get the foci point from the center point of ellipse
Point3d foci1 = new Point3d(P.Origin + P.YAxis * F);
Point3d foci2 = new Point3d(P.Origin - P.YAxis * F);

//output
E = e; // geometry
F1 = foci1; 
F2 = foci2;
# ---------- end gh_ellipse ----------
ellipse = Ellipse(Plane=pln_2, Radius1=number_slider_4, Radius2=number_slider_5)  # -> Ellipse, Focus1, Focus2
panel_7 = Panel(ellipse.Ellipse)
panel_8 = Panel(ellipse.Focus1)
panel_9 = Panel(ellipse.Focus2)
panel_10 = Panel(gh_ellipse.E)
panel_11 = Panel(gh_ellipse.F1)
panel_12 = Panel(gh_ellipse.F2)

number_slider_6 = Slider(0.8, range=0..1)
number_slider_7 = Slider(6, range=3..10)
number_slider_8 = Slider(3, range=0..10)
pln_3 = Plane(Plane(origin=(-195.7521215, -24.70473988, 0), x=(0.997384796, 0.07227426058, 0), y=(0.07227426058, -0.997384796, 0)))
gh_polygon = CSharpScript(P=pln_3, R=number_slider_8, S=number_slider_7, Rf=number_slider_6)  # -> out, Polygon, L; inputs P: Plane, R: Double, S: Int32, Rf: Double
# ---------- gh_polygon: C# ----------
    //Component written by @Suekim37
    //This component creates a polygon

    //Create a new circle from a plane and radius input
    //And create a polyline from the circle
    Circle c = new Circle(P, R);
    Polyline p = Polyline.CreateInscribedPolygon(c, S);

    //Convert the polyline to a curve becasue CreateFilletCornersCurve only takes curve input.
    Curve pc = p.ToPolylineCurve();


    //Fillet the corners (optional input)
    pc = Curve.CreateFilletCornersCurve(pc, Rf, 0, 0);

    //output
    Polygon = pc;
# ---------- end gh_polygon ----------
polygon = Polygon(Plane=pln_3, Radius=number_slider_8, Segments=number_slider_7, FilletRadius=number_slider_6)  # -> Polygon, Length
panel_13 = Panel(polygon.Polygon)
panel_14 = Panel(gh_polygon.Polygon)
panel_15 = Panel(gh_polygon.L)
panel_16 = Panel(polygon.Length)

number_slider_9 = Slider(9.7, range=0..10)
number_slider_10 = Slider(3, range=0..10)
pln_4 = Plane(Plane(origin=(-205.3293543, -264.8921459, 0), x=(0.8033042613, 0.5955688574, 0), y=(0.1239811881, -0.1672260319, -0.9780920812)))
gh_arc = CSharpScript(P=pln_4, R=number_slider_9, A=number_slider_10)  # -> out, Arc, L; inputs P: Plane, R: Double, A: Double
# ---------- gh_arc: C# ----------
//Component written by @Suekim37
//Create an arc from plane, radius and angle
Arc arc = new Arc(P, R, A);

Arc = arc;
L = arc.Length;
# ---------- end gh_arc ----------
arc = Arc(Plane=pln_4, Radius=number_slider_9, Angle=number_slider_10)  # -> Arc, Length
panel_17 = Panel(arc.Length)
panel_18 = Panel(gh_arc.L)

number_slider_11 = Slider(7.2, range=0..10)
domain = Domain(Domain(0, 1))
arc_2 = CircularArc({Angle=0, Angle=0.508771983, Plane=Plane(origin=(-161.2507491, -40.39613601, 0), x=(0.8701091694, 0.49285904, 0), y=(0.49285904, -0.8701091694, 0)), Radius=394.7538335})
gh_modarc = CSharpScript(A=arc_2, R=number_slider_11, Angle=domain)  # -> out, Arc; inputs R: Double
# ---------- gh_modarc: C# ----------
    //Component written by @Suekim37
    //This component modifies the arc(input) by new radius and angle(domain)

    //Creat a full circle by using the center of input arc and the new radius
    Circle c = new Circle(A.Center, R);
    Arc a = new Arc();


    //Create a new arc from the circle and the angle domain
    //But first, check if the angle paramater has input
    //If not, use the original angle domain, otherwise, use the input value for a new arc
    if (Angle.T0 == 0 && Angle.T1 == 0 ) {
      a = new Arc(c, A.AngleDomain);
    }
    else {
      a = new Arc(c, Angle);
    }

    //output
    Arc = a;
# ---------- end gh_modarc ----------
modarc = ModifiedArc(Arc=arc_2, Radius=number_slider_11, Angle=domain)
panel_19 = Panel(gh_modarc.Arc)
panel_20 = Panel(modarc)

number_slider_12 = Slider(0.7, range=0..1)
pln_5 = Plane(Plane(origin=(-178.5358251, -25.32578666, 0), x=(-0.8918644873, 0.4523027043, 0), y=(-0.4523027043, -0.8918644873, 0)))
domain_2 = Domain(Domain(0, 3))
domain_3 = Domain(Domain(0, 5))
gh_rectangle = CSharpScript(P=pln_5, X=domain_2, Y=domain_3, R=number_slider_12)  # -> out, Rec, L; inputs P: Plane, R: Double
# ---------- gh_rectangle: C# ----------
    //Component written by @Suekim37
    //This component creates a rectangle

    //Create a rectangle
    Rectangle3d p = new Rectangle3d(P, X, Y);

    //Convert it to polyline and to a polylinecurve,
    //becasue CreateFilletCornersCurve only takes curve input.
    Polyline pl = p.ToPolyline();
    Curve pc = pl.ToPolylineCurve();


    //Fillet the corners (optional input)
    pc = Curve.CreateFilletCornersCurve(pc, R, 0, 0);
    PolyCurve a = pc.ToArcsAndLines(0, 0, 0, 1);

    Rec = pc;
    L = a;
# ---------- end gh_rectangle ----------
rectangle = Rectangle(Plane=pln_5, XSize=domain_2, YSize=domain_3, Radius=number_slider_12)  # -> Rectangle, Length
panel_21 = Panel(gh_rectangle.L)
panel_22 = Panel(rectangle.Rectangle)
panel_23 = Panel(rectangle.Length)
panel_24 = Panel(gh_rectangle.Rec)

pt_3 = Point(Point(-261.7124038, -250.896599, 0))
pt_4 = Point(Point(-264.9899016, -285.6511768, 0))
vec_3 = Vector(Vector(-209.7498489, -298.3924404, 0))
gh_arc_2 = CSharpScript(S=pt_3, E=pt_4, D=vec_3)  # -> out, Arc, P, R; inputs S: Point3d, E: Point3d, D: Vector3d
# ---------- gh_arc_2: C# ----------
//Component written by @Suekim37
//Create an arc from start point, end point, and the direction
Arc arc = new Arc(S, D, E);

Arc = arc;
P = arc.Plane;
R = arc.Radius;
# ---------- end gh_arc_2 ----------
arc_3 = ArcSED(Start=pt_3, End=pt_4, Direction=vec_3)  # -> Arc, Plane, Radius
panel_25 = Panel(arc_3.Radius)
panel_26 = Panel(gh_arc_2.R)

# ----
# GH#: A C# dictionary of Grasshopper3D components.
# 
# This file contains a category of Grasshopper components, and a mirroring C#/RhinoCommon implementation.
# 
# This is an educational project initiated by students/faculty of GSD-6338: Introduction to Computational Design, at the Harvard Graduate School of Design.
# 
# More information: {{project link}}
# Curve Primitive
pt_5 = Point([Point(155.8388528, 71.52896409, 0), Point(51.30531797, 108.1264096, 0), Point(73.84949321, 151.7913449, 0), Point(-21.15314735, 182.7391885, 0), Point(13.84048851, 76.2304555, 0), Point(93.00540162, 50.08050932, 0), Point(183.6595771, 31.76672344, 0), Point(135.6409858, 173.1669196, 0), Point(69.04437681, 82.55870659, 0), Point(187.854755, 76.16309522, 0), Point(-13.72068491, 121.8715823, 0)])
gh_fline = CSharpScript(P=pt_5)  # -> out, L; inputs P: list of Point3d
# ---------- gh_fline: C# ----------
    //Component written by @Suekim37
    //Define a new line
    Line line = new Line();

    //Fit the line to the input points
    //Output of this command is stored in line
    Line.TryFitLineToPoints(P, out line);

    //output
    L = line;
# ---------- end gh_fline ----------
fline = FitLine(Points=pt_5)
panel_27 = Panel(fline)
panel_28 = Panel(gh_fline.L)

circle_2 = Circle({Plane=Plane(origin=(7.715534002, 219.9828951, 0), x=(0.2519473513, -0.9677409427, 0), y=(0.9677409427, 0.2519473513, 0)), Radius=77.38693699})
circle_3 = Circle({Plane=Plane(origin=(10.4370723, 9.75584062, 0), x=(0.7579917419, -0.6522641483, 0), y=(0.6522641483, 0.7579917419, 0)), Radius=18.19682297})
gh_tanex = CSharpScript(A=circle_2, B=circle_3)  # -> out, T1, T2
# ---------- gh_tanex: C# ----------
    //Component written by @joon @Suekim37
    //Get the center and the radius of each circle
    Point3d pt1 = A.Center;
    Point3d pt2 = B.Center;
    double r1 = A.Radius;
    double r2 = B.Radius;

    //We can calculate the angle by using acos.
    //First, get the distance between the centers.
    double dist_center = pt1.DistanceTo(pt2);

    //Get the difference of two radius
    double dist_rad = Math.Abs(r1 - r2);

    //Get the angle of bigger circle
    double angle = Math.Acos(dist_rad / dist_center);

    //Create a vector from a smaller circle center to a bigger circle center
    Vector3d v1 ;
    if (r1 < r2){
      v1 = pt1 - pt2;
    }
    else {
      v1 = pt2 - pt1;
    }
    //Unitize and rotate the vector with the angle we got above.
    //It will be a unit vector towards the tangent point
    v1.Unitize();
    v1.Rotate(angle, A.Plane.ZAxis);


    //Get the tangent points
    //Start the vector from each center and multiply it by each circle radius
    Point3d r1_tan = pt1 + (v1 * r1);
    Point3d r2_tan = pt2 + (v1 * r2);

    //Get another tangent points
    //Rotate the vector to the other side to get another tangent point
    v1.Rotate(-2.0 * angle, A.Plane.ZAxis);
    Point3d r1_tan2 = pt1 + (v1 * r1);
    Point3d r2_tan2 = pt2 + (v1 * r2);

    //Connect the points!
    Line L1 = new Line(r1_tan, r2_tan);
    Line L2 = new Line(r1_tan2, r2_tan2);

    //outputs
    T1 = L1;
    T2 = L2;
# ---------- end gh_tanex ----------
tanex = TangentLinesEx(CircleA=circle_2, CircleB=circle_3)  # -> Tangent1, Tangent2
panel_29 = Panel(tanex.Tangent1)
panel_30 = Panel(tanex.Tangent2)
panel_31 = Panel(gh_tanex.T1)
panel_32 = Panel(gh_tanex.T2)

pt_6 = Point(Point(-195.6973447, -21.70386075, 0))
pt_7 = Point(Point(-195.3011525, -23.59992335, 0))
pt_8 = Point(Point(-190.6317447, -24.25081051, 0))
gh_rec_3pt = CSharpScript(A=pt_6, B=pt_7, C=pt_8)  # -> out, R, L; inputs A: Point3d, B: Point3d, C: Point3d
# ---------- gh_rec_3pt: C# ----------
    //Component written by @Suekim37
    //This component creates a rectangle
# ---------- end gh_rec_3pt ----------
rec_3pt = Rectangle3Pt(PointA=pt_6, PointB=pt_7, PointC=pt_8)  # -> Rectangle, Length
panel_33 = Panel(rec_3pt.Rectangle)
panel_34 = Panel(rec_3pt.Length)
panel_35 = Panel(gh_rec_3pt.R)
panel_36 = Panel(gh_rec_3pt.L)

ln2pl = Line2Plane()
circlett = CircleTanTan()
inellipse = InEllipse()  # -> Ellipse, Plane
panel_37 = Panel(arc.Arc)
panel_38 = Panel(arc_3.Arc)
panel_39 = Panel(gh_arc_2.Arc)
panel_40 = Panel(gh_arc_2.P)
panel_41 = Panel(gh_arc.Arc)
panel_42 = Panel(arc_3.Plane)

number_slider_13 = Slider(7, range=0..10)
pt_9 = Point(Point(-195.1419831, -21.80808152, 0))
pt_10 = Point(Point(-189.924582, -22.16085953, 0))
pt_11 = Point(Point(-191.7441738, -20.61977664, 0))
gh_poledge = CSharpScript(E0=pt_9, E1=pt_10, P=pt_11, S=number_slider_13)  # -> out, Polygon, C, Rc1, Rc2; inputs E0: Point3d, E1: Point3d, P: Point3d, S: Int32
# ---------- gh_poledge: C# ----------
    //Component written by @Suekim37
    //This component modifies the arc(input) by new radius and angle(domain)
# ---------- end gh_poledge ----------
poledge = PolygonEdge(EdgeStart=pt_9, EdgeEnd=pt_10, PlanePoint=pt_11, Segments=number_slider_13)  # -> Polygon, Centre, CornerRadius, EdgeRadius
panel_43 = Panel(poledge.Centre)
panel_44 = Panel(poledge.Polygon)
panel_45 = Panel(poledge.EdgeRadius)
panel_46 = Panel(poledge.CornerRadius)
panel_47 = Panel(gh_poledge.C)
panel_48 = Panel(gh_poledge.Polygon)
panel_49 = Panel(gh_poledge.Rc2)
panel_50 = Panel(gh_poledge.Rc1)

number_slider_14 = Slider(0.6, range=0..1)
pln_6 = Plane(Plane(origin=(-190.8294342, -21.71001928, 0), x=(1, 0, 0), y=(0, -1, 0)))
pt_12 = Point(Point(-182.8090047, -20.32945355, 0))
pt_13 = Point(Point(-189.924582, -22.16085953, 0))
rec_2pt = Rectangle2Pt(Plane=pln_6, PointA=pt_12, PointB=pt_13, Radius=number_slider_14)  # -> Rectangle, Length
gh_rec_2pt = CSharpScript(P=pln_6, A=pt_12, B=pt_13, R=number_slider_14)  # -> out, Rec, L; inputs P: Plane, A: Point3d, B: Point3d, R: Double; same code as gh_poledge
panel_51 = Panel(rec_2pt.Length)
panel_52 = Panel(rec_2pt.Rectangle)
panel_53 = Panel(gh_rec_2pt.L)
panel_54 = Panel(gh_rec_2pt.Rec)

number_slider_15 = Slider(10, range=0..10)
number_slider_16 = Slider(39, range=0..100)
circle_4 = Circle({Plane=Plane(origin=(-148.3359368, -47.40703434, 0), x=(0.7808688094, -0.6246950476, 0), y=(0.6246950476, 0.7808688094, 0)), Radius=25.76099451})
circle_5 = Circle({Plane=Plane(origin=(-215.2933369, -31.88901028, 0), x=(0.5754934062, -0.8178064193, 0), y=(0.8178064193, 0.5754934062, 0)), Radius=9.48759003})
tarc = TangentArcs(CircleA=circle_5, CircleB=circle_4, Radius=number_slider_16)  # -> ArcA, ArcB
gh_tarc = CSharpScript(A=circle_5, B=circle_4, R=number_slider_16)  # -> out, Arc1, Arc2; inputs R: Double; same code as gh_poledge
panel_55 = Panel(gh_tarc.Arc2)
panel_56 = Panel(gh_tarc.Arc1)
panel_57 = Panel(tarc.ArcB)
panel_58 = Panel(tarc.ArcA)

line_2 = Line(Line((36.37579819, 31.61502154, 0), (66.44652427, 29.5490938, 0)))
pt_14 = Point(Point(93.00540162, 50.08050932, 0))
pt_15 = Point(Point(-67.62681419, 108.9522877, 0))
gh_ln4pt = CSharpScript(L=line_2, A=pt_14, B=pt_15)  # -> out, Line; inputs L: Line, A: Point3d, B: Point3d
# ---------- gh_ln4pt: C# ----------
//Component written by @Suekim37
//Define two points
Point3d a = new Point3d();
Point3d b = new Point3d();

//Get the points projected on the line
a = L.ClosestPoint(A, false); 
b = L.ClosestPoint(B, false);

//Make a line with projected points
Line line = new Line(a,b);

//output
Line = line;
# ---------- end gh_ln4pt ----------
ln4pt = Line4Pt(Line=line_2, PointA=pt_14, PointB=pt_15)
panel_59 = Panel(gh_ln4pt.Line)
panel_60 = Panel(ln4pt)

pt_16 = Point(Point(51.64304902, 11.48408087, 0))
pt_17 = Point(Point(90.04353155, 431.0087378, 0))
gh_ln = CSharpScript(A=pt_16, B=pt_17)  # -> out, L; inputs A: Point3d, B: Point3d
# ---------- gh_ln: C# ----------
//Component written by @Suekim37
//Create a line with two points 
Line line = new Line(A,B);

//output
L = line;
# ---------- end gh_ln ----------
ln = Line(StartPoint=pt_16, EndPoint=pt_17)
panel_61 = Panel(ln)
panel_62 = Panel(gh_ln.L)

pt_18 = Point(Point(31.60245599, -1.72550109, 0))
circle_6 = Circle({Plane=Plane(origin=(17.84871099, -18.26387632, 0), x=(-0.6049502706, 0.7962632543, 0), y=(-0.7962632543, -0.6049502706, 0)), Radius=10.9756345})
gh_tan = CSharpScript(P=pt_18, C=circle_6)  # -> out, T1, T2; inputs P: Point3d
# ---------- end gh_tan ----------
tan = TangentLines(Point=pt_18, Circle=circle_6)  # -> Tangent1, Tangent2
panel_63 = Panel(tan.Tangent2)
panel_64 = Panel(tan.Tangent1)
panel_65 = Panel(gh_tan.T1)
panel_66 = Panel(gh_tan.T2)

pt_19 = Point([Point(-121.1336366, 92.4062709, 0), Point(-116.1971314, 74.67141895, 0), Point(-127.0284732, 65.55135763, 0), Point(-92.37420679, 98.42848215, 0), Point(-94.69990153, 59.96386069, 0), Point(-107.6039557, 66.7654269, 0)])
gh_fcircle = CSharpScript(P=pt_19)  # -> out, C, R, D; inputs P: list of Point3d
# ---------- gh_fcircle: C# ----------
    //Component written by @Suekim37
    //This C# code is to create a circle fitting to the given points.
    //Rhinocommon has the same function as Grasshopper component, but it is returning a different result sometimes.
   

    //Fit a circle to the given points list
    //The output is stored in 'out c'
    Circle c = new Circle();
    Circle.TryFitCircleToPoints(P, out c);

    //Get the maximum distance between circle and points.
    //For that, create a distance list at first.
    List<double> dists = new List<double>();

    //Get the closest points on the circle from each point on the list.
    //Get the distance of each of pair, and store them to the list created above.
    for (int i = 0; i < P.Count; i++)
    {
      Point3d p = c.ClosestPoint(P[i]);
      double dist = p.DistanceTo(P[i]);
      dists.Add(dist);
    }

    //sort the list by distance value (ascending) to get the maximum value
    dists.Sort();

    //Outputs
    C = c;
    R = c.Radius;
    D = dists[P.Count - 1]; // the last value of the distance list
# ---------- end gh_fcircle ----------
fcircle = CircleFit(Points=pt_19)  # -> Circle, Radius, Deviation
panel_67 = Panel(gh_fcircle.R)
panel_68 = Panel(gh_fcircle.D)
panel_69 = Panel(gh_fcircle.C)
panel_70 = Panel(fcircle.Radius)
panel_71 = Panel(fcircle.Deviation)
panel_72 = Panel(fcircle.Circle)

circle_7 = Circle({Plane=Plane(origin=(-237.4107737, -115.0053346, 0), x=(-0.1828460778, -0.9831415523, 0), y=(0.9831415523, -0.1828460778, 0)), Radius=24.42570758})
circle_8 = Circle({Plane=PlaneXY(-219.5202983, -213.3510707, 0), Radius=49.19498341})
tanin = TangentLinesIn(CircleA=circle_7, CircleB=circle_8)  # -> Tangent1, Tangent2
gh_tanin = CSharpScript(A=circle_7, B=circle_8)  # -> out, T1, T2
# ---------- gh_tanin: C# ----------
    //Component written by @joon @Suekim37

    // TODO: Match result with original
    Component.AddRuntimeMessage(GH_RuntimeMessageLevel.Warning, "Output doesn't match original exactly");

    //Get the center and the radius of each circle
    Point3d pt1 = A.Center;
    Point3d pt2 = B.Center;
    double r1 = A.Radius;
    double r2 = B.Radius;

    //We can calculate the angle by using acos.
    //First, get the distance between the centers.
    double dist_center = pt1.DistanceTo(pt2);

    //Get the angle and the vector from the center to the tangent point
    double angle = Math.Acos(r1 / dist_center);

    Vector3d v = A.TangentAt(angle);
    v.Rotate(angle, A.Plane.ZAxis);

    Point3d r1_tan1 = pt1 - (v * r1);
    Point3d r2_tan1 = pt2 + (v * r2);

    //Connect the points!
    Line L1 = new Line(r1_tan1, r2_tan1);


    //Create another tangent line by mirroring it
    Vector3d centers = new Vector3d(pt2 - pt1);
    Plane pl = new Plane(pt1, centers, A.Plane.ZAxis);
    Transform mi = Transform.Mirror(pl);

    //outputs
    T1 = L1;
    L1.Transform(mi);
    T2 = L1;
# ---------- end gh_tanin ----------
panel_73 = Panel(gh_tanin.T1)
panel_74 = Panel(tanin.Tangent1)
panel_75 = Panel(tanin.Tangent2)
panel_76 = Panel(gh_tanin.T2)

pt_20 = Point(Point(59.84576683, -56.08766616, 0))
pt_21 = Point(Point(14.28961613, -57.39863453, 0))
pt_22 = Point(Point(110.645791, -17.08635728, 0))
gh_circle_2 = CSharpScript(A=pt_20, B=pt_21, C=pt_22)  # -> out, Cir, P, R; inputs A: Point3d, B: Point3d, C: Point3d
# ---------- gh_circle_2: C# ----------
//Component written by @Suekim37
//Define a circle with three points
Circle circle = new Circle(A, B, C);


//outputs
Cir = circle;
P = circle.Plane;
R = circle.Radius;
# ---------- end gh_circle_2 ----------
circle_9 = Circle3Pt(PointA=pt_20, PointB=pt_21, PointC=pt_22)  # -> Circle, Plane, Radius
panel_77 = Panel(gh_circle_2.P)
panel_78 = Panel(gh_circle_2.R)
panel_79 = Panel(gh_circle_2.Cir)
panel_80 = Panel(circle_9.Plane)
panel_81 = Panel(circle_9.Radius)
panel_82 = Panel(circle_9.Circle)

crv = Curve(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)
pt_23 = Point(Point(-3.080714717, 58.29432374, 0))
crv_2 = Curve(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)
crv_3 = Curve(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)
gh_circlett = CSharpScript(A=crv_2, B=crv, C=crv_3, P=pt_23)  # -> out, Cir; inputs A: Curve, B: Curve, C: Curve, P: Point3d
# ---------- gh_circlett: C# ----------
//Component written by @Suekim37
//x and y are the parameters on first and second curve close to desired solution respectively
double x = 0.1;
double y = 0.1;
double z = 0.1;

//Try to fit a circle to two curves using tangent relationships @Rhinocommon
//output
Cir = Circle.TryFitCircleTTT(A, B, C, x, y, z);
# ---------- end gh_circlett ----------
circlettt = CircleTanTanTan(CurveA=crv_2, CurveB=crv, CurveC=crv_3, Point=pt_23)
panel_83 = Panel(circlettt)
panel_84 = Panel(gh_circlett.Cir)

pt_24 = Point(Point(-11.07504258, 0.9097356401, 0))
pt_25 = Point(Point(-7.437512648, -10.93983342, 0))
pt_26 = Point(Point(-3.40162022, 0.1186611705, 0))
gh_incircle = CSharpScript(A=pt_24, B=pt_25, C=pt_26)  # -> out, Cir, P, R; inputs A: Point3d, B: Point3d, C: Point3d
# ---------- gh_incircle: C# ----------
    //Component written by @Suekim37

    //Draw temporary lines from the points
    Line a = new Line(A, B);
    Line b = new Line(B, C);
    Line c = new Line(C, A);

    //Convert lines to curves to fit a circle in it
    Curve c1 = a.ToNurbsCurve();
    Curve c2 = b.ToNurbsCurve();
    Curve c3 = c.ToNurbsCurve();

    //Fit a circle in the triangle
    Circle circle = Circle.TryFitCircleTTT(c1, c2, c3, 0.1, 0.1, 0.1);
    //Create plane from the normal vector and the center point of circle.
    Plane pl = new Plane(circle.Center, circle.Normal);

    //Outputs
    Cir = circle;
    P = pl;
    R = circle.Radius;
# ---------- end gh_incircle ----------
incircle = InCircle(CornerA=pt_24, CornerB=pt_25, CornerC=pt_26)  # -> Circle, Plane, Radius
panel_85 = Panel(gh_incircle.Cir)
panel_86 = Panel(incircle.Circle)
panel_87 = Panel(incircle.Plane)
panel_88 = Panel(incircle.Radius)
panel_89 = Panel(gh_incircle.P)
panel_90 = Panel(gh_incircle.R)

pt_27 = Point(Point(-264.9899016, -285.6511768, 0))
pt_28 = Point(Point(-261.1869512, -313.4963266, 0))
pt_29 = Point(Point(-261.7124038, -250.896599, 0))
gh_arc_3 = CSharpScript(A=pt_29, B=pt_27, C=pt_28)  # -> out, Arc, P, R; inputs A: Point3d, B: Point3d, C: Point3d
# ---------- gh_arc_3: C# ----------
    //Component written by @Suekim37
    //Create an arc from three points
    Arc arc = new Arc(A, B, C);

    //outputs
    Arc = arc;
    P = arc.Plane;
    R = arc.Radius;
# ---------- end gh_arc_3 ----------
arc_4 = Arc3Pt(PointA=pt_29, PointB=pt_27, PointC=pt_28)  # -> Arc, Plane, Radius
panel_91 = Panel(arc_4.Arc)
panel_92 = Panel(arc_4.Plane)
panel_93 = Panel(arc_4.Radius)
panel_94 = Panel(gh_arc_3.Arc)
panel_95 = Panel(gh_arc_3.P)
panel_96 = Panel(gh_arc_3.R)

biarc = BiArc(Ratio=0.5)  # -> FirstArc, SecondArc, BiArc
