# Grasshopper definition Curve_Util.ghx (Grasshopper 1.0.7)

# ---- group: Curve To Polyline
number_slider = Slider(1, range=0..10)
crv = Curve(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)
number_slider_2 = Slider(10, range=0..10)
number_slider_3 = Slider(1, range=0..1)
number_slider_4 = Slider(10, range=0..10)
gh_topoly = CSharpScript(C=crv, Td=number_slider_2, Ta=number_slider_3, Eminus=number_slider, Eplus=number_slider_4)  # -> out, P, S; inputs C: Curve, Td: Double, Ta: Double, Eminus: Double, Eplus: Double
# ---------- gh_topoly: C# ----------
    // Written by @garciadelcastillo

    // This component converts a curve into a polyline,
    // given a set of tolerance values.
    PolylineCurve poly = C.ToPolyline(0, 0, Ta, 0, 0, Td, Eminus, Eplus, true);

    // Outputs
    P = poly;
    S = poly.SpanCount;
# ---------- end gh_topoly ----------
topoly = CurveToPolyline(
    Curve=crv,
    ToleranceDistance=number_slider_2,
    ToleranceAngle=number_slider_3,
    MinEdge=number_slider,
    MaxEdge=number_slider_4)  # -> Polyline, Segments
panel = Panel([topoly.Polyline, topoly.Segments])
panel_2 = Panel([gh_topoly.P, gh_topoly.S])

# ---- group: Polyline Collapse
crv_2 = Curve(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)
number_slider_5 = Slider(7.5, range=0..10)
gh_pcol = CSharpScript(P=crv_2, t=number_slider_5)  # -> out, Pl, N; inputs P: Polyline, t: Double
# ---------- gh_pcol: C# ----------
    // Written by @garciadelcastillo

    // This component reduces the number of spans on a polyline
    // by removing the ones shorter than specified length.

    // Reduce the polyline (in place)
    int collapsed = P.CollapseShortSegments(t);

    // Outputs
    Pl = P;
    N = collapsed;
# ---------- end gh_pcol ----------
pcol = PolylineCollapse(Polyline=crv_2, Tolerance=number_slider_5)  # -> Polyline, Count
panel_3 = Panel([pcol.Polyline, pcol.Count])
panel_4 = Panel([gh_pcol.Pl, gh_pcol.N])

# ---- group: Reduce
crv_3 = Curve(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)
number_slider_6 = Slider(1.71, range=0..10)
gh_pcol_2 = CSharpScript(P=crv_3, T=number_slider_6)  # -> out, POut, R; inputs P: Polyline, T: Double
# ---------- gh_pcol_2: C# ----------
    // Written by @garciadelcastillo

    // This component reduces the number of "significant" vertices in a polyline
    // (although not sure really what the "significance" parameter means).

    // Reduce the polyline (in place)
    int reduced = P.ReduceSegments(T);

    // Outputs
    POut = P;
    R = reduced;
# ---------- end gh_pcol_2 ----------
redpline = Reduce(Polyline=crv_3, Tolerance=number_slider_6)  # -> Polyline, Reduction
panel_5 = Panel([gh_pcol_2.POut, gh_pcol_2.R])
panel_6 = Panel([redpline.Polyline, redpline.Reduction])

# ---- group: Project
crv_4 = Curve(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)
crv_5 = Curve(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)
brep = Brep(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)
brep_2 = Brep(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)
Z = UnitZ(Factor=-1)
gh_project = CSharpScript(C=crv_4, B=brep, D="{0.5, 0.5, -0.5}")  # -> out, COut; inputs C: Curve, B: Brep, D: Vector3d
# ---------- gh_project: C# ----------
    // Written by @garciadelcastillo

    // This component projects a curve through a brep along a specified direction.
    Curve[] proj = Curve.ProjectToBrep(C, B, D, this.RhinoDocument.ModelAbsoluteTolerance);

    // Outputs
    COut = proj;
# ---------- end gh_project ----------
project = Project(Curve=crv_4, Brep=brep, Direction="{0.5, 0.5, -0.5}")
panel_7 = Panel(gh_project.COut)
panel_8 = Panel(project)

# ---- group: Seam
crv_6 = Curve(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)
number_slider_7 = Slider(84.01, range=0..100)
seam = Seam(Curve=crv_6, Seam=number_slider_7)
gh_seam = CSharpScript(C=crv_6, t=number_slider_7)  # -> out, COut; inputs C: Curve, t: Double
# ---------- gh_seam: C# ----------
    // Written by @garciadelcastillo

    // This component changes where the seam point is along a closed curve.

    // Some sanity first
    if (C.IsClosed == false)
    {
      this.Component.AddRuntimeMessage(GH_RuntimeMessageLevel.Error, "Curve is not closed and the seam cannot be adjusted");
    }

    // Change the seam location
    bool success = C.ChangeClosedCurveSeam(t);

    // Outputs
    COut = C;
# ---------- end gh_seam ----------
panel_9 = Panel(gh_seam.COut)
panel_10 = Panel(seam)
end = EndPoints(Curve=seam)  # -> Start, End
end_2 = EndPoints(Curve=gh_seam.COut)  # -> Start, End
panel_11 = Panel(end.Start)
panel_12 = Panel(end_2.Start)

# ---- group: Fillet
crv_7 = Curve(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)
number_slider_8 = Slider(10, range=0..10)
gh_fillet = GHFillet(C=crv_7, R=number_slider_8)  # -> out, c; inputs C: Curve, R: Double
# ---------- gh_fillet: C# ----------
    // Written by @v-xup6

    // Fillet the sharp corners of a curve

    double tol = Rhino.RhinoDoc.ActiveDoc.ModelAbsoluteTolerance;
    double aTol = Rhino.RhinoDoc.ActiveDoc.ModelAngleToleranceRadians;
    c = Curve.CreateFilletCornersCurve(C, R, tol, aTol);
# ---------- end gh_fillet ----------
fillet = Fillet(Curve=crv_7, Radius=number_slider_8)
panel_13 = Panel(fillet)
panel_14 = Panel(gh_fillet.c)

# ---- group: Fillet Distance
crv_8 = Curve([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])
number_slider_9 = Slider(5, range=0..12)
gh_fillet_2 = GHFilletDistance(C=crv_8, D=number_slider_9)  # -> out, c; inputs C: Curve, D: Double
# ---------- gh_fillet_2: C# ----------
    // Written by @v-xup6

    // Fillet the sharp corners of a curve by distance
    
    // @TODO: Need to implement distance clamp
    this.Component.AddRuntimeMessage(GH_RuntimeMessageLevel.Warning, "Need to implement distance clamp");

    // Get each segment of the curve and segment count
    Curve[] segments = C.DuplicateSegments();
    int count = segments.Length;

    // If there's no segments, cannot fillet
    if(count == 0) return;

    // Check if there's any non-linear segment
    foreach(Curve seg in segments){
      // If there's a non-linear segment
      // don't fillet this curve at all
      if(!seg.IsLinear()){
        c = C;
        return;
      }
    }

    // Create list to store all fillets
    List<Curve> fillets = new List<Curve>();

    // Iterate thru segment pairs to see if fillet-able
    for(int i = 0;i < count;i++){
      // Get index of second line, if curve is periodic
      // last segment gets paired with first
      int i2 = i + 1;
      if(i2 == count){
        if(C.IsClosed) i2 = 0;
        else break;
      }

      // Get lengths of the pair
      double length = segments[i].GetLength();
      double length2 = segments[i2].GetLength();

      // Need to implement distance clamp
      // if fillet distance is larger than possible
      // reduce fillet distance to fit

      // Clamp fillet distance if too large for segment pair
      double fD = D;
      if(fD > length || fD > 0.5 * length2){
        if(length > 0.5 * length2) fD = 0.5 * length2;
        else fD = length;
      }

      // If fillet-able and there's enought length
      if(length > D && length2 > D){
        // Parameter of start and end of fillet
        double t0, t1;

        // Set new length for first segment
        // and find its parameter, point and tangent at the end
        length = length - D;
        segments[i].LengthParameter(length, out t0);
        Point3d start = segments[i].PointAt(t0);
        Vector3d tangent = segments[i].TangentAt(t0);
        // Shorten 1st segment to fit the fillet
        segments[i] = segments[i].Split(t0)[0];

        // Find parameter and point at new start of 2nd segment
        segments[i2].LengthParameter(D, out t1);
        Point3d end = segments[i2].PointAt(t1);
        // Shorten 2nd segment to fit the fillet
        segments[i2] = segments[i2].Split(t1)[1];

        // Create the fillet arc and store it as a curve
        Arc fillet = new Arc(start, tangent, end);
        fillets.Add(fillet.ToNurbsCurve());
      }
    }

    // Store segments together with fillets so they can be joined
    fillets.AddRange(segments);
    Curve[] crv = Curve.JoinCurves(fillets);

    // Output
    c = crv[0];
# ---------- end gh_fillet_2 ----------
fillet_2 = FilletDistance(Curve=crv_8, Distance=number_slider_9)
panel_15 = Panel(fillet_2)
panel_16 = Panel(gh_fillet_2.c)

# ---- group: Flip Curve
crv_9 = Curve(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)
crv_10 = Curve(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)
gh_flip = GHFlipCurve(C=crv_9, G=crv_10)  # -> out, c, F; inputs C: Curve, G: Curve
# ---------- gh_flip: C# ----------
    // Written by @v=xup6
    
    // Flip a curve using an optional guide curve
    
    // Check vector angle between curve and guide curve
    // wrap in try catch in case there's no guide curve
    double angle = 0;
    try{
      Vector3d crvVec = C.PointAtEnd - C.PointAtStart;
      Vector3d guideVec = G.PointAtEnd - G.PointAtStart;
      angle = Vector3d.VectorAngle(crvVec, guideVec);
    }
    catch{
    }

    // If angle is bigger than 90 deg OR
    // if there's no guide curve, flip the curve
    if(angle >= 0.5 * Math.PI || G == null){
      C.Reverse();
      c = C;
      F = true;
      return;
    }
    else{
      // If direction of curve are the same, no need to flip
      c = C;
      F = false;
      return;
    }
# ---------- end gh_flip ----------
flip = FlipCurve(Curve=crv_9, Guide=crv_10)  # -> Curve, Flag
panel_17 = Panel([flip.Curve, flip.Flag])
panel_18 = Panel([gh_flip.c, gh_flip.F])

# ----
offset_l = OffsetCurveLoose(Distance=1)
smoothpline = SmoothPolyline(Strength=1, Times=1)

# ---- group: Fillet
list = ValueList({"Closed": 0, "Open": 1}, selected="Closed")
t = Slider(0, range=0..1)
number_slider_10 = Slider(10, range=0..10)
domain = Domain(Domain(536.6191752, 823.7800279))
domain_2 = Domain(Domain(546.8909817, 809.9442152))
crv_11 = Curve(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)
crv_12 = Curve(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)
filter = StreamFilter(Gate=list, Stream0=domain, Stream1=domain_2)
filter_2 = StreamFilter(Gate=list, Stream0=crv_11, Stream1=crv_12)
remap = RemapNumbers(Value=t, Source=Domain(0, 1), Target=filter)  # -> Mapped, Clipped
crv_13 = Curve(filter_2)
gh_fillet_3 = GHFillet(C=crv_13, t=remap.Mapped, R=number_slider_10)  # -> out, c, tFil; inputs C: Curve, t: Double, R: Double
# ---------- gh_fillet_3: C# usings ----------
using System.Linq;
# ---------- gh_fillet_3: C# ----------
    // Written by @v-xup6

    // Fillet the sharp corners of a curve at a paramaeter

    // Variables to store where the closest fillet-able
    // corner parameter is, and how "far" it is from
    // user defined paramter
    double distance = double.MaxValue;
    double param = 0;

    // Find start and end parameter
    double t0 = C.Domain.Min;
    double t1 = C.Domain.Max;

    // If curve is closed, we have to consider the
    // fillet between the first and last curve segments
    if(C.IsClosed){
      // Find "distance" from user param to start/end param
      double toStart = Math.Abs(t0 - t);
      double toEnd = Math.Abs(t1 - t);
      // Use the one with a smaller "distance"
      // as start for comparisons
      if(toStart < toEnd){
        distance = toStart;
        param = t0;
      }
      else{
        distance = toEnd;
        param = t1;
      }
    }

    // Find all fillet-able corner parameters
    while(true){
      // Find first corner between t0 and end of curve
      // t0 is the start of curve on first iteration
      // output param of found corner to t0 for next iteration
      bool run = C.GetNextDiscontinuity(Continuity.G1_continuous, t0, t1, out t0);

      // If no fillet-able corner is found, exit while loop
      if(!run) break;

      // Find "distance" from this corner to user param
      double d = Math.Abs(t - t0);
      // If closer then previously found closest value
      // record this "distance" and the parameter
      if(d < distance){
        param = t0;
        distance = d;
      }
    }

    // Create fillet arc at closest corner
    Arc fillet = Curve.CreateFillet(C, C, R, param, param);

    // Find start and end param of fillet on original curve
    // use these param to isolate the segment that needs to
    // replaced with a fillet
    Point3d start = fillet.StartPoint;
    Point3d end = fillet.EndPoint;
    C.ClosestPoint(start, out t0);
    C.ClosestPoint(end, out t1);
    double[] split = {t0,t1};
    Curve[] segments = C.Split(split);

    // Convert array to list using LINQ for versatility
    List<Curve> curves = segments.ToList();

    // Check which curve segment is the segment to be replaced
    Point3d corner = C.PointAt(param);
    for(int i = 0; i < curves.Count; i++){
      // Find parameter of closest point on segment
      double p;
      curves[i].ClosestPoint(corner, out p);

      // If curve is periodic, treat start and end param as the same
      bool atSeam = false;
      if(C.IsClosed &&
        (p == C.Domain.Min || p == C.Domain.Max) &&
      (param == C.Domain.Min || param == C.Domain.Max)){
        atSeam = true;
      }

      // If this segment includes the parameter of the fillet
      if(p == param || atSeam){
        // Remove this segment
        // and add the fillet arc as replacement
        curves.RemoveAt(i);
        curves.Add(fillet.ToNurbsCurve());

        // Segment found, end check
        break;
      }
    }

    // Join curve segments into a single curve
    Curve[] curve = Curve.JoinCurves(curves);

    // Output
    c = curve;
    tFil = param;
# ---------- end gh_fillet_3 ----------
fillet_3 = Fillet(Curve=crv_13, Parameter=remap.Mapped, Radius=number_slider_10)  # -> Curve, Parameter
panel_19 = Panel(fillet_3.Curve)
panel_20 = Panel(gh_fillet_3.c)
panel_21 = Panel(fillet_3.Parameter)
panel_22 = Panel(gh_fillet_3.tFil)

# ---- group: Offset Curve
crv_14 = Curve([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])
number_slider_11 = Slider(10, range=0..10)
xy = XYPlane(Origin=Point(0, 0, 0))
pln = Plane(Plane(origin=(6, 5, 0), x=(0.5368754922, -0.8436614877, 0), y=(0.6305604577, 0.4012657458, -0.6643638388)))
number_slider_12 = Slider(4, range=0..4)
gh_offset = CSharpScript(C=crv_14, D=number_slider_11, P=xy, C2=number_slider_12)  # -> out, COut; inputs C: Curve, D: Double, P: Plane, C2: Int32
# ---------- gh_offset: C# ----------
    // Written by @v-xup6 & @garciadelcastillo

    // This component offsets a curve along a plane with a specified distance

    // Compute the offset (might not be a single continuous curve)
    Curve[] offsets = C.Offset(P, D, 0.0001, (CurveOffsetCornerStyle) C2);

    // Try to join the result
    Curve[] joint = Curve.JoinCurves(offsets);

    // Figure out which one to output
    Curve[] result = joint == null ? offsets : joint;

    // Outputs
    COut = result;
# ---------- end gh_offset ----------
offset = OffsetCurve(Curve=crv_14, Distance=number_slider_11, Plane=xy, Corners=number_slider_12)
panel_23 = Panel(gh_offset.COut)
panel_24 = Panel(offset)

# ---- group: Offset on Srf
crv_15 = Curve(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)
number_slider_13 = Slider(-0.8, range=-10..10)
crv_16 = Curve(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)
srf = Surface(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)
gh_offsets = CSharpScript(C=crv_16, D=number_slider_13, S=srf)  # -> out, COut; inputs C: Curve, D: Double, S: Surface
# ---------- gh_offsets: C# ----------
    // Written by @garciadelcastillo

    // This component offsets a curve along a surface with a specified distance

    // Compute the offset (might not be a single continuous curve)
    Curve[] offsets = C.OffsetOnSurface(S, D, this.RhinoDocument.ModelAbsoluteTolerance);

    // Try to join the result
    Curve[] joint = Curve.JoinCurves(offsets);

    // Figure out which one to output
    Curve[] result = joint == null ? offsets : joint;

    // Outputs
    COut = result;
# ---------- end gh_offsets ----------
offsets = OffsetOnSrf(Curve=crv_16, Distance=number_slider_13, Surface=srf)
panel_25 = Panel(gh_offsets.COut)
panel_26 = Panel(offsets)

# ---- group: Pull
crv_17 = Curve(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)
crv_18 = Curve(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)
srf_2 = Surface(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)
srf_3 = Surface(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)
gh_pull = CSharpScript(C=crv_17, S=srf_2)  # -> out, COut; inputs C: Curve, S: Brep
# ---------- gh_pull: C# ----------
    // Written by @garciadelcastillo

    // This component "pulls" a curve to a surface

    // Pull curve to the surface
    Curve[] pulled = Curve.PullToBrepFace(C, S.Faces[0], this.RhinoDocument.ModelAbsoluteTolerance);

    // Try to join curves
    Curve[] joint = Curve.JoinCurves(pulled);

    // Outputs
    COut = joint[0];  // return only the first one of the joint curves
# ---------- end gh_pull ----------
pull = PullCurve(Curve=crv_17, Surface=srf_2)
panel_27 = Panel(pull)
panel_28 = Panel(gh_pull.COut)

# ---- group: Fir Curve
number_slider_14 = Slider(5, range=0..7)
number_slider_15 = Slider(5, range=0..10)
crv_19 = Curve(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)
gh_fit = CSharpScript(C=crv_19, D=number_slider_14, Ft=number_slider_15)  # -> out, COut; inputs C: Curve, D: Int32, Ft: Double
# ---------- gh_fit: C# ----------
    // Written by @garciadelcastillo

    // This component fits a new curve over the input one.

    // Safe defaults
    int degree = D;
    if (degree == 0)
    {
      degree = C.Degree;
    }
    
    double tolerance = Ft;
    if (tolerance == 0.0)
    {
      tolerance = this.RhinoDocument.ModelAbsoluteTolerance;
    }

    // Fit the curve
    Curve fit = C.Fit(D, Ft, -1);

    // Outputs
    COut = fit;
# ---------- end gh_fit ----------
fit = FitCurve(Curve=crv_19, Degree=number_slider_14, Tolerance=number_slider_15)
panel_29 = Panel(fit)
panel_30 = Panel(gh_fit.COut)

# ---- group: REbuild Curve
number_slider_16 = Slider(5, range=0..7)
number_slider_17 = Slider(9, range=0..25)
toggle = BooleanToggle(True)
crv_20 = Curve(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)
gh_reb = CSharpScript(C=crv_20, D=number_slider_16, N=number_slider_17, T=toggle)  # -> out, COut; inputs C: Curve, D: Int32, N: Int32, T: Boolean
# ---------- gh_reb: C# ----------
    // Written by @garciadelcastillo

    // This component changes the amount of control points of a curve.

    // Safe defaults
    int degree = D;
    if (degree == 0)
    {
      degree = C.Degree;
    }
    
    // Rebuild the curve
    NurbsCurve newCurve = C.Rebuild(N, D, T);


    // Outputs
    COut = newCurve;
# ---------- end gh_reb ----------
reb = RebuildCurve(Curve=crv_20, Degree=number_slider_16, Count=number_slider_17, Tangents=toggle)
panel_31 = Panel(gh_reb.COut)
panel_32 = Panel(reb)

# ---- group: Simplify Curve
crv_21 = Curve(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)
crv_22 = Curve(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)
number_slider_18 = Slider(0.06, range=0..10)
number_slider_19 = Slider(0.96, range=0..1)
gh_reb_2 = CSharpScript(C=crv_21, t=number_slider_18, a=number_slider_19)  # -> out, COut, S; inputs C: Curve, t: Double, a: Double
# ---------- gh_reb_2: C# ----------
    // Written by @garciadelcastillo

    // This component simplifies a curve by doing things such as 
    // collapsing consecutive straight segments, aligning tangents,
    // reducing knots, etc. 
    // Check the Curve.Simplify method for a complete list.
    Curve simpleCurve = C.Simplify(CurveSimplifyOptions.All, t, a);

    // Outputs
    if (simpleCurve == null)
    {
      COut = C;
      S = false;
    }
    else
    {
      COut = simpleCurve;
      S = true;
    }
# ---------- end gh_reb_2 ----------
simplify = SimplifyCurve(Curve=crv_21, Tolerance=number_slider_18, AngleTolerance=number_slider_19)  # -> Curve, Simplified
panel_33 = Panel([simplify.Curve, simplify.Simplified])
panel_34 = Panel([gh_reb_2.COut, gh_reb_2.S])

# ---- group: Extend Curve
crv_23 = Curve([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])
list_2 = ValueList({"Line": 0, "Arc": 1, "Smooth": 2}, selected="Smooth")
number_slider_20 = Slider(-20, range=-20..20)
number_slider_21 = Slider(20, range=-20..20)
gh_ext = GHExtendCurve(C=crv_23, T=list_2, L0=number_slider_20, L1=number_slider_21)  # -> out, c; inputs C: Curve, T: Int32, L0: Double, L1: Double
# ---------- gh_ext: C# usings ----------
using Rhino.Runtime;
# ---------- gh_ext: C# ----------
    // Written by @v-xup6

    // Extend a curve by a specified distance

    Curve crv = C;
    if(L0 > 0 && !C.IsClosed){ // If extention value at start >0, extend curve
      crv = C.Extend(CurveEnd.Start, L0, (CurveExtensionStyle) T);
    }
    else if(L0 < 0){ // If extention value at start <0, shorten curve
      double t0;
      // Find parameter of new start point
      crv.LengthParameter(-L0, out t0);
      // Split curve at start point, retrieve the curve after the point
      crv = crv.Split(t0)[1];
    }
    if(L1 > 0 && !C.IsClosed){ // If extention value at end >0, extend curve
      crv = crv.Extend(CurveEnd.End, L1, (CurveExtensionStyle) T);
    }
    else if(L1 < 0){ // If extention value at end <0, shorten curve
      double t1;
      double l = crv.GetLength();
      // Find parameter of new end point
      crv.LengthParameter(l + L1, out t1);
      // Split curve at end point, retrieve the curve before the point
      crv = crv.Split(t1)[0];
    }

    // Output
    c = crv;
# ---------- end gh_ext ----------
ext = ExtendCurve(Curve=crv_23, Type=list_2, Start=number_slider_20, End=number_slider_21)
panel_35 = Panel(ext)
panel_36 = Panel(gh_ext.c)

# ---- group: Join Curves
crv_24 = Curve([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])
toggle_2 = BooleanToggle(False)
gh_join = GHJoinCurves(C=crv_24, P=toggle_2)  # -> out, c; inputs C: list of Curve, P: Boolean
# ---------- gh_join: C# ----------
    // Written by @v-xup6

    // Join as many curves as possible
    
    double tol = Rhino.RhinoDoc.ActiveDoc.ModelAbsoluteTolerance;
    c = Curve.JoinCurves(C, tol, P);
# ---------- end gh_join ----------
join = JoinCurves(Curves=crv_24, Preserve=toggle_2)
panel_37 = Panel(join)
panel_38 = Panel(gh_join.c)

# ---- group: Explode
toggle_3 = BooleanToggle(True)
# GH#: A C# dictionary of Grasshopper3D components.
# 
# This file contains a category of Grasshopper components, and a mirroring C#/RhinoCommon implementation.
# 
# This is an educational project initiated by students/faculty of GSD-6338: Introduction to Computational Design, at the Harvard Graduate School of Design.
# 
# More information: {{project link}}
# Curve Util
crv_25 = Curve([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])
gh_explode = GHExplode(C=crv_25, R=toggle_3)  # -> out, S, V; inputs C: Curve, R: Boolean
# ---------- gh_explode: C# ----------
    // Written by @v-xup6

    // Explode a curve into smaller segments

    // Explode to segments
    Curve[] segments = C.DuplicateSegments();

    // Convert to list for versatility
    List<Curve> seg = new List<Curve>();
    seg.AddRange(segments);

    // If no need to break down to atomic segments join lines
    if(!R){
      // List to store lines
      List<Curve> lines = new List<Curve>();

      // Variable to store if previous curve is a line
      // and how many lines are in the lines list
      int prevDeg = -1;
      int count = 0;

      // Loop thru in reverse order to avoid skips when item removed
      for(int i = segments.Length - 1;i >= 0;i--){
        // Check degree of current segment, 1 = line
        int deg = segments[i].Degree;

        // If current segment is a line
        if(deg == 1){
          // Add segment to lines list and update preDev
          lines.Add(segments[i]);
          prevDeg = deg;

          // If not last segment continue to next segment
          if(i != 0){
            count++;
            continue;
          }
        }

        // If at last segment OR
        // this segment is not a line and prev segment is a line
        if(prevDeg == 1){
          // Logic limits of removal and insertion
          // Remove count limit up to current segment (exclusive)
          int limit = 0;
          // Insert location default to after current segment
          int inIndex = i + 1;
          if(i == 0 && deg == 1){
            // If at last segment and it is a line, remove it too
            // insert location become current segment
            limit = -1;
            inIndex = i;
          }
          // Actually remove the lines
          for(int j = count; j > limit; j--){
            seg.RemoveAt(i + j);
          }
          // Join previously found lines and insert polyline to list
          Curve[] polyline = Curve.JoinCurves(lines);
          seg.Insert(inIndex, polyline[0]);
          // Reset count and list
          count = 0;
          lines = new List<Curve>();
        }

        // If current segment is not line, and previous also not line
        // OR current segment is not line, but previous is a line
        // OR last last segment, last iteration ergo doesn't matter

        // Update varible with degree from current segment
        prevDeg = deg;

        // Continue to next segment
      }
    }

    // Find verticies
    Point3d[] pt = new Point3d[seg.Count + 1];
    // Record start point for each segment
    for(int i = 0; i < seg.Count; i++){
      pt[i] = seg[i].PointAtStart;
    }
    // Add end point of curve
    pt[seg.Count] = C.PointAtEnd;

    // Output
    S = seg;
    V = pt;
# ---------- end gh_explode ----------
panel_39 = Panel(gh_explode.S)
panel_40 = Panel(gh_explode.V)

# ----
explode = Explode(Curve=crv_25, Recursive=toggle_3)  # -> Segments, Vertices

# ---- group: Explode (continued)
panel_41 = Panel(explode.Segments)
panel_42 = Panel(explode.Vertices)
