# Grasshopper definition Surface_Analysis.ghx (Grasshopper 1.0.7)

# ---- group: error testing
pt = Point(Point(-0.614617653, 1.396960664, 0))
crv = Curve(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)
crv_2 = Curve(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)

# ---- group: test points
pt_2 = Point(Point(-0.4506977088, -1.374628012, 3.911992067))
pt_3 = Point(Point(2.216256994, 2.247253595, 2.777777632))
pt_4 = Point(Point(0, 0, 3.911992067))

# ---- group: error testing
pt_5 = Point(Point(-0.614617653, 1.396960664, 0))
geo = Geometry(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)

# ---- group: Working Progress
c_triminc = CSharpScript()  # -> Out, I

# ---- group: Working Progress / Grasshopper TrimInc
triminc = PointInTrim()

# ---- group: error testing
pt_6 = Point(Point(-0.614617653, 1.396960664, 0))
crv_3 = Curve(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)
crv_4 = Curve(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)

pt_7 = Point(Point(-0.614617653, 1.396960664, 0))
geo_2 = Geometry(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)

# ---- group: outside Pt
pt_8 = Point(Point(0.2066013269, 5.463709837, 1.934946635))

# ---- group: inside Pt
pt_9 = Point(Point(8.739623683, 4.154964077, 1.934946635))

# ---- group: Working Progress
c_planar = CSharpScript()  # -> Out, F, P, A

# ---- group: Working Progress / Grasshopper Planar
planar = IsPlanar(Interior=True)  # -> Planar, Plane

# ---- group: Working Procress
c_shapein = CSharpScript()  # -> Out, R

# ---- group: Working Procress / Grasshopper ShapeIn
shapein = ShapeInBrep()

# ----
# GH#: A C# dictionary of Grasshopper3D components.
# 
# This file contains a category of Grasshopper components, and a mirroring C#/RhinoCommon implementation.
# 
# This is an educational project initiated by students/faculty of GSD-6338: Introduction to Computational Design, at the Harvard Graduate School of Design.
# 
# More information: {{project link}}
# Surface Analysis
geo_3 = Geometry(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)
c_box_corners = CSharpScript(box=geo_3)  # -> out, A, B, C, D, E, F, G, H; inputs box: Box
# ---------- c_box_corners: C# ----------
    // Component created by @mirahx24

    // Rhinocommon's method of getting box's corners: box.GetCorners()
    Point3d[] corners = box.GetCorners();

    // Output
    A = corners[0];
    B = corners[1];
    C = corners[2];
    D = corners[3];
    E = corners[4];
    F = corners[5];
    G = corners[6];
    H = corners[7];
# ---------- end c_box_corners ----------
panel = Panel(c_box_corners.A)
panel_2 = Panel(c_box_corners.B)
panel_3 = Panel(c_box_corners.C)
panel_4 = Panel(c_box_corners.D)
panel_5 = Panel(c_box_corners.E)
panel_6 = Panel(c_box_corners.F)
panel_7 = Panel(c_box_corners.G)
panel_8 = Panel(c_box_corners.H)

# ---- group: Grasshopper Box Corners
box_corners = BoxCorners(Box=geo_3)  # -> CornerA, CornerB, CornerC, CornerD, CornerE, CornerF, CornerG, CornerH

# ----
panel_9 = Panel(box_corners.CornerA)
panel_10 = Panel(box_corners.CornerB)
panel_11 = Panel(box_corners.CornerC)
panel_12 = Panel(box_corners.CornerD)
panel_13 = Panel(box_corners.CornerE)
panel_14 = Panel(box_corners.CornerF)
panel_15 = Panel(box_corners.CornerG)
panel_16 = Panel(box_corners.CornerH)

geo_4 = Geometry(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)
c_debox = CSharpScript(B=geo_4)  # -> out, P, X, Y, Z; inputs B: Box
# ---------- c_debox: C# ----------
    // This component is created by @mirahx24

    // Output
    P = B.Plane; // box's plane
    X = B.X; // box's domain on X direction
    Y = B.Y; // box's domain on Y direction
    Z = B.Z; // box's domain on Z direction
# ---------- end c_debox ----------
panel_17 = Panel(c_debox.P)
panel_18 = Panel(c_debox.X)
panel_19 = Panel(c_debox.Y)
panel_20 = Panel(c_debox.Z)

# ---- group: Grasshopper DeBox
debox = DeconstructBox(Box=geo_4)  # -> Plane, X, Y, Z

# ----
panel_21 = Panel(debox.Y)
panel_22 = Panel(debox.Plane)
panel_23 = Panel(debox.X)
panel_24 = Panel(debox.Z)

geo_5 = Geometry(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)
number_slider = Slider(1, range=-1..1)
c_wires = CSharpScript(B=geo_5, D=number_slider)  # -> out, W; inputs B: Brep, D: Int32
# ---------- c_wires: C# ----------
    // This component is created by @mirahx24

    // Safety Check! Only run the script if Brep is not empty
    if(B != null) {
      // B.GetWireframe(int density) method will get all the "Wires" of Brep B
      W = B.GetWireframe(D);
    }
# ---------- end c_wires ----------
geo_6 = Geometry(c_wires.W)
panel_25 = Panel(c_wires.W)

# ---- group: Grasshopper Wires
wires = BrepWireframe(Brep=geo_5, Density=number_slider)

# ----
geo_7 = Geometry(wires)
panel_26 = Panel(wires)

srf = Surface(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)
c_dim = CSharpScript(S=srf)  # -> out, U, V; inputs S: Surface
# ---------- c_dim: C# ----------
    // This component is created by @mirahx24

    // A surface has two main domains
    // Domain(0) is at u-direction
    // Domain(1) is at v-direction
    // The grasshopper component returns the dimension at u and v directions
    
    // Output
    U = S.Domain(0).Length;
    V = S.Domain(1).Length;
# ---------- end c_dim ----------
panel_27 = Panel(c_dim.U)
panel_28 = Panel(c_dim.V)

# ---- group: Grasshopper Dim
dim = Dimensions(Surface=srf)  # -> UDimension, VDimension

# ----
panel_29 = Panel(dim.UDimension)
panel_30 = Panel(dim.VDimension)

srf_2 = Surface(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)

# ---- group: Grasshopper Area
area = Area(Geometry=srf_2)  # -> Area, Centroid

# ---- group: C# Area
c_script = CSharpScript(G=srf_2)  # -> out, A, C; inputs G: GeometryBase
# ---------- c_script: C# ----------
    //Component written by @mirahx24

    // This component should be able to read in closed planar Curve, Brep, and Mesh
    // Because of this requirement, the input G need to be set as class GeometryBase object
    // And need to implement try-catch statements
    // Try-catch statement enable the script to run potentially fail-able code in a saft environment
    // If code inside the Try block failed, the compiler will start to execute code inside the Catch statement and then the rest of the script
    // For more information on try-catch statements, read https://docs.microsoft.com/en-us/dotnet/csharp/language-reference/keywords/try-catch

    // Rhinocommon has an AreaMassProperties class that is able to take in many different geometries
    // And able to return the associated area property of that geometry
    // For more information on AreaMassProperties, read https://developer.rhino3d.com/api/RhinoCommon/html/T_Rhino_Geometry_AreaMassProperties.htm

    // First initialize a null object of AreaMassProperties
    AreaMassProperties amp = null;

    // Boolean variable to check if the type of input geometry is already found
    bool computed = false;

    // Try to convert input G to a curve
    try{
      // If G is a curve, then the conversion will be successful and the rest of the code inside try block will execute.
      // Otherwise, it will go to the Catch statement without running the rest of the codes inside the try block
      Curve c = (Curve) G;

      // If G is a curve, then check curve is closed
      if (!c.IsClosed) {
        // If it is not closed, add runtime error message
        Component.AddRuntimeMessage(GH_RuntimeMessageLevel.Error, "Curve must be closed for Area calculation");
        return;
      }

      // Check if curve is planar
      if(!c.IsPlanar()) {
        // If it is not planar, add runtime error message
        Component.AddRuntimeMessage(GH_RuntimeMessageLevel.Error, "Curve must be planar for Area calculation");
        return;
      }

      // Compute values of the amp object
      amp = AreaMassProperties.Compute(c);
      computed = true; // Confirmed amp has been comupted, which mean type conversion succeed
    }
    catch{}

    // If boolean varaible "computed" is false, amp hasn't been computed
    // Which means the previous conversion failed
    if(!computed) {
      // Try converting G to a Brep
      try{
        // If G is a Brep, then the conversion will be successful and the rest of the code inside try block will execute.
        // Otherwise, it will go to the Catch statement without running the rest of the codes inside the try block
        Brep b = (Brep) G;

        amp = AreaMassProperties.Compute(b); // compute values of the amp object
        computed = true; // confirmed amp has been comupted, which mean type conversion succeed
      }
      catch{}
    }

    // If boolean varaible "computed" is false, amp hasn't been computed
    // Which means the previous conversion failed
    if(!computed) {
      // Try converting G to a Mesh
      try{
        // If G is a Mesh, then the conversion will be successful and the rest of the code inside try block will execute.
        // Otherwise, it will go to the Catch statement without running the rest of the codes inside the try block
        Mesh m = (Mesh) G;

        amp = AreaMassProperties.Compute(m); // Compute values of the amp object
        computed = true; // Confirmed amp has been comupted, which mean type conversion succeed
      }
      catch{}
    }

    // Check if we were able to compute amp of a closed planar curve, brep, or mesh
    // If computation is successful, find the area and centroid of geometry
    if(amp != null) {
      //Find Area
      A = Math.Round(amp.Area, 6);

      //Find Centroid
      C = amp.Centroid;
    }

      // Otherwise, add runtime error
    else{
      Component.AddRuntimeMessage(GH_RuntimeMessageLevel.Error, "Area properties could not be solved.");
    }
# ---------- end c_script ----------

# ----
panel_31 = Panel(area.Area)
panel_32 = Panel(area.Centroid)
panel_33 = Panel(c_script.out)
panel_34 = Panel(c_script.C)

panel_35 = Panel(c_script.A)

geo_8 = Geometry(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)
c_edges = CSharpScript(B=geo_8)  # -> out, En, Ei, Em; inputs B: Brep
# ---------- c_edges: C# ----------
    // This component is created by @mirahx24


    // Safety check! only run this component when there is infomation passed into it
    if(B != null){
      // First create lists to store the geometry data
      // The edges of brep will be of BrepEdge class, so here we declare lists of BrepEdge
      List<BrepEdge> nakedEdges = new List<BrepEdge>(); // list for naked edges
      List<BrepEdge> interiorEdges = new List<BrepEdge>(); // list for interior edges
      List<BrepEdge> nonManifoldEdges = new List<BrepEdge>(); //list for nonManifold edges

      // Brep.Edges returns a list of edges, and is of class BrepEdge
      // We use Valence property of this class to check edges connectivity
      // Valence is an enumerator of edge adjcency
      // It checks how many faces is an edge connected to
      // If an edge is connected to only one face, then the edge is a naked edge
      // If an edge is connected to two faces, then it is a interior edge
      // if an edge is connected to three or more faces, then it is a nonmanifold edge

      // We first iterate through the entire edge list of Brep B
      for(int i = 0; i < B.Edges.Count;i++){
        EdgeAdjacency v = B.Edges[i].Valence; // get the valence for each edge

        // if the valence returns as Naked, then add the current edge to nakedEdges list
        if (v == EdgeAdjacency.Naked){
          nakedEdges.Add(B.Edges[i]);
        }

          // if the valence returns as Interior, then add the current edge to interiorEdges list
        else if (v == EdgeAdjacency.Interior){
          interiorEdges.Add(B.Edges[i]);
        }

          // if the valence returns as NonManifold, then add the current edge to nonManifoldEdges list
        else if (v == EdgeAdjacency.NonManifold) {
          nonManifoldEdges.Add(B.Edges[i]);
        }
      }

      // Output
      En = nakedEdges;
      Ei = interiorEdges;
      Em = nonManifoldEdges;
    }
# ---------- end c_edges ----------
geo_9 = Geometry(c_edges.Ei)
geo_10 = Geometry(c_edges.En)
panel_36 = Panel(c_edges.En)
panel_37 = Panel(c_edges.Ei)
panel_38 = Panel(c_edges.Em)

# ---- group: Grasshopper Edges
edges = BrepEdges(Brep=geo_8)  # -> Naked, Interior, NonManifold

# ----
geo_11 = Geometry(edges.Interior)
panel_39 = Panel(edges.Naked)
panel_40 = Panel(edges.Interior)
panel_41 = Panel(edges.NonManifold)

geo_12 = Geometry(edges.Naked)

srf_3 = Surface(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)
c_srfpt = CSharpScript(S=srf_3)  # -> out, P, W, G, U, V; inputs S: Surface
# ---------- c_srfpt: C# usings ----------
using Rhino.Geometry.Collections;
# ---------- c_srfpt: C# ----------
    // This component is created by @mirahx24

    // NurbsSurface is easier to to access certain information
    // So first we convert Surface to NurbsSurface
    NurbsSurface nurbsSurf = S.ToNurbsSurface();

    // Then get all the control points of surface by envoking the NurbsSurface.Points property
    // But since it is of class NurbsSurfacePointList, it is better to convert them to class Point3d
    // For better understanding of their positions
    NurbsSurfacePointList controlPoints = nurbsSurf.Points;

    // Create empty lists for data storage later
    List<Point3d> points = new List<Point3d>();
    List<Point2d> grevillePoints = new List<Point2d>();
    List<double> weights = new List<double>();
    int uCount = controlPoints.CountU; // number of points in u direction
    int vCount = controlPoints.CountV; // number of points in v direction

    // Iterate through u direction
    for(int u = 0; u < uCount; u++) {
      // Iterate through v direction
      for(int v = 0; v < vCount;v++){
        Point3d pt; // Creating un-initialized Point3d

        // Invoke method to get the control points coordinate
        // This method returns bool if the operation is successful
        // and output the control point coordinate to pt variable
        if(!controlPoints.GetPoint(u, v, out pt)){
          // if method is not successful, add error message and stop script from executing
          Component.AddRuntimeMessage(GH_RuntimeMessageLevel.Error, "Cannot get control points.");
          return;
        }
        
        Point2d grePt = controlPoints.GetGrevillePoint(u, v); // invoke method to get the greville points of uv coordinate
        double w = controlPoints.GetWeight(u, v); // invoke method to get weight of each points
        points.Add(pt); 
        grevillePoints.Add(grePt); 
        weights.Add(w);
      }
    }

    // Output
    P = points;
    W = weights;
    G = grevillePoints;
    U = uCount;
    V = vCount;
# ---------- end c_srfpt ----------
control_points = Panel(c_srfpt.P)
control_points_weights = Panel(c_srfpt.W)
greville_uv_pts = Panel(c_srfpt.G)
u_count = Panel(c_srfpt.U)
v_count = Panel(c_srfpt.V)

# ---- group: Grasshopper SrfPt
srfpt = SurfacePoints(Surface=srf_3)  # -> Points, Weights, Greville, UCount, VCount

# ----
control_points_2 = Panel(srfpt.Points)
control_points_weights_2 = Panel(srfpt.Weights)
u_count_2 = Panel(srfpt.UCount)
greville_uv_pts_2 = Panel(srfpt.Greville)
v_count_2 = Panel(srfpt.VCount)

pt_10 = ConstructPoint(XCoordinate="0", YCoordinate=Slider(10.58, range=0..19.49), ZCoordinate="0")
srf_4 = Surface(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)
pt_11 = Point(pt_10)

# ---- group: C# Cruvature
c_curvature = CSharpScript(S=srf_4, uv=pt_11)  # -> out, F, C1, C2, K1, K2; inputs S: Surface, uv: Point3d
# ---------- c_curvature: C# ----------
    // Component created by @mirahx24

    double u = uv.X;
    double v = uv.Y;
    
    // Initiate empty variables
    double minCurvature;
    double maxCurvature;
    Vector3d minDir;
    Vector3d maxDir;
    
    // Get plane at uv coordinate
    Plane frame = new Plane();
    if(S.FrameAt(u, v, out frame)) {
      SurfaceCurvature curv = S.CurvatureAt(u, v); // get surface curvature at uv coordinate
      
      // SurfaceCurvature stores the following properties
      minCurvature = curv.Kappa(0); 
      maxCurvature = curv.Kappa(1);
      minDir = curv.Direction(0);
      maxDir = curv.Direction(1);
    }
    else {
      Component.AddRuntimeMessage(GH_RuntimeMessageLevel.Error, "Cannot compute Frame at given uv point");
      return;
    }

    // Output
    F = frame;
    C1 = minCurvature;
    C2 = maxCurvature;
    K1 = minDir;
    K2 = maxDir;
# ---------- end c_curvature ----------

# ---- group: Grasshopper Curvature
curvature = PrincipalCurvature(Surface=srf_4, Point=pt_11)  # -> Frame, Min, Max, MinDirection, MaxDirection

# ----
panel_42 = Panel(curvature.Frame)
panel_43 = Panel(curvature.Min)
panel_44 = Panel(curvature.Max)
panel_45 = Panel(curvature.MinDirection)
panel_46 = Panel(curvature.MaxDirection)
panel_47 = Panel(c_curvature.C2)
panel_48 = Panel(c_curvature.F)
panel_49 = Panel(c_curvature.C1)
panel_50 = Panel(c_curvature.K1)
panel_51 = Panel(c_curvature.K2)

pt_12 = Point(Point(2.216256994, 2.247253595, 2.777777632))
geo_13 = Geometry(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)
c_brep_cp = CSharpScript(Pt=pt_12, B=geo_13)  # -> out, P, N, C; inputs Pt: Point3d, B: Brep
# ---------- c_brep_cp: C# ----------
    // Component created by @mirahx24

    Point3d closestPt = B.ClosestPoint(Pt); // invoke method to find the closest point of Pt in B
    Vector3d normal = closestPt - Pt; // direction from closestPt to Pt
    normal.Unitize(); // unitize vector

    // Output
    P = closestPt;
    N = normal;
    C = Pt.DistanceTo(closestPt);
# ---------- end c_brep_cp ----------
pt_13 = Point(c_brep_cp.P)
panel_52 = Panel(c_brep_cp.C)
panel_53 = Panel(c_brep_cp.P)
panel_54 = Panel(c_brep_cp.N)

# ---- group: Grasshopper Brep CP
brep_cp = BrepClosestPoint(Point=pt_12, Brep=geo_13)  # -> Point, Normal, Distance

# ----
pt_14 = Point(brep_cp.Point)
panel_55 = Panel(brep_cp.Point)
panel_56 = Panel(brep_cp.Normal)
panel_57 = Panel(brep_cp.Distance)

toggle = BooleanToggle(False)
geo_14 = Geometry(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)
c_brepinc = CSharpScript(B=geo_14, P=pt_2, S=toggle)  # -> out, I; inputs B: Brep, P: Point3d, S: Boolean
# ---------- c_brepinc: C# ----------
    // Component created by @mirahx24

    // Invoke method to check whether the point is inside brep
    I = B.IsPointInside(P, RhinoMath.SqrtEpsilon, S);
# ---------- end c_brepinc ----------
panel_58 = Panel(c_brepinc.I)

# ---- group: Grasshopper BrepInc
brepinc = PointInBrep(Brep=geo_14, Point=pt_2, Strict=toggle)

# ----
panel_59 = Panel(brepinc)

srf_5 = Surface(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)
pt_15 = Point(Point(4.663708413, 1.889306389, -0.1706610635))
pt_16 = Point(Point(5.196461818, 1.889306389, -0.1706610635))
pt_17 = Point(Point(2.216256994, 2.247253595, 2.777777632))
c_evalsrf = CSharpScript(S=srf_5, uv=pt_16)  # -> out, P, N, U, V, F; inputs S: Surface, uv: Point3d
# ---------- c_evalsrf: C# ----------
    // Component created by @mirahx24

    // Get the u and v values 
    double u = uv.X;
    double v = uv.Y;
    
    Vector3d[] uvDirs; // initiate vector3d that will store uv directions
    Point3d pt = new Point3d(); 
    Plane target_Plane = new Plane();

    // Invoke method to get normal vector at uv points
    Vector3d norm = S.NormalAt(u, v);

    // Invoke method to get the uv point and return the plane
    if(S.FrameAt(u, v, out target_Plane)){
      if(S.Evaluate(u, v, 1, out pt, out uvDirs)){ //get the point and uv directions based on uv coordinate
        uvDirs[0].Unitize(); // unitize u 
        uvDirs[1].Unitize(); // unitize v
      }

      else{
        Component.AddRuntimeMessage(GH_RuntimeMessageLevel.Error, "Cannot find UV direction at {uv} Point");
        return;
      }
    }
    else{
      Component.AddRuntimeMessage(GH_RuntimeMessageLevel.Error, "Cannot find Frame at uv Point");
      return;
    }

    // Output
    P = pt;
    N = norm;
    U = uvDirs[0];
    V = uvDirs[1];
    F = target_Plane;
# ---------- end c_evalsrf ----------
panel_60 = Panel(c_evalsrf.P)
panel_61 = Panel(c_evalsrf.U)
panel_62 = Panel(c_evalsrf.N)
panel_63 = Panel(c_evalsrf.V)
panel_64 = Panel(c_evalsrf.F)

# ---- group: Grasshopper EvalSrf
evalsrf = EvaluateSurface(Surface=srf_5, Point=pt_16)  # -> Point, Normal, UDirection, VDirection, Frame

# ----
panel_65 = Panel(evalsrf.Point)
panel_66 = Panel(evalsrf.UDirection)
panel_67 = Panel(evalsrf.Normal)
panel_68 = Panel(evalsrf.VDirection)
panel_69 = Panel(evalsrf.Frame)

geo_15 = Geometry(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)
c_volume = CSharpScript(G=geo_15)  # -> out, V, C; inputs G: GeometryBase
# ---------- c_volume: C# ----------
    // Component created by @mirahx24

    // This component should be able to read in closed planar Brep and Mesh
    // Because of this requirement, the input G need to be set as class GeometryBase object
    // And need to implement try-catch statements
    // Try-catch statement enable the script to run potentially fail-able code in a saft environment
    // If code inside the Try block failed, the compiler will start to execute code inside the Catch statement and then the rest of the script
    // For more information on try-catch statements, read https://docs.microsoft.com/en-us/dotnet/csharp/language-reference/keywords/try-catch

    // Rhinocommon has an VolumeMassProperties class that is able to take in many different geometries
    // And able to return the associated volume property of that geometry
    // For more information on VolumeMassProperties, read https://developer.rhino3d.com/api/RhinoCommon/html/T_Rhino_Geometry_VolumeMassProperties.htm

    // First initialize a null object of VolumeMassProperties
    VolumeMassProperties vmp = null;

    // Boolean variable to check if the type of input geometry is already found
    bool computed = false;

    // Try to convert input G to a Brep
    try{
      // If G is a Brep, then the conversion will be successful and the rest of the code inside try block will execute.
      // Otherwise, it will go to the Catch statement without running the rest of the codes inside the try block
      Brep b = (Brep) G;

      // Check if Brep is a closed one
      if(!b.IsSolid){
        // If not, then add runtime error
        Component.AddRuntimeMessage(GH_RuntimeMessageLevel.Error, "Volume cannot be computed for an open brep.");
        return;
      }
      
      vmp = VolumeMassProperties.Compute(b); // compute vmp value of Brep
      computed = true; // flag computed as true
    }
    catch{}


    // If boolean varaible "computed" is false, vmp hasn't been computed
    // Which means the previous conversion failed
    if(!computed) {
      // Try to convert input G to a Mesh
      try{
        // If G is a Mesh, then the conversion will be successful and the rest of the code inside try block will execute.
        // Otherwise, it will go to the Catch statement without running the rest of the codes inside the try block
        Mesh m = (Mesh) G;

        vmp = VolumeMassProperties.Compute(m); // compute vmp value of Mesh
        computed = true; // flag computed as true
      }
      catch{}
    }

    // Check if we were able to compute vmp of a closed brep or a mesh
    // If computation is successful, find the volume and centroid of geometry
    if(vmp != null) {
      // Output volume and center of Geometry
      V = Math.Round(vmp.Volume, 6);

      //Find Centroid
      C = vmp.Centroid;
    }

      // Otherwise, add runtime error
    else{
      Component.AddRuntimeMessage(GH_RuntimeMessageLevel.Error, "Volume properties could not be solved.");
    }
# ---------- end c_volume ----------
panel_70 = Panel(c_volume.C)
panel_71 = Panel(c_volume.V)

# ---- group: Grasshopper Volume
volume = Volume(Geometry=geo_15)  # -> Volume, Centroid

# ----
panel_72 = Panel(volume.Centroid)
panel_73 = Panel(volume.Volume)

number_slider_2 = Slider(0.5, range=0..1)
number_slider_3 = Slider(0.6, range=0..1)
number_slider_4 = Slider(0.8, range=0..1)
box = CenterBox(Base=PlaneXY(0, 0, 0), X=1, Y=1, Z=1)
c_box = CSharpScript(B=box, U=number_slider_2, V=number_slider_3, W=number_slider_4)  # -> out, Pl, Pt, I; inputs B: Box, U: Double, V: Double, W: Double
# ---------- c_box: C# ----------
    // Component created by @mirahx24

    // Get the Point in world coorindate that is represented as UVW
    Point3d pt = new Point3d(B.X.Min + B.X.Length * U, B.Y.Min + B.Y.Length * V, B.Z.Min + B.Z.Length * W);

    // Get the box's plane normal
    // Then move that plane to the new point
    Vector3d vt = B.Plane.Normal;
    Plane planeUVW = new Plane(pt, vt);

    // Check if the new point is actually on the plane
    // With U, V, W within the range of 0-1, this should always return true
    bool isInside = B.Contains(pt);

    // Output
    Pl = planeUVW;
    Pt = pt;
    I = isInside;
# ---------- end c_box ----------
panel_74 = Panel(c_box.Pl)
panel_75 = Panel(c_box.Pt)
panel_76 = Panel(c_box.I)

# ---- group: Grasshopper Box
box_2 = EvaluateBox(Box=box, UParameter=number_slider_2, VParameter=number_slider_3, WParameter=number_slider_4)  # -> Plane, Point, Include

# ----
panel_77 = Panel(box_2.Plane)
panel_78 = Panel(box_2.Point)
panel_79 = Panel(box_2.Include)

box_3 = CenterBox(Base=PlaneXY(0, 0, 0), X=Slider(4, range=0..10), Y=Slider(0, range=0..10), Z=Slider(0, range=0..10))
c_boxprop = CSharpScript(B=box_3)  # -> out, C, D, A, V, d; inputs B: Box
# ---------- c_boxprop: C# ----------
    // Component created by @mirahx24

    // First get the array of Box's corners
    Point3d[] corners = B.GetCorners();

    // Then calculate vector from 1st corner to the 7th corner
    Vector3d diagonal = corners[corners.Length - 2] - corners[0];

    // To my understanding of Degeneracy,
    // it returns the number of edges that are 0 length
    int degeneracy = 0;
    if ( B.X.Length == 0) {
      degeneracy++;
    }
    if ( B.Y.Length == 0) {
      degeneracy++;
    }
    if ( B.Z.Length == 0) {
      degeneracy++;
    }

    // Output
    C = B.Center; // box's center
    D = diagonal;
    A = B.Area; // box's total area
    V = B.Volume; // box's volume
    d = degeneracy;
# ---------- end c_boxprop ----------
panel_80 = Panel(c_boxprop.C)
panel_81 = Panel(c_boxprop.D)
panel_82 = Panel(c_boxprop.A)
panel_83 = Panel(c_boxprop.V)
panel_84 = Panel(c_boxprop.d)

# ---- group: Grasshopper BoxProp
boxprop = BoxProperties(Box=box_3)  # -> Center, Diagonal, Area, Volume, Degeneracy

# ----
panel_85 = Panel(boxprop.Center)
panel_86 = Panel(boxprop.Area)
panel_87 = Panel(boxprop.Volume)
panel_88 = Panel(boxprop.Degeneracy)
panel_89 = Panel(boxprop.Diagonal)

toggle_2 = BooleanToggle(True)
geo_16 = Geometry([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])
c_brepsinc = CSharpScript(B=geo_16, P=pt_8, S=toggle_2)  # -> out, I, i; inputs B: list of Brep, P: Point3d, S: Boolean
# ---------- c_brepsinc: C# ----------
    // Component created by @mirahx24

    bool inside = false; // set boolean flag to check whether point inside
    int index = -1; // for later use to store idex

    // Iterate the list of breps 
    for(int j = 0; j < B.Count; j++){
      // check if point is inside current brep
      if(B[j].IsPointInside(P, RhinoMath.SqrtEpsilon, S)) {
        inside = true; // if it is, set flag to true
        index = j; // save the index of current brep
        break; // stop the for-loop from executing
      }
    }

    // Output
    I = inside;
    i = index;
# ---------- end c_brepsinc ----------
panel_90 = Panel(c_brepsinc.I)
panel_91 = Panel(c_brepsinc.i)

# ---- group: Grasshopper BrepsInc
brepsinc = PointInBreps(Brep=geo_16, Point=pt_8, Strict=toggle_2)  # -> Inside, Index

# ----
panel_92 = Panel(brepsinc.Inside)
panel_93 = Panel(brepsinc.Index)

box_4 = CenterBox(Base=PlaneXY(0, 0, 0), X=Slider(7, range=0..10), Y=Slider(3, range=0..10), Z=Slider(3, range=0..10))

brep = Brep(box_4)

# ---- group: Grasshopper Topology
topology = BrepTopology(Brep=brep, PerspectiveOnly=False)  # -> FaceFaceAdjacency, FaceEdgeAdjacency, EdgeFaceAdjacency

# ----
c_topology = CSharpScript(B=brep)  # -> out, FF, FE, EF; inputs B: tree of Brep
# ---------- c_topology: C# ----------
    // This component is created by @mirahx24

    // In order to access Brep Topology, we need to use a new type of data storage class: DataTree
    // DataTree contains information about each node and its connected "branches"
    // For more information about DataTree, visit
    // https://developer.rhino3d.com/api/grasshopper/html/T_Grasshopper_DataTree_1.htm
    
    // Create DataTrees to storage Brep Data
    DataTree<int> fFaceIndices = new DataTree<int>(); // DataTree of face indices connected to each face
    DataTree<int> fEdgeIndices = new DataTree<int>(); // DataTree of edge indices connected to each face
    DataTree<int> eFaceIndices = new DataTree<int>(); // DataTree of face indices connected to each edge

    // Iterate through each "branch" of the original DataTree<Brep>
    for (int j = 0; j < B.BranchCount; j++) {
      // Create a List of Brep for each branch 
      // Create a path to remember the current path for later access
      List<Brep> brepsList = B.Branches[j];
      GH_Path currentPath = B.Paths[j];

      // Iterate through each brep in current brepsList
      for (int i = 0; i < brepsList.Count; i++) {
        Brep brep = brepsList[i];

        // Iterate through each face in current Brep
        for (int k = 0; k < brep.Faces.Count; k++) {
          // Create a path to "copy" to the fFaceIndices and fEdgeIndice DataTrees
          GH_Path targetPath = currentPath.AppendElement(k);

          // Get an array of adjcent faces and edges of current face
          int[] adjacentFaces = brep.Faces[k].AdjacentFaces();
          int[] adjacentEdges = brep.Faces[k].AdjacentEdges();

          // Add the faces and edges to the corresponding DataTrees, with the path information
          fFaceIndices.AddRange(adjacentFaces, targetPath);
          fEdgeIndices.AddRange(adjacentEdges, targetPath);
        }

        // Iterate through each edge in current Brep
        for (int n = 0;n < brep.Edges.Count; n++) {
          // Create a path to "copy" to the eFaceIndices DataTrees
          GH_Path edgePath = currentPath.AppendElement(n);

          // Get an array of adjcent faces of current edge
          int[] adjacentEdgeFaces = brep.Edges[n].AdjacentFaces();
          // Add the faces to the eFaceIndices DataTree, with the path information
          eFaceIndices.AddRange(adjacentEdgeFaces, edgePath);
        }
      }
    }

    // Output
    FF = fFaceIndices;
    FE = fEdgeIndices;
    EF = eFaceIndices;
# ---------- end c_topology ----------
panel_94 = Panel(topology.FaceFaceAdjacency)
panel_95 = Panel(c_topology.FF)
panel_96 = Panel(topology.FaceEdgeAdjacency)
panel_97 = Panel(c_topology.FE)
panel_98 = Panel(topology.EdgeFaceAdjacency)
panel_99 = Panel(c_topology.EF)

pt_18 = Point(Point(2.216256994, 2.247253595, 2.777777632))
srf_6 = Surface(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)
c_srf_cp = CSharpScript(Pt=pt_18, S=srf_6)  # -> out, P, uvP, D; inputs Pt: Point3d, S: Surface
# ---------- c_srf_cp: C# ----------
    // Component created by @mirahx24

    // Initialize the u and v as double
    double u;
    double v;
    Point3d closestPt = Pt;

    // Get the plane for Pt in world coordinate
    Plane source_Plane = Plane.WorldXY;
    source_Plane.Origin = Pt;

    // This function returns true if successful
    // It doesn't return the resulting closest point of Pt on surface
    // Instead it returns them as outputs
    if(S.ClosestPoint(Pt, out u, out v)) {

      //Get the plane for Pt in uv coordinate
      Plane target_Plane;
      S.FrameAt(u, v, out target_Plane);

      // Perform matrix transforms to to convert plane in world coordinate to uv coordinate
      Transform xform = Transform.PlaneToPlane(source_Plane, target_Plane);
      closestPt.Transform(xform); // apply the transformation to the closestPt
    }
    else{
      return; // if cannot find closest point, stop script from executing
    }

    Point3d uvPt = new Point3d(u, v, 0);

    // Output
    P = closestPt;
    uvP = uvPt;
    D = closestPt.DistanceTo(Pt);
# ---------- end c_srf_cp ----------
pt_19 = Point(c_srf_cp.P)
panel_100 = Panel(c_srf_cp.P)
panel_101 = Panel(c_srf_cp.D)
panel_102 = Panel(c_srf_cp.uvP)

# ---- group: Grasshopper Srf CP
srf_cp = SurfaceClosestPoint(Point=pt_18, Surface=srf_6)  # -> Point, UVPoint, Distance

# ----
pt_20 = Point(srf_cp.Point)
panel_103 = Panel(srf_cp.Point)
panel_104 = Panel(srf_cp.UVPoint)
panel_105 = Panel(srf_cp.Distance)

geo_17 = Geometry(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)
c_debrep = CSharpScript(B=geo_17)  # -> out, F, E, V; inputs B: Brep
# ---------- c_debrep: C# ----------
    // This component is created by @mirahx24

    // Safety check! Only run component if input Brep exist
    if( B != null) {
      F = B.Faces; 
      E = B.Edges;
      V = B.Vertices;
    }
# ---------- end c_debrep ----------
geo_18 = Geometry(c_debrep.F)
geo_19 = Geometry(c_debrep.E)
geo_20 = Geometry(c_debrep.V)

# ---- group: Grasshopper DeBrep
debrep = DeconstructBrep(Brep=geo_17)  # -> Faces, Edges, Vertices

# ----
geo_21 = Geometry(debrep.Faces)
geo_22 = Geometry(debrep.Edges)
geo_23 = Geometry(debrep.Vertices)

pt_21 = ConstructPoint(XCoordinate="0", YCoordinate=Slider(10.58, range=0..19.49), ZCoordinate="0")
pt_22 = Point(pt_21)
srf_7 = Surface(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)
c_osc = CSharpScript(S=srf_7, uv=pt_22)  # -> out, P, C1, C2; inputs S: Surface, uv: Point3d
# ---------- c_osc: C# ----------
    // Component created by @mirahx24

    // Get u and v dimensions
    double u = uv.X;
    double v = uv.Y;

    Point3d pt = S.PointAt(u, v); // get surface point at uv coordinate
    SurfaceCurvature curv = S.CurvatureAt(u, v); // get surface curvature at uv coordinate

    // Get the oscilating circles of curvature at uv coordinate
    NurbsCurve cir1 = curv.OsculatingCircle(0).ToNurbsCurve();
    NurbsCurve cir2 = curv.OsculatingCircle(1).ToNurbsCurve();

    // Output
    P = pt;
    C1 = cir1;
    C2 = cir2;
# ---------- end c_osc ----------
panel_106 = Panel(c_osc.P)
panel_107 = Panel(c_osc.C1)
panel_108 = Panel(c_osc.C2)

# ---- group: Grasshopper Osc
osc = OsculatingCircles(Surface=srf_7, Point=pt_22)  # -> Point, FirstCircle, SecondCircle

# ----
panel_109 = Panel(osc.Point)
panel_110 = Panel(osc.FirstCircle)
panel_111 = Panel(osc.SecondCircle)

pt_23 = ConstructPoint(XCoordinate="0", YCoordinate=Slider(10.58, range=0..19.49), ZCoordinate="0")
srf_8 = Surface(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)
pt_24 = Point(pt_23)
c_cruvature = CSharpScript(S=srf_8, uv=pt_24)  # -> out, F, G, M; inputs S: Surface, uv: Point3d
# ---------- c_cruvature: C# ----------
    // Component created by @mirahx24
    
    double u = uv.X;
    double v = uv.Y;
    double gau;
    double mean;
    
    // Get plane at surface uv coordinate
    Plane frame = new Plane();
    if(S.FrameAt(u, v, out frame)) {
      SurfaceCurvature curv = S.CurvatureAt(u, v);
      gau = curv.Gaussian; // get the gaussian value of surface curvature
      mean = curv.Mean; // get the mean value of surface curvature
    }
    else {
      // Create runtime error message if cannot get plane at uv coordinate
      Component.AddRuntimeMessage(GH_RuntimeMessageLevel.Error, "Cannot compute Frame at given uv point");
      return;
    }
    
    // Output
    F = frame;
    G = gau;
    M = mean;
# ---------- end c_cruvature ----------
panel_112 = Panel(c_cruvature.F)
panel_113 = Panel(c_cruvature.M)
panel_114 = Panel(c_cruvature.G)

# ---- group: Grasshopper Cruvature
curvature_2 = SurfaceCurvature(Surface=srf_8, Point=pt_24)  # -> Frame, Gaussian, Mean

# ----
panel_115 = Panel(curvature_2.Frame)
panel_116 = Panel(curvature_2.Gaussian)
panel_117 = Panel(curvature_2.Mean)

srf_9 = Surface(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)
c_amoments = CSharpScript(Geo=srf_9)  # -> out, A, C, I, Ii, S, Ss, G; inputs Geo: GeometryBase
# ---------- c_amoments: C# ----------
    // Component created by @mirahx24
    
    // This component should be able to read in closed planar Curve, Surface, and Brep
    // Because of this requirement, the input Geo need to be set as class GeometryBase object
    // And need to implement try-catch statements
    // Try-catch statement enable the script to run potentially fail-able code in a saft environment
    // If code inside the Try block failed, the compiler will start to execute code inside the Catch statement and then the rest of the script
    // For more information on try-catch statements, read https://docs.microsoft.com/en-us/dotnet/csharp/language-reference/keywords/try-catch

    
    // Rhinocommon has an AreaMassProperties class that is able to take in many different geometries
    // And able to return the associated area property of that geometry
    // For more information on AreaMassProperties, read https://developer.rhino3d.com/api/RhinoCommon/html/T_Rhino_Geometry_AreaMassProperties.htm
    
    // First initialize a null object of AreaMassProperties
    AreaMassProperties amp = null;
    
    // Boolean variable to check if the type of input geometry is already found
    bool computed = false;
    
    // Try to convert input G to a curve
    try {
      // If Geo is a curve, then the conversion will be successful and the rest of the code inside try block will execute.
      // Otherwise, it will go to the Catch statement without running the rest of the codes inside the try block
      Curve c = (Curve) Geo;
      
      // If G is a curve, then check curve is closed
      if (!c.IsClosed) {
        // If it is not closed, add runtime error message
        Component.AddRuntimeMessage(GH_RuntimeMessageLevel.Error, "Curve must be closed for Area calculation");
        return;
      }

      // Check if curve is planar
      if(!c.IsPlanar()) {
        // If it is not planar, add runtime error message
        Component.AddRuntimeMessage(GH_RuntimeMessageLevel.Error, "Curve must be planar for Area calculation");
        return;
      }
      
      amp = AreaMassProperties.Compute(c); // compute values of the amp object
      computed = true; // confirmed amp has been comupted, which mean type conversion succeed
    }
    catch {}

    // If boolean varaible "computed" is false, amp hasn't been computed
    // Which means the previous conversion failed
    if (!computed) {
      // Try converting Geo to a Surface
      try {
        // If Geo is a Surface, then the conversion will be successful and the rest of the code inside try block will execute.
        // Otherwise, it will go to the Catch statement without running the rest of the codes inside the try block
        Surface s = (Surface) Geo;
        amp = AreaMassProperties.Compute(s); // compute values of the amp object
        computed = true; // confirmed amp has been comupted, which mean type conversion succeed
      }
      catch {}
    }

    if (!computed) {
      // Try converting Geo to a Brep
      try {
        // If Geo is a Brep, then the conversion will be successful and the rest of the code inside try block will execute.
        // Otherwise, it will go to the Catch statement without running the rest of the codes inside the try block
        Brep b = (Brep) Geo;
        
        amp = AreaMassProperties.Compute(b); // compute values of the amp object
        computed = true; // confirmed amp has been comupted, which mean type conversion succeed
      }
      catch {}
    }


    // Check if we were able to compute amp of a closed planar curve, surface, or brep
    // If computation is successful, find the properties of geometry 
    if (amp != null) {
      A = amp.Area;
      C = amp.Centroid;
      I = amp.CentroidCoordinatesMomentsOfInertia;
      Ii = amp.CentroidCoordinatesMomentsOfInertiaError;
      S = amp.CentroidCoordinatesSecondMoments;
      Ss = amp.CentroidCoordinatesSecondMomentsError;
      G = amp.CentroidCoordinatesRadiiOfGyration;
    }
    
    // Otherwise, add runtime error
    else {
      Component.AddRuntimeMessage(GH_RuntimeMessageLevel.Error, "Area properties could not be solved.");

    }
# ---------- end c_amoments ----------
panel_118 = Panel(c_amoments.A)
panel_119 = Panel(c_amoments.Ii)
panel_120 = Panel(c_amoments.S)
panel_121 = Panel(c_amoments.C)
panel_122 = Panel(c_amoments.I)
panel_123 = Panel(c_amoments.Ss)
panel_124 = Panel(c_amoments.G)

# ---- group: Grasshopper AMoments
amoments = AreaMoments(Geometry=srf_9)  # -> Area, Centroid, Inertia, InertiaError, Secondary, SecondaryError, Gyration

# ----
panel_125 = Panel(amoments.Area)
panel_126 = Panel(amoments.Centroid)
panel_127 = Panel(amoments.Inertia)
panel_128 = Panel(amoments.InertiaError)
panel_129 = Panel(amoments.Secondary)
panel_130 = Panel(amoments.SecondaryError)
panel_131 = Panel(amoments.Gyration)

geo_24 = Geometry(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)
c_vmoments = CSharpScript(Geo=geo_24)  # -> out, V, C, I, Ii, S, Ss, G; inputs Geo: GeometryBase
# ---------- c_vmoments: C# ----------
    // Component created by @mirahx24

    // This component should be able to read in closed planar Brep and Mesh
    // Because of this requirement, the input G need to be set as class GeometryBase object
    // And need to implement try-catch statements
    // Try-catch statement enable the script to run potentially fail-able code in a saft environment
    // If code inside the Try block failed, the compiler will start to execute code inside the Catch statement and then the rest of the script
    // For more information on try-catch statements, read https://docs.microsoft.com/en-us/dotnet/csharp/language-reference/keywords/try-catch

    // Rhinocommon has an VolumeMassProperties class that is able to take in many different geometries
    // And able to return the associated volume property of that geometry
    // For more information on VolumeMassProperties, read https://developer.rhino3d.com/api/RhinoCommon/html/T_Rhino_Geometry_VolumeMassProperties.htm

    // First initialize a null object of VolumeMassProperties
    VolumeMassProperties vmp = null;

    // Boolean variable to check if the type of input geometry is already found
    bool computed = false;
    
    // Try to convert input Geo to a Brep
    try{
      // If G is a Brep, then the conversion will be successful and the rest of the code inside try block will execute.
      // Otherwise, it will go to the Catch statement without running the rest of the codes inside the try block
      Brep b = (Brep) Geo;
      
      // Check if Brep is closed
      if(!b.IsSolid){
        // If not, then add runtime error
        Component.AddRuntimeMessage(GH_RuntimeMessageLevel.Error, "Volume cannot be computed for an open brep.");
        return;
      }
      
      vmp = VolumeMassProperties.Compute(b); // compute vmp value of Brep
      computed = true; // flag computed as true
    }
    catch{}

    // If boolean varaible "computed" is false, vmp hasn't been computed
    // Which means the previous conversion failed
    if(!computed) {
      try{
        // Try to convert input Geo to a Mesh
        Mesh m = (Mesh) Geo;

        vmp = VolumeMassProperties.Compute(m); // compute vmp value of Mesh
        computed = true; // flag computed as true
      }
      catch{}
    }

    // Check if we were able to compute vmp of a closed brep or a mesh
    // If computation is successful, find the volume and centroid of geometry
    if(vmp != null) {
      // Output volume properties of Geometry
      V = Math.Round(vmp.Volume, 6);
      C = vmp.Centroid;
      I = vmp.CentroidCoordinatesMomentsOfInertia;
      Ii = vmp.CentroidCoordinatesMomentsOfInertiaError;
      S = vmp.CentroidCoordinatesSecondMoments;
      Ss = vmp.CentroidCoordinatesSecondMomentsError;
      G = vmp.CentroidCoordinatesRadiiOfGyration;
    }
      
    // Otherwise, add runtime error
    else{
      Component.AddRuntimeMessage(GH_RuntimeMessageLevel.Error, "Volume properties could not be solved.");
    }
# ---------- end c_vmoments ----------
panel_132 = Panel(c_vmoments.Ss)
panel_133 = Panel(c_vmoments.G)
panel_134 = Panel(c_vmoments.V)
panel_135 = Panel(c_vmoments.C)
panel_136 = Panel(c_vmoments.I)
panel_137 = Panel(c_vmoments.Ii)
panel_138 = Panel(c_vmoments.S)

# ---- group: Grasshopper VMoments
vmoments = VolumeMoments(Geometry=geo_24)  # -> Volume, Centroid, Inertia, InertiaError, Secondary, SecondaryError, Gyration

# ----
panel_139 = Panel(vmoments.Volume)
panel_140 = Panel(vmoments.Centroid)
panel_141 = Panel(vmoments.Inertia)
panel_142 = Panel(vmoments.InertiaError)
panel_143 = Panel(vmoments.Secondary)
panel_144 = Panel(vmoments.SecondaryError)
panel_145 = Panel(vmoments.Gyration)
