# Grasshopper definition Surface_Primitives.ghx (Grasshopper 1.0.7)

# ----
# GH#: A C# dictionary of Grasshopper3D components.
# 
# This file contains a category of Grasshopper components, and a mirroring C#/RhinoCommon implementation.
# 
# This is an educational project initiated by students/faculty of GSD-6338: Introduction to Computational Design, at the Harvard Graduate School of Design.
# 
# More information: {{project link}}
# Surface Primitive
# Surface Primitive Incomplete: Plane Through Shape (PxS)
# Bounding Box
xy = XYPlane(Origin=Point(0, 0, 0))
number_slider = Slider(50, range=0..100)
number_slider_2 = Slider(50, range=0..100)
gh_planesrf = CSharpScript(P=xy, X=number_slider, Y=number_slider_2)  # -> out, PlaneSrf; inputs P: Plane
# ---------- gh_planesrf: C# ----------
    //Component written by @erinlinseyhunt

    //Create a new planar surface with a point and a XY size.
    Surface a = new PlaneSurface(P, X, Y);

    //Output
    PlaneSrf = a;
# ---------- end gh_planesrf ----------
planesrf = PlaneSurface(Plane=xy, XSize=number_slider, YSize=number_slider_2)
geo = Geometry(planesrf)
geo_2 = Geometry(gh_planesrf.PlaneSrf)

pln = Plane(Plane(origin=(0.2218104066, 0.6959550324, 0), x=(0, 1, 0), y=(-1, 0, 0)))
geo_3 = Geometry(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)
number_slider_3 = Slider(0, range=-1..3)
gh_pxs = CSharpScript(P=pln, S=geo_3, I=number_slider_3)  # -> Out, S
pxs = PlaneThroughShape(Plane=pln, Shape=geo_3, Inflate=number_slider_3, SectionLogic=False)
srf = Surface(pxs)
srf_2 = Surface(gh_pxs.S)

geo_4 = Geometry(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)
xy_2 = XYPlane(Origin=Point(0, 0, 0))
gh_bbox = CSharpScript(C=geo_4, P=xy_2)  # -> out, bOrigin; inputs C: Brep, P: Plane
# ---------- gh_bbox: C# ----------
    Box bounding = new Box(P, C);

    bOrigin = bounding;
# ---------- end gh_bbox ----------
bbox = BoundingBox(Content=geo_4, Plane=xy_2, UnionBox=True)  # -> Box, Box_2
geo_5 = Geometry(bbox.Box)
geo_6 = Geometry(bbox.Box_2)
geo_7 = Geometry(gh_bbox.bOrigin)

pt = Point(Point(19.92908617, 6.729750141, 0))
pt_2 = Point(Point(0, -0.07428227364, 2.92176943))
xy_3 = XYPlane(Origin=Point(0, 0, 0))
gh_box = CSharpScript(A=[pt, pt_2], P=xy_3)  # -> out, B; inputs A: list of Point3d, P: Plane
# ---------- gh_box: C# ----------
    //Component written by @erinlinseyhunt

    //Create a new Box with two points and a plane.
    Box c = new Box(P, A);
    
    //Output
    B = c;
# ---------- end gh_box ----------
box = Box2Pt(PointA=pt, PointB=pt_2, Plane=xy_3)
geo_8 = Geometry(box)
geo_9 = Geometry(gh_box.B)

number_slider_4 = Slider(20, range=1..20)
crv = Curve(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)
gh_boxrec = CSharpScript(R=crv, H=number_slider_4)  # -> out, B; inputs R: Curve, H: Double
# ---------- gh_boxrec: C# ----------
    //Component written by @erinlinseyhunt

    //Create a rectangular extrusion by inputting a rectangle and a height. If the third input is true, the box will be closed.
    Extrusion E = Extrusion.Create(R, H, true);

    B = E;
# ---------- end gh_boxrec ----------
boxrec = BoxRectangle(Rectangle=crv, Height=number_slider_4)
geo_10 = Geometry(boxrec)
geo_11 = Geometry(gh_boxrec.B)

xy_4 = XYPlane(Origin=Point(0, 0, 0))
number_slider_5 = Slider(3.5, range=0.5..15)
number_slider_6 = Slider(8.6, range=0.5..15)
number_slider_7 = Slider(7.7, range=0.5..15)
gh_box_2 = CSharpScript(B=xy_4, X=number_slider_5, Y=number_slider_6, Z=number_slider_7)  # -> out, box; inputs B: Plane, X: Double, Y: Double, Z: Double
# ---------- gh_box_2: C# ----------
    //Component written by @erinlinseyhunt

    //Create an X, Y, and Z interval to allowing for a negative to positive domain so that the box will be centered.  
    Interval dx = new Interval(-X, X);
    Interval dy = new Interval(-Y, Y);
    Interval dz = new Interval(-Z, Z);

    //Create a new box using the above created intervals.
    Box b = new Box(B, dx, dy, dz);

    //Output
    box = b;
# ---------- end gh_box_2 ----------
box_2 = CenterBox(Base=xy_4, X=number_slider_5, Y=number_slider_6, Z=number_slider_7)
geo_12 = Geometry(box_2)
geo_13 = Geometry(gh_box_2.box)

xy_5 = XYPlane(Origin=Point(0, 0, 0))
number_slider_8 = Slider(3.5, range=0.5..15)
number_slider_9 = Slider(8.6, range=0.5..15)
number_slider_10 = Slider(7.7, range=0.5..15)
gh_domain_box = CSharpScript(B=xy_5, X=number_slider_8, Y=number_slider_9, Z=number_slider_10)  # -> out, box; inputs B: Plane, X: Double, Y: Double, Z: Double
# ---------- gh_domain_box: C# ----------
    //Component written by @erinlinseyhunt

    //Create an X, Y and Z interval.
    Interval dx = new Interval(0, X);
    Interval dy = new Interval(0, Y);
    Interval dz = new Interval(0, Z);

    //Create a new box with the above interval.
    Box b = new Box(B, dx, dy, dz);

    //Output
    box = b;
# ---------- end gh_domain_box ----------
box_3 = DomainBox(Base=xy_5, X=number_slider_8, Y=number_slider_9, Z=number_slider_10)
geo_14 = Geometry(box_3)
geo_15 = Geometry(gh_domain_box.box)

xy_6 = XYPlane(Origin=Point(0, 0, 0))
radius_of_cone = Slider(3, range=0..10)
height_of_cone = Slider(5, range=0..10)
gh_cone = CSharpScript(B=xy_6, R=radius_of_cone, L=height_of_cone)  # -> out, C, T; inputs B: Plane, R: Double, L: Double
# ---------- gh_cone: C# ----------
    //Component written by @erinlinseyhunt

    //Offset the Plane
    Point3d Origin = B.Origin;

    //Moving the plane in the Z Axis since it is unitized it needs to be multiplied by the input height.
    Vector3d dir = B.ZAxis * L;

    //New origin location created by creating a new point3d and adding the vector created above.
    Point3d newOrigin = Origin + dir;

    //Set the input origin equal to the new origin.
    B.Origin = newOrigin;

    //Create a new cone. The length is set to negative to mirror the cone so that its base sits on the origin.
    C = new Cone(B, -L, R);

    //Creating a new Point3d at the tip of the cone. This is just the location of the new origin.
    T = new Point3d(B.OriginX, B.OriginY, B.OriginZ);
# ---------- end gh_cone ----------
cone = Cone(Base=xy_6, Radius=radius_of_cone, Length=height_of_cone)  # -> Cone, Tip
geo_16 = Geometry(cone.Cone)
pt_3 = Point(cone.Tip)
geo_17 = Geometry(gh_cone.C)
pt_4 = Point(gh_cone.T)

xy_7 = XYPlane(Origin=Point(0, 0, 0))
length_of_cylinder = Slider(13.21, range=0.25..40)
radius_of_cylinder = Slider(8.82, range=0.25..10)
gh_cyl = CSharpScript(B=xy_7, R=radius_of_cylinder, L=length_of_cylinder)  # -> out, C; inputs B: Plane, R: Double, L: Double
# ---------- gh_cyl: C# ----------
    //Component written by @erinlinseyhunt

    //Create a new circle.
    Circle a = new Circle(B, R);
    
    //Create a cylinder by inputting the above circle and the length.
    Cylinder cyl = new Cylinder(a, L);
    
    //Output
    C = cyl;
# ---------- end gh_cyl ----------
cyl = Cylinder(Base=xy_7, Radius=radius_of_cylinder, Length=length_of_cylinder)
geo_18 = Geometry(cyl)
geo_19 = Geometry(gh_cyl.C)

xy_8 = XYPlane(Origin=Point(0, 0, 0))
radius_of_quad_sphere = Slider(8.82, range=0.25..10)
gh_qsph = CSharpScript(B=xy_8, R=radius_of_quad_sphere)  # -> out, S; inputs B: Plane, R: Double
# ---------- gh_qsph: C# ----------
    //Component written by @erinlinseyhunt

    //Create a new sphere.
    Sphere a = new Sphere(B, R);

    //Use the above sphere to create a quad sphere.
    S = Brep.CreateQuadSphere(a);
# ---------- end gh_qsph ----------
qsph = QuadSphere(Base=xy_8, Radius=radius_of_quad_sphere)
geo_20 = Geometry(qsph)
geo_21 = Geometry(gh_qsph.S)

xy_9 = XYPlane(Origin=Point(0, 0, 0))
sphere_radius = Slider(5, range=0..10)
sph = Sphere(Base=xy_9, Radius=sphere_radius)
gh_sph = CSharpScript(B=xy_9, R=sphere_radius)  # -> out, S; inputs B: Plane, R: Double
# ---------- gh_sph: C# ----------
    //Component written by @erinlinseyhunt

    //Using a base plane and a radius as input create a new sphere.
    Sphere a = new Sphere(B, R);

    //Output
    S = a;
# ---------- end gh_sph ----------
geo_22 = Geometry(sph)
geo_23 = Geometry(gh_sph.S)

pt_5 = Point(Point(-1.386047, -9.693180155, 0))
pt_6 = Point(Point(5.454254388, 8.069916751, 0))
pt_7 = Point(Point(8.083708926, -4.641052015, 0))
pt_8 = Point(Point(-1.134328629, 0.2683152975, 0))
gh_sph4pt = CSharpScript(P1=pt_6, P2=pt_7, P3=pt_8, P4=pt_5)  # -> out, C, R, S; inputs P1: Point3d, P2: Point3d, P3: Point3d, P4: Point3d
# ---------- gh_sph4pt: C# ----------
    //Component written by @erinlinseyhunt

    //Create a new list of Point3d
    List<Point3d> P = new List<Point3d>();


    //Add the four input Point3D to the new Point3D list using a for loop.
    for (int i = 0; i < 4; i++)
    {
      P.Add(P1);
      P.Add(P2);
      P.Add(P3);
      P.Add(P4);
    }

    //Create a bounding sphere from the list of input points.
    Sphere s = Sphere.FitSphereToPoints(P);

    //Find the radius of the above sphere.
    double a = s.Radius;

    //Find the center of the above sphere.
    Point3d b = s.Center;

    //Outputs
    S = s;
    R = a;
    C = b;
# ---------- end gh_sph4pt ----------
sph4pt = Sphere4Pt(Point1=pt_6, Point2=pt_7, Point3=pt_8, Point4=pt_5)  # -> Center, Radius, Sphere
panel = Panel(sph4pt.Center)
panel_2 = Panel(sph4pt.Radius)
geo_24 = Geometry(sph4pt.Sphere)
panel_3 = Panel(gh_sph4pt.C)
panel_4 = Panel(gh_sph4pt.R)
geo_25 = Geometry(gh_sph4pt.S)

pt_9 = Point([Point(-6.645286165, 15.51268916, -1.757074672), Point(10.45775515, -12.87173439, -3.559948881), Point(-5.62444061, -3.08111199, 15.78249162), Point(-9.566593566, -6.552946609, -12.53700328), Point(8.773347936, 6.371772614, -12.95736687), Point(7.425120298, 10.40485214, 11.03796241)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])
gh_sfit = CSharpScript(P=pt_9)  # -> out, C, R, S; inputs P: list of Point3d
# ---------- gh_sfit: C# ----------
    //Component written by @erinlinseyhunt

    //Create a bounding sphere from the input points.
    Sphere s = Sphere.FitSphereToPoints(P);

    //Find the radius of the above sphere.
    double a = s.Radius;

    //Find the center of the above sphere.
    Point3d b = s.Center;

    //Outputs
    S = s;
    R = a;
    C = b;
# ---------- end gh_sfit ----------
sfit = SphereFit(Points=pt_9)  # -> Center, Radius, Sphere
panel_5 = Panel(sfit.Center)
panel_6 = Panel(sfit.Radius)
geo_26 = Geometry(sfit.Sphere)
panel_7 = Panel(gh_sfit.C)
panel_8 = Panel(gh_sfit.R)
geo_27 = Geometry(gh_sfit.S)
