# Grasshopper definition Mesh_Util.ghx (Grasshopper 1.0.7)

toggle = BooleanToggle(True)
toggle_2 = BooleanToggle(False)
toggle_3 = BooleanToggle(True)
number_slider = Slider(400, range=0..1000)
number_slider_2 = Slider(20, range=0..100)
number_slider_3 = Slider(0, range=0..100)
number_slider_4 = Slider(0, range=0..100)
number_slider_5 = Slider(36, range=0..100)
number_slider_6 = Slider(0, range=0..100)
number_slider_7 = Slider(20, range=0..100)
gh_custom_mesh_settings = CSharpScript(
    Stitch=toggle,
    Planes=toggle_2,
    Refine=toggle_3,
    Min=number_slider_5,
    Max=number_slider,
    Aspect=number_slider_2,
    MaxDist=number_slider_6,
    MaxAngle=number_slider_7,
    MinEdge=number_slider_3,
    MaxEdge=number_slider_4)  # -> out, S; inputs Stitch: Boolean, Planes: Boolean, Refine: Boolean, Min: Int32, Max: Int32, Aspect: Double, MaxDist: Double, MaxAngle: Double, MinEdge: Double, MaxEdge: Double
# ---------- gh_custom_mesh_settings: C# ----------
    // Component written by @garciadelcastillo

    // This component outputs a MeshingParameters object, with
    // information about Brep to Mesh conversion.
    MeshingParameters mp = new MeshingParameters();

    mp.JaggedSeams = !Stitch;
    mp.SimplePlanes = Planes;
    mp.RefineGrid = Refine;
    mp.GridMinCount = Min;
    mp.GridMaxCount = Max;
    mp.GridAspectRatio = Aspect;
    mp.Tolerance = MaxDist;
    double angleRads = MaxAngle * Math.PI / 180.0;
    mp.GridAngle = angleRads;
    mp.MinimumEdgeLength = MinEdge;
    mp.MaximumEdgeLength = MaxEdge;

    // Outputs
    S = mp;
# ---------- end gh_custom_mesh_settings ----------
custom_mesh_settings = SettingsCustom(
    StitchSeams=toggle,
    SimplePlanes=toggle_2,
    Refine=toggle_3,
    MinCount=number_slider_5,
    MaxCount=number_slider,
    AspectRatio=number_slider_2,
    MaxDistance=number_slider_6,
    MaxAngle=number_slider_7,
    MinEdge=number_slider_3,
    MaxEdge=number_slider_4)
gh_mpreader = CSharpScript(MP=custom_mesh_settings)  # -> out
# ---------- gh_mpreader: C# ----------
    // Component written by @garciadelcastillo

    // This component prints out MeshingParameters values.
    // NOTE: this component is for debugging, no mirror on the main GH API.
    MeshingParameters mp = (MeshingParameters) MP;

    Print("Stitch: " + mp.JaggedSeams.ToString());
    Print("Planes: " + mp.SimplePlanes.ToString());
    Print("Refine: " + mp.RefineGrid.ToString());
    Print("Min: " + mp.GridMinCount.ToString());
    Print("Max: " + mp.GridMaxCount.ToString());
    Print("Aspect: " + mp.GridAspectRatio.ToString());
    Print("Max Dist: " + mp.Tolerance.ToString());
    double angleDegs = mp.GridAngle * 180 / Math.PI;
    Print("Max Angle: " + angleDegs.ToString());
    Print("Min Edge: " + mp.MinimumEdgeLength.ToString());
    Print("Max Edge: " + mp.MaximumEdgeLength.ToString());
# ---------- end gh_mpreader ----------
gh_mpreader_2 = CSharpScript(MP=gh_custom_mesh_settings.S)  # -> out; same code as gh_mpreader
meshing_parameters = Panel(gh_mpreader)
meshing_parameters_2 = Panel(gh_mpreader_2)

# ----
# GH#: A C# dictionary of Grasshopper3D components.
# 
# This file contains a category of Grasshopper components, and a mirroring C#/RhinoCommon implementation.
# 
# This is an educational project initiated by students/faculty of GSD-6338: Introduction to Computational Design, at the Harvard Graduate School of Design.
# 
# More information: {{project link}}
# Mesh Util
brep = Brep(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)
data = Data(custom_mesh_settings)
data_2 = Data(gh_custom_mesh_settings.S)
mesh = MeshBrep(Brep=brep, Settings=data)
gh_mesh = CSharpScript(B=brep, S=data_2)  # -> out, M; inputs B: Brep
# ---------- gh_mesh: C# ----------
    // Component written by @garciadelcastillo

    // This component outputs relevant mesh information, such as
    // vertices, faces, vertex color and vertex normals.
    // Most of this information is avaliable as collections inside
    // the Mesh class, so it can be output directly.

    MeshingParameters mp = (MeshingParameters) S;
    Mesh[] meshes = Mesh.CreateFromBrep(B, mp);

    // Output
    M = meshes;
# ---------- end gh_mesh ----------
mesh_2 = Panel(mesh)
mesh_3 = Panel(gh_mesh.M)

mblur = BlurMesh(Iterations=1)
cullv = CullVertices(Shrink=True)
deletev = DeleteVertices(Shrink=True)
mjoin = MeshJoin()
quad = Quadrangulate(Angle=0.03490658504, Ratio=0.875)  # -> Mesh, Count
alignvert = AlignVertices(Tolerance=0.01)  # -> Result, Count
unim = UnifyMesh()  # -> Result, Count
msplit = MeshSplitPlane(Plane=PlaneXY(0, 0, 0))  # -> Above, Below
weld = WeldMesh(Angle=3.141592654)
exposure = Exposure(Lambert=False)  # -> Exposure, Range

gh_jagged = CSharpScript()  # -> out, S
# ---------- gh_jagged: C# ----------
    // Component written by @garciadelcastillo

    // This component outputs a MeshingParameter object
    // of the type FastRenderMesh.
    S = MeshingParameters.FastRenderMesh;
# ---------- end gh_jagged ----------
jagged = SettingsSpeed()
gh_mpreader_3 = CSharpScript(MP=gh_jagged.S)  # -> out; same code as gh_mpreader
gh_mpreader_4 = CSharpScript(MP=jagged)  # -> out; same code as gh_mpreader
meshing_parameters_3 = Panel(gh_mpreader_3)
meshing_parameters_4 = Panel(gh_mpreader_4)

srf = Surface(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)
srf_2 = Surface(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)
toggle_4 = BooleanToggle(True)
toggle_5 = BooleanToggle(True)
number_slider_8 = Slider(8, range=0..10)
number_slider_9 = Slider(7, range=0..10)
gh_mesh_uv = CSharpScript(S=srf_2, U=number_slider_8, V=number_slider_9, H=toggle_4, Q=toggle_5)  # -> out, M; inputs S: Brep, U: Int32, V: Int32, H: Boolean, Q: Boolean
# ---------- gh_mesh_uv: C# ----------
    // Component written by @garciadelcastillo

    // This component creates a Mesh out of a Surface by subdividing it
    // along its main U and V directions.
    // In the original GH component, U and V directions seem inverted according to
    // the main 0 and 1 surface directions.
    // The values here are also inverted to maintain consistency.

    // Let's start with an empty Mesh.
    Mesh mesh = new Mesh();

    // Grasshopper Surfaces are Breps with just one face.
    // Check if this is the case.
    if (S.Faces.Count != 1) {
      Component.AddRuntimeMessage(GH_RuntimeMessageLevel.Error, "Can only work with single-surface Breps.");
    }

    // Retrieve surface information from the surface/s in the Brep,
    // and reparameterize it for easier manipulation.
    BrepFace surf = S.Faces[0];
    Interval normD = new Interval(0, 1);
    surf.SetDomain(0, normD);
    surf.SetDomain(1, normD);

    // Retrieve trimming information if available.
    Curve trim = null;
    if (S.Curves2D.Count == 1) {
      trim = S.Curves2D[0];
    }


    // First, create a grid of UV points on the surface.
    List<Point2d> uvCoords = new List<Point2d>();  // note Point2d here

    // Using 1.0, since surface was reparameterized.
    double du = 1.0 / U;
    double dv = 1.0 / V;

    for (int j = 0; j <= U; j++) {
      double u = j * du;

      for (int i = 0; i <= V; i++) {
        double v = i * dv;

        // Store UV coordinates as a Point2d
        Point2d uvPt = new Point2d(u, v);
        uvCoords.Add(uvPt);
      }
    }

    // If equalization is on, we need to redistribute the points along the surface,
    // trying to make their euclidean distance in each direction aproximately equal.
    if (Q) {
      // Let's first equalize points in the U direction.
      List<Point2d> equalizedUPts = EqualizeUVPtsOnSurface(surf, uvCoords, U + 1, V + 1, 0);

      // Repeat process for the V direction
      List<Point2d> equalizedVPts = EqualizeUVPtsOnSurface(surf, equalizedUPts, U + 1, V + 1, 1);

      // Overwrite previous coordinates
      uvCoords = equalizedVPts;
    }

    // Now find those UV points in world coordinates
    List<Point3d> pointsOnSurf = new List<Point3d>();
    foreach(Point2d p in uvCoords) {
      Point3d pt = surf.PointAt(p.X, p.Y);
      pointsOnSurf.Add(pt);
    }

    // Add those as Mesh vertices
    mesh.Vertices.AddVertices(pointsOnSurf);


    // Now, populate the Mesh with faces respecting trimming options.
    // If no trim, all vertices shall be joined by faces.
    if (trim == null) {
      int a, b, c, d;
      for (int j = 0; j < U; j++) {
        for (int i = 0; i < V; i++) {
          a = j * (V + 1) + i;
          b = a + 1;
          c = b + V + 1;
          d = c - 1;

          mesh.Faces.AddFace(a, d, c, b);  // d and b are flipped to mirror original component
        }
      }
    }

      // If surface is trimmed, check if vertices are inside trim and act accordingly.
    else {
      // Check trim containment of every vertex using their UV coordinates on the surface.
      List<PointContainment> contains = new List<PointContainment>();
      for (int i = 0; i < uvCoords.Count; i++) {
        // Curve.Contains only takes Point3d objects, must convert UV coordinates first.
        Point3d p = new Point3d(uvCoords[i].X, uvCoords[i].Y, 0);
        PointContainment pc = trim.Contains(p, Plane.WorldXY, RhinoMath.ZeroTolerance);
        contains.Add(pc);
      }

      // If faces can overhang...
      if (H) {
        int a, b, c, d;
        for (int j = 0; j < U; j++) {
          for (int i = 0; i < V; i++) {
            a = j * (V + 1) + i;
            b = a + 1;
            c = b + V + 1;
            d = c - 1;

            // ...check if AT LEAST ONE of the face vertices is inside the trim
            // by checking its corresponding UV coordinates.
            if (
              contains[a] == PointContainment.Inside ||
              contains[b] == PointContainment.Inside ||
              contains[c] == PointContainment.Inside ||
              contains[d] == PointContainment.Inside
            ) {
              mesh.Faces.AddFace(a, d, c, b);  // d and b are flipped to mirror original component
            }
          }
        }
      }
        // Otherwise...
      else {
        int a, b, c, d;
        for (int j = 0; j < U; j++) {
          for (int i = 0; i < V; i++) {
            a = j * (V + 1) + i;
            b = a + 1;
            c = b + V + 1;
            d = c - 1;

            // ...check if ALL of the face vertices are inside the trim
            // by checking its corresponding UV coordinates.
            if (
              contains[a] == PointContainment.Inside &&
              contains[b] == PointContainment.Inside &&
              contains[c] == PointContainment.Inside &&
              contains[d] == PointContainment.Inside
            ) {
              mesh.Faces.AddFace(a, d, c, b);  // d and b are flipped to mirror original component
            }
          }
        }
      }

      // Clean up unused vertices.
      mesh.Vertices.CullUnused();
    }

    // Output
    M = mesh;
# ---------- gh_mesh_uv: C# additional code ----------
  // This function takes a list of UV coordinates for a surface, and tries to equalize them
  // along a given direction.
  List<Point2d> EqualizeUVPtsOnSurface(Surface surface, List<Point2d> uvPoints, int uCount, int vCount, int direction){

    // First, prepare some data based on the chosen direction.
    int dirCount, perpCount;
    List<Point2d> uvPts;

    if (direction == 0)
    {
      dirCount = uCount;
      perpCount = vCount;

      // Clone the incoming list
      uvPts = new List<Point2d>(uvPoints);
    }
    else
    {
      dirCount = vCount;
      perpCount = uCount;

      // Flip the grid the UV points
      uvPts = new List<Point2d>();
      for (int v = 0; v < vCount; v++) {
        for (int u = 0; u < uCount; u++) {
          int id = v + u * vCount;
          uvPts.Add(uvPoints[id]);
        }
      }
    }

    // Create interpolated curves with the UV points in the chosen direction.
    List<NurbsCurve > dirCurves = new List<NurbsCurve>();
    for (int i = 0; i < dirCount; i++) {
      List<Point2d> dirPoints = uvPts.GetRange(i * perpCount, perpCount);
      NurbsCurve dirCurve;

      //// Let's create the interpolated curve contained in the surface.
      //// For some reason, this is not working correctly and is generating lots of null curves.
      //// @TODO: fix later :(
      //dirCurve = NurbsSurface.CreateCurveOnSurface(surface, dirPoints, 0.001, false);
      
      // Alternatively, let's define an interpolated curve in 2D UV domain,
      // and find it's 3D mapping on the surface by "pushing it up".
      // Must convert Point2d to Point3d first to feed them to CreateInterpolatedCurve.
      List<Point3d> pts = new List<Point3d>();
      foreach (Point2d p in dirPoints) {
        pts.Add(new Point3d(p.X, p.Y, 0));
      }
      Curve dirNormCurve = NurbsCurve.CreateInterpolatedCurve(pts, 3).ToNurbsCurve();
      dirCurve = surface.Pushup(dirNormCurve, RhinoMath.ZeroTolerance).ToNurbsCurve();

      dirCurves.Add(dirCurve);
    }

    // Find points at equal lengths on the direction curves.
    uvPts.Clear();
    foreach (NurbsCurve c in dirCurves) {
      Point3d[] pts;
      c.DivideByCount(perpCount - 1, true, out pts);
      
      double u, v;
      foreach (Point3d p in pts) {
        surface.ClosestPoint(p, out u, out v);
        Point2d uv = new Point2d(u, v);
        uvPts.Add(uv);
      }
    }

    // Before returning, if point order was flipped,
    // unflip it for consistency with the incoming data.
    if (direction != 0)
    {
      // Flip the order of the UV points
      List<Point2d> flippedPts = new List<Point2d>();
      for (int u = 0; u < uCount; u++) {
        for (int v = 0; v < vCount; v++) {
          int id = u + v * uCount;
          flippedPts.Add(uvPts[id]);
        }
      }

      uvPts = flippedPts;
    }
    
    // Done!
    return uvPts;
  }
# ---------- end gh_mesh_uv ----------
mesh_uv = MeshSurface(Surface=srf_2, UCount=number_slider_8, VCount=number_slider_9, Overhang=toggle_4, Equalize=toggle_5)
mesh_4 = Panel(mesh_uv)
mesh_5 = Panel(gh_mesh_uv.M)

brep_2 = Brep(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)
gh_smesh = CSharpScript(B=brep_2)  # -> out, M; inputs B: Brep
# ---------- gh_smesh: C# ----------
    // Component written by @garciadelcastillo
    
    // This component creates a simple Mesh out of a Brep, by turning
    // each one of the Brep faces into a simple triangular/quad Mesh face.
    // Only valid for Brep faces with 3 or 4 edges. 
    
    // Let's start with an empty Mesh.    
    Mesh m = new Mesh();

    // And add a face to it for each Brep face.
    foreach(BrepFace face in B.Faces) 
    {
      // Let's extract the indices of the edge curves adjacent to this BrepFace
      int[] adjacencies = face.AdjacentEdges();
      
      // Only add the MeshFace if we have a valid amount of edges
      if (adjacencies.Length == 3 || adjacencies.Length == 4) 
      {
        // Extract the actual edge curves of this BrepFace
        Curve[] edgeCurves = new Curve[adjacencies.Length];
        for (int i = 0; i < adjacencies.Length; i++) 
        {
          edgeCurves[i] = B.Edges[adjacencies[i]].EdgeCurve;
        }

        // Reorder (and flip) those curves to make sure the end point of a
        // curve matches the start point of the next.
        List<Curve> sortedCurves = SortCurvesByEndPoints(edgeCurves, true);
        
        // Extract start points of all the edge curves...
        List<Point3d> startPts = new List<Point3d>();
        foreach(Curve c in sortedCurves) {
          startPts.Add(c.PointAtStart);
        }
        
        // ...and use them as vertices to create a new face on the mesh, 
        // oriented with the same normal as the center of the BrepFace.
        Vector3d n = face.NormalAt(face.Domain(0).Mid, face.Domain(1).Mid);
        AddOrientedFaceToMesh(m, startPts, n);
      }
    }

    // Outputs
    M = m;
# ---------- gh_smesh: C# additional code ----------
  
  // This function takes an array of curves, and returns a list with the same curves
  // sorted so that the endpoint of any curve matches the start point of the next. 
  // The first curve of the array will be used as the guiding curve.
  // If flip is true, curves may be reversed in order to fulfill the goal.
  // Note that if there is a gap between curves, the returned list will not include them.
  List<Curve> SortCurvesByEndPoints(Curve[] curves, bool flip) 
  {
    // Let's start by creating two lists of sorted and pending to sort Curves.
    List<Curve> sorted = new List<Curve>();
    List<Curve> toSort = new List<Curve>(curves);
    int it = 0;

    // Take the first curve as the guiding one
    sorted.Add(toSort[it]);
    toSort.RemoveAt(it);
    it++;

    // While there are curves remaining to sort...
    while(toSort.Count > 0) 
    {
      // Take the guiding point for checks
      Point3d endPt = sorted[it - 1].PointAtEnd;

      // Iterate over the remaining curves to check
      bool success = false;
      for (int i = 0; i < toSort.Count; i++) 
      {
        // If flippping is allowed, and the end point matches, reverse this curve
        if (flip && endPt.DistanceToSquared(toSort[i].PointAtEnd) < RhinoMath.ZeroTolerance)
        {
          toSort[i].Reverse();
        }
        
        // If the end point of the previous curve matches the start point of this one...
        if (endPt.DistanceToSquared(toSort[i].PointAtStart) < RhinoMath.ZeroTolerance) 
        {
          // Chose this curve as the next one in the list, and stop checking the rest of the curves.
          sorted.Add(toSort[i]);
          toSort.RemoveAt(i);
          it++;
          success = true;
          break;
        }
      }
      
      // If no matching curve was found (there could be a gap between them), stop the while loop.
      if (!success) {
        Print("Could not find overlapping curve");
        break;
      }
    }
    
    // Return whatever could be sorted
    return sorted;
  }
  
  
  // This function takes a Mesh and a list of Points, and add a new MeshFace with those as vertices. 
  // If a valid normal vector is passed, the function will try to align the face normal to it. 
  bool AddOrientedFaceToMesh(Mesh mesh, List<Point3d> vertices, Vector3d normal) 
  {
    // Some sanity
    if (vertices.Count < 3 || vertices.Count > 4) {
      Print("Invalid amount of vertices for new face");
      return false;
    }
    
    // Let's add the vertices to the Mesh
    mesh.Vertices.AddVertices(vertices);

    // Now, let's figure out the MeshFace situation
    int vertC = mesh.Vertices.Count;
    Vector3d faceNormal = Vector3d.Unset;
    // If triangle face...
    if (vertices.Count == 3)
    {
      // ...add the face to the mesh...
      mesh.Faces.AddFace(vertC - 3, vertC - 2, vertC - 1);
      
      // ...and compute the triangle normal.
      if (normal.IsValid) 
      {
        Vector3d a = vertices[1] - vertices[0];
        Vector3d b = vertices[2] - vertices[0];
        faceNormal = Vector3d.CrossProduct(a, b);
      }
    }
    // If quad face...
    else
    {
      // ...add the fac to the mesh...
      mesh.Faces.AddFace(vertC - 4, vertC - 3, vertC - 2, vertC - 1);

      // ...and compute the quad normal as the average of the two triangle ones.
      if (normal.IsValid) 
      {
        Vector3d a = vertices[1] - vertices[0];
        Vector3d b = vertices[2] - vertices[0];
        Vector3d c = vertices[3] - vertices[0];
        Vector3d n0 = Vector3d.CrossProduct(a, b);
        n0.Unitize();
        Vector3d n1 = Vector3d.CrossProduct(b, c);
        n1.Unitize();
        // We average the normals of the two triangles
        faceNormal = 0.5 * (n0 + n1);  
      }
    }
  
    // Check if normals are aligned by looking at the sign of their dot product
    if (faceNormal.IsValid)
    {
      faceNormal.Unitize();
      
      double cosAngle = normal * faceNormal;  // dot product of two unit vectors
      if (cosAngle < 0) {
        mesh.Faces[mesh.Faces.Count - 1].Flip();
        faceNormal.Reverse();
      }

      mesh.FaceNormals.AddFaceNormal(faceNormal);
    }
    
    // This operation was successful
    return true;
  }
# ---------- end gh_smesh ----------
smesh = SimpleMesh(Brep=brep_2)
mesh_6 = Panel(gh_smesh.M)
mesh_7 = Panel(smesh)

cullf = CullFaces()
deletef = DeleteFaces()
disjoint = DisjointMesh()
msmooth = SmoothMesh(Strength=0.5, SkipNaked=True, Iterations=1)
flipm = FlipMesh(VertexNormals=True, FaceNormals=True, FaceOrientation=True)
tri = Triangulate()  # -> Mesh, Count
mshadow = MeshShadow(Light=Vector(0, 0, -1), Plane=PlaneXY(0, 0, 0))
unweld = UnweldMesh(Angle=1.570796327)
occ = Occlusion()  # -> Hits, Occlusion

smooth = SettingsQuality()
gh_smooth = CSharpScript()  # -> out, S
# ---------- gh_smooth: C# ----------
    // Component written by @garciadelcastillo

    // This component outputs a MeshingParameter object
    // of the type QualityRenderMesh
    S = MeshingParameters.QualityRenderMesh;
# ---------- end gh_smooth ----------
gh_mpreader_5 = CSharpScript(MP=gh_smooth.S)  # -> out; same code as gh_mpreader
gh_mpreader_6 = CSharpScript(MP=smooth)  # -> out; same code as gh_mpreader
meshing_parameters_5 = Panel(gh_mpreader_5)
meshing_parameters_6 = Panel(gh_mpreader_6)

panel = Panel(gh_mesh_uv.out)
