# Grasshopper definition Transform_Array.ghx (Grasshopper 1.0.7)

# ----
# GH#: A C# dictionary of Grasshopper3D components.
# 
# This file contains a category of Grasshopper components, and a mirroring C#/RhinoCommon implementation.
# 
# This is an educational project initiated by students/faculty of GSD-6338: Introduction to Computational Design, at the Harvard Graduate School of Design.
# 
# More information: {{project link}}
# Transform Array
mesh = Mesh(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)
box = Box({Plane=PlaneXY(0, 0, 0), X=Domain(0, 8), Y=Domain(0, 4), Z=Domain(0, 3)})
number_slider = Slider(3, range=0..10)
number_slider_2 = Slider(6, range=0..10)
number_slider_3 = Slider(2, range=0..10)
arrbox = BoxArray(Geometry=mesh, Cell=box, XCount=number_slider, YCount=number_slider_2, ZCount=number_slider_3)  # -> Geometry, Transform
gh_arrbox = CSharpScript(G=mesh, C=box, X=number_slider, Y=number_slider_2, Z=number_slider_3)  # -> out, Gout, Xout; inputs G: GeometryBase, C: Box, X: Int32, Y: Int32, Z: Int32
# ---------- gh_arrbox: C# ----------
    // Component written by @garciadelcastillo

    // This component creates a list of transformations that,
    // when applied to an object, result in a 3D array of them.
    
    // Let's initialize the list of outputs.
    List<Transform> transforms = new List<Transform>();
    List<GeometryBase> transformed = new List<GeometryBase>();

    // Let's get the step size based on the dimensions of the box.
    double dx = C.X.Length;
    double dy = C.Y.Length;
    double dz = C.Z.Length;

    // Create a list of move transforms with a triple nested loop:
    for (int k = 0; k < Z; k++)
    {
      double z = k * dz;
      for (int j = 0; j < Y; j++)
      {
        double y = j * dy;
        for (int i = 0; i < X; i++)
        {
          double x = i * dx;

          Transform t = Transform.Translation(x, y, z);
          transforms.Add(t);
        }
      }
    }
    Xout = transforms;  // *

    // Apply it to the object and output it only if it exists
    if (G != null)
    {
      foreach (Transform t in transforms)
      {
        // Clone the object to avoid changing the original one.
        GeometryBase g = G.Duplicate();
        g.Transform(t);
        transformed.Add(g);
      }
      Gout = transformed;
    }

    // * NOTE:
    //   This transform stringifies to "Generic" because it doesn't use
    //   the GH-flavored transforms in Grasshopper.Kernel.Types.Transforms.
# ---------- end gh_arrbox ----------
geometry = Panel(arrbox.Geometry)
geometry_2 = Panel(gh_arrbox.Gout)
transform = Panel(gh_arrbox.Xout)
transform_2 = Panel(arrbox.Transform)

mesh_2 = Mesh(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)
crv = Curve(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)
number_slider_4 = Slider(4, range=0..10)
gh_arrcurve = CSharpScript(G=mesh_2, C=crv, N=number_slider_4)  # -> out, Gout, Xout; inputs G: GeometryBase, C: Curve, N: Int32
# ---------- gh_arrcurve: C# ----------
    // Component written by @garciadelcastillo

    // This component creates a list of transformations that,
    // when applied to an object, result in an array of objects
    // oriented along the perpendicular planes of a curve.

    // Let's initialize the list of outputs.
    List<Transform> transforms = new List<Transform>();
    List<GeometryBase> transformed = new List<GeometryBase>();

    // Some sanity.
    if (N == 0)
    {
      // Output empty lists
      Gout = transformed;
      Xout = transforms;
      return;
    }
    else if (N == 1)
    {
      // Output the object and the identity matrix
      Gout = G;
      Xout = Transform.Identity;
      return;
    }

    // Otherwise, get curve perpendicular curves.
    List<Plane> perpFrames = new List<Plane>();
    double[] curveParams = C.DivideByCount(N - 1, true);
    foreach (double t in curveParams)
    {
      Plane frame;
      C.FrameAt(t, out frame);
      perpFrames.Add(frame);
    }

    // Take the first plane, and use it as the source plane
    // for all the orient transformations.
    Plane source = perpFrames[0];
    foreach (Plane target in perpFrames)
    {
      Transform t = Transform.PlaneToPlane(source, target);
      transforms.Add(t);
    }
    Xout = transforms;  // *

    // Apply it to the object and output it only if it exists
    if (G != null)
    {
      foreach (Transform t in transforms)
      {
        // Clone the object to avoid changing the original one.
        GeometryBase g = G.Duplicate();
        g.Transform(t);
        transformed.Add(g);
      }
      Gout = transformed;
    }


    // * NOTE:
    //   This transform stringifies to "Generic" because it doesn't use
    //   the GH-flavored transforms in Grasshopper.Kernel.Types.Transforms.
# ---------- end gh_arrcurve ----------
arrcurve = CurveArray(Geometry=mesh_2, Curve=crv, Count=number_slider_4)  # -> Geometry, Transform
geometry_3 = Panel(arrcurve.Geometry)
geometry_4 = Panel(gh_arrcurve.Gout)
transform_3 = Panel(arrcurve.Transform)
transform_4 = Panel(gh_arrcurve.Xout)

number_slider_5 = Slider(4, range=0..10)
mesh_3 = Mesh(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)
vec = VectorXYZ(XComponent=Slider(1, range=-5..5), YComponent=Slider(1, range=-5..5), ZComponent=Slider(2, range=-5..5))  # -> Vector, Length
gh_arrlinear = CSharpScript(G=mesh_3, D=vec.Vector, N=number_slider_5)  # -> out, Gout, Xout; inputs G: GeometryBase, D: Vector3d, N: Int32
# ---------- gh_arrlinear: C# ----------
    // Component written by @garciadelcastillo

    // This component creates a list of transformations that,
    // when applied to an object, result in an array of objects
    // linearly distributed along a direction vector

    // Let's initialize the list of outputs.
    List<Transform> transforms = new List<Transform>();
    List<GeometryBase> transformed = new List<GeometryBase>();

    // Some sanity.
    if (N == 0)
    {
      // Output empty lists
      Gout = transformed;
      Xout = transforms;
      return;
    }

    // Otherwise, generate a list of translation vectors.
    List<Vector3d> directions = new List<Vector3d>();
    for (int i = 0; i < N; i++)
    {
      Vector3d dir = i * D;
      directions.Add(dir);
    }

    // For each vector, create the appropriate translation Transform.
    foreach (Vector3d dir in directions)
    {
      Transform t = Transform.Translation(dir);
      transforms.Add(t);
    }
    Xout = transforms;  // *

    // Apply it to the object and output it only if it exists
    if (G != null)
    {
      foreach (Transform t in transforms)
      {
        // Clone the object to avoid changing the original one.
        GeometryBase g = G.Duplicate();
        g.Transform(t);
        transformed.Add(g);
      }
      Gout = transformed;
    }


    // * NOTE:
    //   This transform stringifies to "Generic" because it doesn't use
    //   the GH-flavored transforms in Grasshopper.Kernel.Types.Transforms.
# ---------- end gh_arrlinear ----------
arrlinear = LinearArray(Geometry=mesh_3, Direction=vec.Vector, Count=number_slider_5)  # -> Geometry, Transform
geometry_5 = Panel(arrlinear.Geometry)
geometry_6 = Panel(gh_arrlinear.Gout)
transform_5 = Panel(arrlinear.Transform)
transform_6 = Panel(gh_arrlinear.Xout)

mesh_4 = Mesh(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)
pln = Plane(Plane(origin=(5, 10, 0), x=(0.5796831591, 0.8148419694, 0), y=(-0.387507732, 0.2756751796, 0.8796823023)))
number_slider_6 = Slider(12, range=0..32)
number_slider_7 = Slider(3.14, range=0..6.28)
gh_arrpolar = CSharpScript(G=mesh_4, P=pln, N=number_slider_6, A=number_slider_7)  # -> out, Gout, Xout; inputs G: GeometryBase, P: Plane, N: Int32, A: Double
# ---------- gh_arrpolar: C# ----------
    // Component written by @garciadelcastillo

    // This component creates a list of transformations that,
    // when applied to an object, result in an polar array of objects
    // on the reference plane around its Z axis.

    // Let's initialize the list of outputs.
    List<Transform> transforms = new List<Transform>();
    List<GeometryBase> transformed = new List<GeometryBase>();

    // Some sanity.
    if (N == 0)
    {
      // Output empty lists
      Gout = transformed;
      Xout = transforms;
      return;
    }

    // Otherwise, generate a list of rotation angles
    List<double> angles = new List<double>();
    double delta = A / N;  // ideally, we would probbably want to do A/(N-1) instead to complete the full input angle; left like this for simmetry with the original
    for (int i = 0; i < N; i++)
    {
      double a = i * delta;
      angles.Add(a);
    }
    
    
    // For each angle, create the appropriate rotation Transform.
    foreach (double angle in angles)
    {
      Transform t = Transform.Rotation(angle, P.ZAxis, P.Origin);
      transforms.Add(t);
    }
    Xout = transforms;  // *

    // Apply it to the object and output it only if it exists
    if (G != null)
    {
      foreach (Transform t in transforms)
      {
        // Clone the object to avoid changing the original one.
        GeometryBase g = G.Duplicate();
        g.Transform(t);
        transformed.Add(g);
      }
      Gout = transformed;
    }


    // * NOTE:
    //   This transform stringifies to "Generic" because it doesn't use
    //   the GH-flavored transforms in Grasshopper.Kernel.Types.Transforms.
# ---------- end gh_arrpolar ----------
arrpolar = PolarArray(Geometry=mesh_4, Plane=pln, Count=number_slider_6, Angle=number_slider_7)  # -> Geometry, Transform
geometry_7 = Panel(arrpolar.Geometry)
geometry_8 = Panel(gh_arrpolar.Gout)
transform_7 = Panel(arrpolar.Transform)
transform_8 = Panel(gh_arrpolar.Xout)

mesh_5 = Mesh(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)
rec = Rectangle({Plane=PlaneXY(2, 4, 0), Size=Domain2(u=-2..2, v=-4..4)})
number_slider_8 = Slider(6, range=0..10)
number_slider_9 = Slider(3, range=0..10)
arrrec = RectangularArray(Geometry=mesh_5, Cell=rec, XCount=number_slider_8, YCount=number_slider_9)  # -> Geometry, Transform
gh_arrrec = CSharpScript(G=mesh_5, C=rec, X=number_slider_8, Y=number_slider_9)  # -> out, Gout, Xout; inputs G: GeometryBase, C: Box, X: Int32, Y: Int32
# ---------- gh_arrrec: C# ----------
    // Component written by @garciadelcastillo

    // This component creates a list of transformations that,
    // when applied to an object, result in a 2D array of them.

    // Let's initialize the list of outputs.
    List<Transform> transforms = new List<Transform>();
    List<GeometryBase> transformed = new List<GeometryBase>();

    // Let's get the step size based on the dimensions of the rectangle.
    double dx = C.X.Length;
    double dy = C.Y.Length;

    // Create a list of move transforms with a triple nested loop:
    for (int j = 0; j < Y; j++)
    {
      double y = j * dy;
      for (int i = 0; i < X; i++)
      {
        double x = i * dx;

        Transform t = Transform.Translation(x, y, 0);
        transforms.Add(t);
      }
    }
    Xout = transforms;  // *

    // Apply it to the object and output it only if it exists
    if (G != null)
    {
      foreach (Transform t in transforms)
      {
        // Clone the object to avoid changing the original one.
        GeometryBase g = G.Duplicate();
        g.Transform(t);
        transformed.Add(g);
      }
      Gout = transformed;
    }

    // * NOTE:
    //   This transform stringifies to "Generic" because it doesn't use
    //   the GH-flavored transforms in Grasshopper.Kernel.Types.Transforms.
# ---------- end gh_arrrec ----------
geometry_9 = Panel(gh_arrrec.Gout)
geometry_10 = Panel(arrrec.Geometry)
transform_9 = Panel(arrrec.Transform)
transform_10 = Panel(gh_arrrec.Xout)

kscope = Kaleidoscope(Plane=PlaneXY(0, 0, 0), Segments=10)  # -> Geometry, Transform
