# Grasshopper definition Vector_Plane_Example.ghx (Grasshopper 1.0.7)

# ---- group: NOT PERFECT GROUP COLOR
list = ValueList({"Leave One": 1, "Cull All": 2, "Average": 3}, selected="Leave One")
number_slider = Slider(5.47, range=0..10)
pt = Point([Point(8.607951551, 2.486685842, 3.832204693), Point(5.778370651, 1.107439772, 8.712556827), Point(9.619506323, 4.670106799, 6.609386227), Point(8.388187749, 7.71604122, 0.5226170553), Point(9.149475926, 6.575188938, 3.664333324), Point(8.022716347, 4.327826013, 6.761694414)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])
gh_cullpt = CSharpScript(P=pt, T=number_slider, Option=list)  # -> out, POut, I, V; inputs P: list of Point3d, T: Double, Option: Int32
# ---------- gh_cullpt: C# ----------
    //Component written by @bava-kumaravel & @garciadelcastillo
    //Cull points in a Point cloud P that are within a tolerance T
    //and return culled points, the indices I retained and the valence V
    //of each point (number of points represented by a point)

    //Duplicate the input point list and store the input indices
    List<Point3d> inputP = P;
    List<int> inputI = new List<int>();
    for(int i = 0;i < inputP.Count;i++){
      inputI.Add(i);
    }

    //We take a square of the tolerance so we can compare with the
    //squared distances, because distance operations require square roots
    //which are very computationally expensive
    double sqrTol = T * T;

    //Define lists to hold the outputs
    List<Point3d> points = new List<Point3d>();
    List<int> indices = new List<int>();
    List<int> valence = new List<int>();

    //Option 1 - LEAVE ONE
    //Go through the list of input points and check if each point
    //has a duplicate. If yes, then leave the point only and cull all its
    //duplicates
    if(Option == 1){
      for(int i = 0; i < inputP.Count; i++){
        int index = -1;
        int valen = 1;
        for(int j = i + 1; j < inputP.Count; j++){
          if(inputP[i].DistanceToSquared(inputP[j]) <= sqrTol){
            //Remove the point at index j
            inputP.RemoveAt(j);
            inputI.RemoveAt(j);
            valen++;
            //Since a point is removed, the other points on the list
            //move one index forward, so the index is decreased by 1
            j--;
          }
        }
        //Add the checked point to the final output list
        points.Add(inputP[i]);
        index = inputI[i];
        indices.Add(index);
        valence.Add(valen);
      }
      
      //WIP Warning Message
      Component.AddRuntimeMessage(GH_RuntimeMessageLevel.Warning,
        "The valence values do not match those from the original component. Work in Progress.");
    }

      //Option 2 - CULL ALL
      //Go through the list of points and check if they have a duplicate
      //If yes, then cull all its duplicates and also cull the point too
    else if(Option == 2){
      for(int i = 0;i < inputP.Count;i++){
        //Define a boolean to check if a point has a duplicate
        bool duplicateFound = false;
        int valen = 1;
        int index = -1;
        for(int j = i + 1;j < inputP.Count;j++){
          if(inputP[i].DistanceToSquared(inputP[j]) <= sqrTol){
            //Remove the point at index j
            inputP.RemoveAt(j);
            inputI.RemoveAt(j);
            //Since a point is removed, the other points on the list
            //move one index forward, so the index is decreased by 1
            j--;
            duplicateFound = true;
          }
        }
        if(!duplicateFound){
          //Only add a point to the final list if its doesn't have a duplicate
          points.Add(inputP[i]);
          index = inputI[i];
          indices.Add(index);
          valence.Add(valen);
        }
      }
    }

      //Option 3 - AVERAGE
      //Go through the list of points and check if they have a duplicate
      //If yes, then calculate the average between them and return it
    else{
      for(int i = 0;i < inputP.Count;i++){
        Point3d point1 = inputP[i];
        int valen = 1;
        int index = -1;
        bool averaged = false;
        Point3d averagedPoint = point1;
        for(int j = i + 1;j < inputP.Count;j++){
          if(point1.DistanceToSquared(inputP[j]) <= sqrTol){
            //Take average between point i and j
            averagedPoint = AveragePoint(averagedPoint, inputP[j], valen, 1);
            //Remove the point j and its index from the list
            inputP.RemoveAt(j);
            inputI.RemoveAt(j);
            //Since a point is removed, the other points on the list
            //move one index forward, so the index is decreased by 1
            j--;
            valen++;
            averaged = true;
          }
        }

        points.Add(averagedPoint);
        if(!averaged){
          //If the point is not an average, retain its index.
          index = inputI[i];
        }
        indices.Add(index);
        valence.Add(valen);
      }

      //WIP Warning Message
      Component.AddRuntimeMessage(GH_RuntimeMessageLevel.Warning,
        "The outputs do not match those from the original component. Work in Progress.");
    }

    //Outputs
    POut = points;
    I = indices;
    V = valence;
# ---------- gh_cullpt: C# additional code ----------
  private Point3d AveragePoint(Point3d pointA, Point3d pointB, int valenA, int valenB){
    //Function to calculate cumulative average of point A and B
    //The points are multiplied by their valence(number of points each represents)
    //Then, the points are added and divided by the sum of the valence
    Point3d totalPointA = Point3d.Multiply(pointA, (double) valenA);
    Point3d totalPointB = Point3d.Multiply(pointB, (double) valenB);
    Point3d total = totalPointA + totalPointB;
    double num = (double) valenA + (double) valenB;
    Point3d averagePt = total / num;
    return averagePt;
  }
# ---------- end gh_cullpt ----------
cullpt = CullDuplicates(Points=pt, Tolerance=number_slider, CullMode=1)  # -> Points, Indices, Valence
panel = Panel(cullpt.Points)
panel_2 = Panel(gh_cullpt.POut)
panel_3 = Panel(cullpt.Indices)
panel_4 = Panel(gh_cullpt.I)
panel_5 = Panel(cullpt.Valence)
panel_6 = Panel(gh_cullpt.V)

# ---- group: Component Name
# GH#: A C# dictionary of Grasshopper3D components.
# 
# This file contains a category of Grasshopper components, and a mirroring C#/RhinoCommon implementation.
# 
# This is an educational project initiated by students/faculty of GSD-6338: Introduction to Computational Design, at the Harvard Graduate School of Design.
# 
# More information: {{project link}}
# Vector Plane
# NOTES
# 
# DEFINITION TEMPLATE
# -Use a scribble to denote the Tab and the sub-tab in which you are working. These can be set to size 50 and grouped in white. More details regarding the white colored groups below.
# 
# FILE NAMING
# tab_Subtab (ie. for this file the name would be vector_Plane
# 
# GROUPING
# - For each component, create a group with source geometry, the vanilla GH component, your interpretation, and panels comparing the outputs.
# - Group them using the colors described below.
# - Name the group with the full name of the vanilla component.
# 
# COMPONENTS
# - The order of the components should be the same as in the tab's sub-tab with the Grasshopper component above the C#.
# - A line created with a scribble should separate groups of components if that is found within the sub-tab.
# -Be sure to leave the out output on your C# components.
# -Try to get the inputs and outputs on the C# component as close as possible to the grasshopper component equivalent.
# - Each component C# Script component should be called "GH# NickName". For example, if the "Cull Duplicates" component is nicknamed "CullPt", then the component should be called "GH# CullPt".
# - Make sure to use the pain bucket to force the name to show up on the component, regardless of Show Icons state.
# -Be sure to use the same inputs for the grasshopper and C# components. Make sure that you are internalizing the referenced geometries into the components so that a Rhino file will not be needed.
# 
# CODE
# - Be sure to credit yourself by starting your components' code with the below comment.
# //Component written by @yourgithubusername
# - Please be very generous with comments explaining what's happening at every  step of the algorithm... remember it's an educational project for beginners :)
# - Be verbose: avoid shortcuts or complicated one-liners, declare interim variables, avoid using 'var'... remember it's an educational project for beginners :)
# 
# COLORS
# - Group the grasshopper and C# components in transparent white:
# 	Hue: 0
# 	Sat: 0
# 	Val: 90
# 	A: 150
# 
# - If the component is working, but not exactly as the original, group it with a transparent orange:
# 	Hue: 25
# 	Sat: 43
# 	Val: 100
# 	A: 150
# - If the component not implemented at all, wrap the original vanilla one in red:
# 	Hue: 0
# 	Sat: 60
# 	Val: 100
# 	A: 150
# 
# - Panels should be full white:
# 	Hue: 0
# 	Sat: 0
# 	Val: 100
# 	A: 255
# 
# 
# If you have any questions, comments, or concerns, please feel free to contact Jose Luis at jgarciadelcasti@gsd.harvard.edu
pt_2 = Point(Point(6.14131138, 9.497784469, 7.470016762))
pt_3 = Point([Point(8.607951551, 2.486685842, 3.832204693), Point(5.778370651, 1.107439772, 8.712556827), Point(9.619506323, 4.670106799, 6.609386227), Point(8.388187749, 7.71604122, 0.5226170553), Point(9.149475926, 6.575188938, 3.664333324), Point(8.022716347, 4.327826013, 6.761694414)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])
gh_cp = CSharpScript(P=pt_2, C=pt_3)  # -> out, POut, i, D; inputs P: Point3d, C: list of Point3d
# ---------- gh_cp: C# ----------
    //Component written by @bava-kumaravel
    //Find the closest point to the Point P in a cloud of points C

    //Create a Point Cloud from the list of Points C
    PointCloud ptCld = new PointCloud(C);

    //Find the index of the closest point to P in the point cloud
    int index = ptCld.ClosestPoint(P);

    //Use the index to retrieve the point from the list of points C
    Point3d point = C[index];

    //Find distance between Point P and the closest point
    double dist = P.DistanceTo(point);

    //Outputs
    POut = point;
    i = index;
    D = dist;
# ---------- end gh_cp ----------
cp = ClosestPoint(Point=pt_2, Cloud=pt_3)  # -> ClosestPoint, CPIndex, Distance
panel_7 = Panel(cp.CPIndex)
panel_8 = Panel(gh_cp.i)
panel_9 = Panel(cp.ClosestPoint)
panel_10 = Panel(cp.Distance)
panel_11 = Panel(gh_cp.POut)
panel_12 = Panel(gh_cp.D)

# ---- group: NOT IMPLEMENTED GROUP COLOR
crv = Curve([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])
srf = Surface(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)
gh_srfsplit = CSharpScript(S=srf, C=crv)  # -> Out, F
srfsplit = SurfaceSplit(Surface=srf, Curves=crv)
panel_13 = Panel(srfsplit)
panel_14 = Panel(gh_srfsplit.F)
