# Grasshopper definition JLX_utils.gh (Grasshopper 1.0.7)

panel = Panel("""0
15
24
33
45""")
panel_2 = Panel("""0
15
24
33
45
20
3
56""")
mesh = Mesh(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)
mesh_2 = Mesh(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)
jlx_meshcoloring = CSharpScript(x=mesh_2, y=Slider(9, range=0..10))  # -> out, A; inputs x: Mesh, y: Int32
# ---------- jlx_meshcoloring: C# ----------
    //x.VertexColors.CreateMonotoneMesh(System.Drawing.Color.White);

    for (int i = 0 ; i < x.Vertices.Count; i++) {
      int id = i % y;

      switch (id) {
        case 0: x.VertexColors.Add(0, 0, 0); break;
        case 2: x.VertexColors.Add(255, 0, 0); break;
        case 4: x.VertexColors.Add(0, 255, 0); break;
        case 6: x.VertexColors.Add(0, 0, 255); break;
        default: x.VertexColors.Add(255, 255, 255); break;
      }
    }

    A = x;
# ---------- end jlx_meshcoloring ----------
jlx_faceflipping = CSharpScript(x=mesh, y=panel_2)  # -> out, A; inputs x: Mesh, y: list of Int32
# ---------- jlx_faceflipping: C# ----------
    for (int i = 0; i < y.Count; i++) {
      MeshFace flipped = x.Faces[y[i]].Flip();
      x.Faces[y[i]] = flipped;
    }



    A = x;
# ---------- end jlx_faceflipping ----------
mesh_3 = Mesh(jlx_meshcoloring.A)
mesh_4 = Mesh(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)
